# Grasshopper definition Letter B.gh (Grasshopper 0.9.76)

pt = ConstructPoint(XCoordinate=Slider(0, range=0..200), YCoordinate=Slider(0, range=0..220), ZCoordinate=0)
rectangle = Rectangle(Plane=PlaneXY(0, 0, 0), XSize=Slider(200, range=0..220), YSize=Slider(220, range=0..220), Radius=0)  # -> Rectangle, Length
pt_2 = ConstructPoint(XCoordinate=Slider(131.351, range=0..200), YCoordinate=Slider(0, range=0..220), ZCoordinate=0)
pt_3 = ConstructPoint(XCoordinate=Slider(0, range=0..200), YCoordinate=Slider(191.84, range=0..220), ZCoordinate=0)
pt_4 = ConstructPoint(XCoordinate=Slider(150.231, range=0..200), YCoordinate=Slider(135.015, range=0..220), ZCoordinate=0)
pt_5 = ConstructPoint(XCoordinate=Slider(200, range=0..200), YCoordinate=Slider(68.26, range=0..220), ZCoordinate=0)
pt_6 = ConstructPoint(XCoordinate=Slider(90.26, range=0..200), YCoordinate=Slider(217.184, range=0..220), ZCoordinate=0)
crv = Curve(rectangle.Rectangle)
vec2pt = Vector2Pt(PointA=pt_4, PointB=pt_2, Unitize=False)  # -> Vector, Length
vec2pt_2 = Vector2Pt(PointA=pt_3, PointB=pt_6, Unitize=False)  # -> Vector, Length
ln = Line(StartPoint=pt, EndPoint=pt_3)
ln_2 = Line(StartPoint=pt_3, EndPoint=pt_6)
ln_3 = Line(StartPoint=pt, EndPoint=pt_2)
arc = ArcSED(Start=pt_6, End=pt_4, Direction=vec2pt_2.Vector)  # -> Arc, Plane, Radius
arc_2 = Arc3Pt(PointA=pt_4, PointB=pt_5, PointC=pt_2)  # -> Arc, Plane, Radius
join = JoinCurves(Curves=[ln, arc_2.Arc, ln_2, ln_3, arc.Arc], Preserve=False)
crv_2 = Curve(graft([<curve referenced from the Rhino model> x2]))
Y = UnitY(Factor=Slider(367.967, range=0..500))
move = Move(Geometry=join, Motion=Y)  # -> Geometry, Transform
explode = Explode(Curve=join, Recursive=True)  # -> flatten(Segments), Vertices
explode_2 = Explode(Curve=crv_2, Recursive=True)  # -> flatten(Segments), Vertices
number_slider = Slider(19.84, range=0..400)
number_slider_2 = Slider(70, range=20..70)
ply_thickness = Slider(3, range=0..10)
expression = Expression(x=number_slider_2, Expression="x*2")
expression_2 = Expression(x=number_slider_2, Expression="x*2")
lng = ListLength(List=explode.Segments)
len = Length(Curve=explode.Segments)
lng_2 = ListLength(List=explode_2.Segments)
len_2 = Length(Curve=explode_2.Segments)
crv_3 = Curve(<curve referenced from the Rhino model>)
crv_4 = Curve(<curve referenced from the Rhino model>)
crv_5 = Curve(<curve referenced from the Rhino model>)
series = Series(Start=0, Step=expression, Count=lng)
offset = Offset(Curve=crv_3, Distance=number_slider, Plane=PlaneXY(0, 0, 0), Corners=1)
merge = Merge(Data1=crv_2, Data2=join)
series_2 = Series(Start=0, Step=expression_2, Count=lng_2)
offset_2 = Offset(Curve=crv_4, Distance=number_slider, Plane=PlaneXY(0, 0, 0), Corners=1)
offset_3 = Offset(Curve=crv_5, Distance=number_slider, Plane=PlaneXY(0, 0, 0), Corners=1)
expression_3 = Expression(x=number_slider_2, y=ply_thickness, Expression="x-(2*y)")
Z = UnitZ(Factor=number_slider_2)
flip = FlipCurve(Curve=offset_2)  # -> Curve, Flag
loft = Loft(
    Curves=flatten([crv_3, offset]),
    Options={Adjust=False, Closed=False, LoftEnds=0, LoftSimp=0, LoftType=0, Rebuild=10, Refit=0.01})
end = EndPoints(Curve=crv_5)  # -> Start, End
end_2 = EndPoints(Curve=offset_3)  # -> Start, End
boundary = BoundarySurfaces(Edges=flatten(merge))
pt_7 = ConstructPoint(XCoordinate=Slider(231, range=0..500), YCoordinate=series, ZCoordinate=0)
pt_8 = ConstructPoint(XCoordinate=Slider(500, range=0..500), YCoordinate=series_2, ZCoordinate=0)
crv_6 = Curve(loft)
flatten = FlattenTree(Tree=[crv_4, flip.Curve], Path="{0}")
ln_4 = Line(StartPoint=end.Start, EndPoint=end_2.Start)
ln_5 = Line(StartPoint=end.End, EndPoint=end_2.End)
xy = XYPlane(Origin=pt_7)
xy_2 = XYPlane(Origin=pt_8)
extr = Extrude(Base=boundary, Direction=Z)
connect = ConnectCurves(Curves=flatten, Continuity=0, Close=True, Bulge=1)
join_2 = JoinCurves(Curves=flatten([crv_5, offset_3, ln_4, ln_5]), Preserve=False)
rectangle_2 = Rectangle(Plane=xy, XSize=len, YSize=expression_3, Radius=0)  # -> Rectangle, Length
rectangle_3 = Rectangle(Plane=xy_2, XSize=len_2, YSize=expression_3, Radius=0)  # -> Rectangle, Length
simplify = SimplifyCurve(Curve=join_2, Tolerance=Slider(6.017, range=0..100))  # -> Curve, Simplified
explode_3 = Explode(Curve=simplify.Curve, Recursive=True)  # -> Segments, Vertices
panel = Panel(explode_3.Segments)
