# Grasshopper definition Living Hinge.gh (Grasshopper 0.9.76)

crv = Curve(<curve referenced from the Rhino model>)
crv_2 = Curve(<curve referenced from the Rhino model>)
len = Length(Curve=crv)
expression = Expression(x=len, y=Slider(2, range=0..10), Expression="x/y")
divide = DivideCurve(Curve=crv, Count=expression, Kinks=False)  # -> Points, Tangents, Parameters
divide_2 = DivideCurve(Curve=crv_2, Count=expression, Kinks=False)  # -> Points, Tangents, Parameters
ln = Line(StartPoint=divide.Points, EndPoint=divide_2.Points)
bool = Boolean([True, False])
number_slider = Slider(1.74, range=0..5)
D = Domain(Domain(0, 1))
dispatch = Dispatch(List=ln, DispatchPattern=bool)  # -> ListA, ListB
range = Range(Domain=D, Steps=Slider(7, range=0..10))
crv_3 = Curve(dispatch.ListB)
crv_4 = Curve(dispatch.ListA)
rev = ReverseList(List=range)
ext = ExtendCurve(Curve=crv_3, Type=0, Start=expr("x/2", number_slider), End=expr("x/2", number_slider))
panel = Panel("x/2")
ext_2 = ExtendCurve(Curve=crv_4, Type=0, Start=expr("x/2", number_slider), End=expr("x/2", number_slider))
cull_i = CullIndex(List=rev, Indices=0, Wrap=True)
rev_2 = ReverseList(List=cull_i)
cull_i_2 = CullIndex(List=rev_2, Indices=0, Wrap=True)  # -> flatten(List)
dispatch_2 = Dispatch(List=cull_i_2, DispatchPattern=bool)  # -> ListA, ListB
shatter = Shatter(Curve=reparameterize(ext), Parameters=dispatch_2.ListB)
shatter_2 = Shatter(Curve=reparameterize(ext_2), Parameters=dispatch_2.ListA)
panel_3 = Panel("-x/2")
ext_3 = ExtendCurve(Curve=shatter, Type=0, Start=expr("-x/2", number_slider), End=expr("-x/2", number_slider))
ext_4 = ExtendCurve(Curve=shatter_2, Type=0, Start=expr("-x/2", number_slider), End=expr("-x/2", number_slider))
