# Grasshopper definition MT001 - AB Comments.gh (Grasshopper 0.9.76)

number_slider = Slider(204, range=0..204)
number_slider_2 = Slider(0, range=0..100)
mid_pos = Slider(145, range=0..204)
number_slider_3 = Slider(150, range=0..226)
number_slider_4 = Slider(0, range=0..100)
rectangle = Rectangle(Plane=PlaneXY(0, 0, 0), XSize=Slider(204, range=0..1000), YSize=Slider(226, range=0..1000), Radius=0)  # -> Rectangle, Length
pt = ConstructPoint(XCoordinate=number_slider_4, YCoordinate=number_slider_3, ZCoordinate=0)
pt_2 = ConstructPoint(XCoordinate=number_slider_4, YCoordinate=number_slider_2, ZCoordinate=0)
pt_3 = ConstructPoint(XCoordinate=number_slider, YCoordinate=number_slider_2, ZCoordinate=0)
pt_4 = ConstructPoint(XCoordinate=number_slider, YCoordinate=number_slider_3, ZCoordinate=0)
pt_5 = ConstructPoint(XCoordinate=mid_pos, YCoordinate=Slider(150, range=0..226), ZCoordinate=0)
ln = Line(StartPoint=pt_4, EndPoint=pt_3)
vec2pt = Vector2Pt(PointA=pt_2, PointB=pt, Unitize=False)  # -> Vector, Length
vec2pt_2 = Vector2Pt(PointA=pt_3, PointB=pt_4, Unitize=False)  # -> Vector, Length
arc = ArcSED(Start=pt, End=pt_5, Direction=vec2pt.Vector)  # -> Arc, Plane, Radius
ln_2 = Line(StartPoint=pt_2, EndPoint=pt)
thickness = Slider(33, range=0..100)
join = JoinCurves(Curves=flatten([arc.Arc, ln_2]), Preserve=False)
mid_height = Slider(74, range=0..1000)
offset = Offset(Curve=ln_2, Distance=thickness, Plane=PlaneXY(0, 0, 0), Corners=1)
offset_2 = Offset(Curve=join, Distance=thickness, Plane=PlaneXY(0, 0, 0), Corners=1)
expression = Expression(x=mid_height, Expression="-x")
end = EndPoints(Curve=offset_2)  # -> Start, End
arc_2 = ArcSED(Start=pt_4, End=end.End, Direction=vec2pt_2.Vector)  # -> Arc, Plane, Radius
join_2 = JoinCurves(Curves=flatten([arc_2.Arc, ln]), Preserve=False)
offset_3 = Offset(Curve=join_2, Distance=thickness, Plane=PlaneXY(0, 0, 0), Corners=1)
Y = UnitY(Factor=1)
edgesrf = EdgeSurface(CurveA=join_2, CurveB=offset_3)
expression_2 = Expression(x=thickness, Expression="-x")
line = LineSDL(Start=end.End, Direction=Y, Length=expression)
edgesrf_2 = EdgeSurface(CurveA=join, CurveB=offset_2)
offset_4 = Offset(Curve=line, Distance=expression_2, Plane=PlaneXY(0, 0, 0), Corners=1)
number_slider_5 = Slider(34, range=0..64)

# ---- group: 3
# Planar surfaces
# Living Hinge Surfaces
crv = Curve(offset_3)
crv_2 = Curve(offset_4)
crv_3 = Curve(join_2)
crv_4 = Curve(line)
# 3: We join the curves together, I do it this way so I don't lose the Arcs.
join_3 = JoinCurves(Curves=flatten([offset_2, line]), Preserve=False)
join_4 = JoinCurves(Curves=flatten([join, offset_4]), Preserve=False)
join_5 = JoinCurves(Curves=flatten([crv, crv_2]), Preserve=False)
join_6 = JoinCurves(Curves=flatten([crv_3, crv_4]), Preserve=False)
end_2 = EndPoints(Curve=join_3)  # -> Start, End
end_3 = EndPoints(Curve=join_4)  # -> Start, End
end_4 = EndPoints(Curve=join_5)  # -> Start, End
end_5 = EndPoints(Curve=join_6)  # -> Start, End
ln_3 = Line(StartPoint=end_2.Start, EndPoint=end_3.Start)
ln_4 = Line(StartPoint=end_2.End, EndPoint=end_3.End)
ln_5 = Line(StartPoint=end_4.Start, EndPoint=end_5.Start)
ln_6 = Line(StartPoint=end_4.End, EndPoint=end_5.End)
join_7 = JoinCurves(Curves=flatten([join_3, join_4, ln_3, ln_4]), Preserve=False)
join_8 = JoinCurves(Curves=flatten([join_5, join_6, ln_5, ln_6]), Preserve=False)
# 3: The list of exploded curves are shifted so that the first curve is the shared surface.
explode = Explode(Curve=join_7, Recursive=True)  # -> Segments, Vertices
explode_2 = Explode(Curve=join_8, Recursive=True)  # -> Segments, Vertices
shift = ShiftList(List=explode.Segments, Shift=2, Wrap=True)
shift_2 = ShiftList(List=explode_2.Segments, Shift=6, Wrap=True)
len = Length(Curve=shift)
len_2 = Length(Curve=shift_2)
consec = ConsecutiveDomains(Numbers=len, Additive=True)
consec_2 = ConsecutiveDomains(Numbers=len_2, Additive=True)
dedomain = DeconstructDomain(Domain=consec)  # -> Start, End
dedomain_2 = DeconstructDomain(Domain=consec_2)  # -> Start, End
int = Integer(0)
int_2 = Integer(0)
merge = Merge(Data1=flatten(int), Data2=flatten(dedomain.Start))
merge_2 = Merge(Data1=flatten(int_2), Data2=flatten(dedomain_2.Start))
# 3: I've layed the rectangles out so that they are touching, and then breaks are added manually (Its rather advanced to show you an automated way).
int_3 = Integer([0, 0, 0, 100, 200, 200, 200, 300])
int_4 = Integer([0, 0, 0, 100, 200, 200, 200, 300])
expression_3 = Expression(x=int_3, y=merge, Expression="x+y")
expression_4 = Expression(x=int_4, y=merge_2, Expression="x+y")
pt_6 = ConstructPoint(XCoordinate=expression_3, YCoordinate=0, ZCoordinate=0)
pt_7 = ConstructPoint(XCoordinate=expression_4, YCoordinate=number_slider_5, ZCoordinate=0)
# 3: The rectables are the dispatched into the panels that should be living hinged, and not.
# You will need to manually edit the baked rectangles to remove splits between some of your living hinges and planar elements.
rectangle_2 = Rectangle(Plane=pt_6, XSize=len, YSize=number_slider_5, Radius=0)  # -> Rectangle, Length
rectangle_3 = Rectangle(Plane=pt_7, XSize=len_2, YSize=number_slider_5, Radius=0)  # -> Rectangle, Length
panel = Panel("""0
1
0
0
0
1
0
0""")
dispatch = Dispatch(List=rectangle_2.Rectangle, DispatchPattern=panel)  # -> ListA, ListB
dispatch_2 = Dispatch(List=rectangle_3.Rectangle, DispatchPattern=panel)  # -> ListA, ListB
crv_5 = Curve([dispatch.ListB, dispatch_2.ListB])
crv_6 = Curve([dispatch.ListA, dispatch_2.ListA])

# ----
edgesrf_3 = EdgeSurface(CurveA=line, CurveB=offset_4)

# ---- group: 1
# 1: These BREP joins are required before you merge the surfaces.
join_9 = BrepJoin(Breps=flatten([edgesrf_2, edgesrf_3]))  # -> Breps, Closed
join_10 = BrepJoin(Breps=flatten([edgesrf_3, edgesrf]))  # -> Breps, Closed

# ----
expression_5 = Expression(x=number_slider_5, Expression="-(64-x)")

explode_3 = Explode(Curve=edgesrf, Recursive=True)  # -> Segments, Vertices
expression_6 = Expression(x=Slider(32, range=0..70), Expression="x*2")
lng = ListLength(List=explode_3.Segments)
len_3 = Length(Curve=explode_3.Segments)
series = Series(Start=0, Step=expression_6, Count=lng)
pt_8 = ConstructPoint(XCoordinate=Slider(249, range=0..500), YCoordinate=series, ZCoordinate=0)
xy = XYPlane(Origin=pt_8)
rectangle_4 = Rectangle(Plane=xy, XSize=len_3, YSize=expression_5, Radius=0)  # -> Rectangle, Length
panel_2 = Panel(series)

fmerge = MergeFaces(Brep=join_9.Breps)  # -> Breps, Before, After
fmerge_2 = MergeFaces(Brep=join_10.Breps)  # -> Breps, Before, After
Z = UnitZ(Factor=number_slider_5)
Z_2 = UnitZ(Factor=expression_5)
extr = Extrude(Base=fmerge.Breps, Direction=Z)
extr_2 = Extrude(Base=fmerge_2.Breps, Direction=Z_2)

# ---- group: 2
crv_7 = Curve(fmerge.Breps)
crv_8 = Curve(fmerge_2.Breps)
# 2: The surfaces are converted to curves, so that we can use curve functions. Then we can use a region difference to cut the shapes from each other.
rdiff = RegionDifference(CurvesA=crv_7, CurvesB=crv_8)
rdiff_2 = RegionDifference(CurvesA=crv_8, CurvesB=crv_7)
# Cut shapes
crv_9 = Curve(rdiff)
crv_10 = Curve(rdiff_2)

# ----
explode_4 = Explode(Curve=edgesrf_2, Recursive=True)  # -> Segments, Vertices
expression_7 = Expression(x=Slider(32, range=0..70), Expression="x*2")
lng_2 = ListLength(List=explode_4.Segments)
len_4 = Length(Curve=explode_4.Segments)
series_2 = Series(Start=0, Step=expression_7, Count=lng_2)
panel_3 = Panel(series_2)

expression_8 = Expression(x=Slider(249, range=0..500), Expression="-x")

pt_9 = ConstructPoint(XCoordinate=expression_8, YCoordinate=series_2, ZCoordinate=0)
xy_2 = XYPlane(Origin=pt_9)
rectangle_5 = Rectangle(Plane=xy_2, XSize=len_4, YSize=expression_5, Radius=0)  # -> Rectangle, Length
