# Grasshopper definition FC003 - AB Comments.gh (Grasshopper 0.9.76)

number_slider = Slider(20, range=0..70)
number_slider_2 = Slider(28, range=0..70)
geo = Geometry(<brep referenced from the Rhino model>)
geo_2 = Geometry(<brep referenced from the Rhino model>)
range = Range(Domain=Slider(200, range=0..200), Steps=number_slider)
range_2 = Range(Domain=Slider(70, range=0..70), Steps=number_slider_2)
range_3 = Range(Domain=Slider(200, range=0..200), Steps=number_slider)
range_4 = Range(Domain=Slider(200, range=0..200), Steps=number_slider_2)
xz = XZPlane(Origin=Point(0, 0, 0))
Y = UnitY(Factor=range)
Z = UnitZ(Factor=range_2)
xy = XYPlane(Origin=Point(0, 0, 0))
yz = YZPlane(Origin=Point(0, 0, 0))
yz_2 = YZPlane(Origin=Point(0, 0, 0))
X = UnitX(Factor=range_3)
X_2 = UnitX(Factor=range_4)
move = Move(Geometry=xz, Motion=Y)  # -> Geometry, Transform
move_2 = Move(Geometry=xy, Motion=Z)  # -> Geometry, Transform
pop3d = Populate3D(Region=geo, Count=Slider(20, range=0..20), Seed=Slider(4, range=0..10))
# 1: Your original threshold value was too high.
# Thresholds normaly have to be super low for this to work. To make it easier for you to generate a super low threshold without hitting zero (because zero breaks this), you can divide 1 by a number. The higher the number, the lower the result.
pop3d_2 = Populate3D(Region=geo_2, Count=Slider(20, range=0..20), Seed=Slider(4, range=0..10))
move_3 = Move(Geometry=yz, Motion=X)  # -> Geometry, Transform
move_4 = Move(Geometry=yz_2, Motion=X_2)  # -> Geometry, Transform

# ---- group: 1
expression = Expression(x=Slider(395.094, range=1..500), Expression="1/x")

# ----
expression_2 = Expression(x=Slider(388.962, range=1..500), Expression="1/x")
data = Data(move.Geometry)
data_2 = Data(move_3.Geometry)

# ---- group: 2
metaball_t = MetaBallT(Points=pop3d, Plane=move.Geometry, Threshold=expression_2)  # -> simplify(Isocurve)
metaball_t_2 = MetaBallT(Points=pop3d, Plane=move_3.Geometry, Threshold=expression_2)  # -> simplify(Isocurve)
sec = BrepPlane(Brep=geo, Plane=move.Geometry)  # -> simplify(Curves), Points
graft = GraftTree(Tree=move_3.Geometry, IncludeEmptyLists=True, IncludeNullItems=True)  # -> simplify(Tree)
graft_2 = GraftTree(Tree=move.Geometry, IncludeEmptyLists=True, IncludeNullItems=True)  # -> simplify(Tree)
sec_2 = BrepPlane(Brep=geo, Plane=move_3.Geometry)  # -> simplify(Curves), Points
trim = TrimWithRegions(Curve=metaball_t, Regions=sec.Curves, Plane=graft_2)  # -> Inside, Outside
trim_2 = TrimWithRegions(Curve=sec.Curves, Regions=metaball_t, Plane=graft_2)  # -> Inside, Outside
trim_3 = TrimWithRegions(Curve=sec_2.Curves, Regions=metaball_t_2, Plane=graft)  # -> Inside, Outside
trim_4 = TrimWithRegions(Curve=metaball_t_2, Regions=sec_2.Curves, Plane=graft)  # -> Inside, Outside
crv = Curve(trim_2.Inside)
crv_2 = Curve(trim.Inside)
crv_3 = Curve(trim_4.Inside)
crv_4 = Curve(trim_3.Inside)
trim_5 = TrimTree(Tree=crv, Depth=1)
trim_6 = TrimTree(Tree=crv_2, Depth=1)
trim_7 = TrimTree(Tree=crv_3, Depth=1)
trim_8 = TrimTree(Tree=crv_4, Depth=1)
merge = Merge(Data1=trim_6, Data2=trim_5)
merge_2 = Merge(Data1=trim_8, Data2=trim_7)
join = JoinCurves(Curves=merge, Preserve=False)  # -> simplify(Curves)
join_2 = JoinCurves(Curves=merge_2, Preserve=False)  # -> simplify(Curves)

# ----
metaball_t_3 = MetaBallT(Points=pop3d_2, Plane=move_2.Geometry, Threshold=expression)
# 2: You have created a rather annoying problem for yourself by going down the route of making a script that uses metaballs.
# 
# 1) Metaballs don't simply turn into a mesh, you have to use complex processes to get that to work (marching cubes)
# 
# 2) The script we wrote in class doesn't deal with meshes, it deals with breps.
# 
# Fortuneate solution:
# Meta balls generate curves in space relative to a plane, exactly like a waffle. So, you can skip the meshing and cutting process, cause you already have the curves that you would have had if you did that process.
# Below is probably the best way to deal with these so they can then plug into the waffle script we did.
# 
# NOTE: You are probably going to have a very similar problem to Matt. You can download his most recent scripts from Github to see the solution.
metaball_t_4 = MetaBallT(Points=pop3d_2, Plane=move_4.Geometry, Threshold=expression)  # -> flatten(Isocurve)
graft_3 = GraftTree(Tree=data, IncludeEmptyLists=True, IncludeNullItems=True)  # -> simplify(Tree)
graft_4 = GraftTree(Tree=data_2, IncludeEmptyLists=True, IncludeNullItems=True)  # -> simplify(Tree)
lng = ListLength(List=data)
lng_2 = ListLength(List=data_2)
flatten = FlattenTree(Tree=metaball_t_3, Path="{0}")
explode = Explode(Curve=flatten, Recursive=True)  # -> Segments, flatten(Vertices)
series = Series(Start=0, Step=Slider(100.35, range=0..500), Count=lng)
series_2 = Series(Start=0, Step=Slider(100.35, range=0..500), Count=lng_2)
pt = ConstructPoint(XCoordinate=Slider(0, range=0..500), YCoordinate=series, ZCoordinate=0)
pt_2 = ConstructPoint(XCoordinate=Slider(219.2, range=0..500), YCoordinate=series_2, ZCoordinate=0)
xy_2 = XYPlane(Origin=pt)
xy_3 = XYPlane(Origin=pt_2)
boundary = BoundarySurfaces(Edges=simplify(join))
boundary_2 = BoundarySurfaces(Edges=simplify(join_2))
graft_5 = GraftTree(Tree=xy_2, IncludeEmptyLists=True, IncludeNullItems=True)  # -> simplify(Tree)
graft_6 = GraftTree(Tree=xy_3, IncludeEmptyLists=True, IncludeNullItems=True)  # -> simplify(Tree)
orient = Orient(Geometry=join, Source=graft_3, Target=graft_5)  # -> Geometry, Transform
orient_2 = Orient(Geometry=join_2, Source=graft_4, Target=graft_6)  # -> Geometry, Transform
graft_7 = GraftTree(Tree=boundary_2, IncludeEmptyLists=True, IncludeNullItems=True)
graft_8 = GraftTree(Tree=boundary, IncludeEmptyLists=True, IncludeNullItems=True)
flatten_2 = FlattenTree(Tree=boundary_2, Path="{0}")
flatten_3 = FlattenTree(Tree=boundary, Path="{0}")
bbx = BrepBrep(BrepA=graft_7, BrepB=flatten_3)  # -> Curves, Points
bbx_2 = BrepBrep(BrepA=graft_8, BrepB=flatten_2)  # -> Curves, Points
D = Depth(2)
crv_5 = Curve(bbx.Curves)
crv_6 = Curve(bbx_2.Curves)
trim_9 = TrimTree(Tree=crv_5, Depth=D)
trim_10 = TrimTree(Tree=crv_6, Depth=D)
orient_3 = Orient(Geometry=trim_10, Source=graft_3, Target=graft_5)  # -> Geometry, Transform
orient_4 = Orient(Geometry=trim_9, Source=graft_4, Target=graft_6)  # -> Geometry, Transform
