# Grasshopper definition MT001 - AB Comments.gh (Grasshopper 0.9.76)

number_slider = Slider(16, range=0..50)
number_slider_2 = Slider(34, range=0..50)
number_slider_3 = Slider(40, range=0..100)
number_slider_4 = Slider(50, range=0..100)
number_slider_5 = Slider(35, range=0..100)
number_slider_6 = Slider(226, range=0..226)
number_slider_7 = Slider(40, range=0..100)
number_slider_8 = Slider(102, range=0..204)
number_slider_9 = Slider(25, range=0..50)
number_slider_10 = Slider(113, range=0..226)
int = Integer(204)
int_2 = Integer(204)
number_slider_11 = Slider(53, range=0..100)
subtraction = Subtraction(A=int_2, B=number_slider_4)
subtraction_2 = Subtraction(A=int_2, B=number_slider_5)
subtraction_3 = Subtraction(A=int, B=number_slider_11)
pt = ConstructPoint(XCoordinate=0, YCoordinate=number_slider_10, ZCoordinate=0)
pt_2 = ConstructPoint(XCoordinate=Slider(102, range=0..1000), YCoordinate=number_slider_10, ZCoordinate=Slider(17, range=0..100))
pt_3 = ConstructPoint(XCoordinate=subtraction_3, YCoordinate=number_slider_10, ZCoordinate=number_slider_3)
pt_4 = ConstructPoint(XCoordinate=Slider(204, range=0..1000), YCoordinate=number_slider_10, ZCoordinate=0)
pt_5 = ConstructPoint(XCoordinate=number_slider_11, YCoordinate=number_slider_10, ZCoordinate=number_slider_3)
pt_6 = ConstructPoint(XCoordinate=number_slider_5, YCoordinate=number_slider_2, ZCoordinate=0)
pt_7 = ConstructPoint(XCoordinate=number_slider_4, YCoordinate=number_slider, ZCoordinate=number_slider_9)
pt_8 = ConstructPoint(XCoordinate=number_slider_8, YCoordinate=0, ZCoordinate=number_slider_7)
pt_9 = ConstructPoint(XCoordinate=subtraction, YCoordinate=number_slider, ZCoordinate=number_slider_9)
pt_10 = ConstructPoint(XCoordinate=subtraction_2, YCoordinate=number_slider_2, ZCoordinate=0)
pt_11 = ConstructPoint(XCoordinate=number_slider_5, YCoordinate=number_slider_6, ZCoordinate=0)
pt_12 = ConstructPoint(XCoordinate=number_slider_4, YCoordinate=number_slider_6, ZCoordinate=number_slider_9)
pt_13 = ConstructPoint(XCoordinate=number_slider_8, YCoordinate=number_slider_6, ZCoordinate=number_slider_7)
pt_14 = ConstructPoint(XCoordinate=subtraction, YCoordinate=number_slider_6, ZCoordinate=number_slider_9)
pt_15 = ConstructPoint(XCoordinate=subtraction_2, YCoordinate=number_slider_6, ZCoordinate=0)
intcrv = Interpolate(Vertices=[pt_6, pt_7, pt_8, pt_9, pt_10], Degree=3, Periodic=False, KnotStyle=1)  # -> Curve, Length, Domain
intcrv_2 = Interpolate(Vertices=[pt_11, pt_12, pt_13, pt_14, pt_15], Degree=3, Periodic=False, KnotStyle=1)  # -> Curve, Length, Domain
intcrv_3 = Interpolate(Vertices=[pt, pt_5, pt_2, pt_3, pt_4], Degree=3, Periodic=False, KnotStyle=1)  # -> Curve, Length, Domain
loft = Loft(
    Curves=[intcrv.Curve, intcrv_3.Curve, intcrv_2.Curve],
    Options={Adjust=False, Closed=False, LoftEnds=0, LoftSimp=0, LoftType=0, Rebuild=10, Refit=0.01})
# Is it possible to extrude normal to a curved surface, I'm not sure if I'm over complicating it, but I've tried a bunch of different methods and can only get the surface to extrude in one direction (like the z vector) if that makes sense.
# 
# I have attached my GH file with the loft I want to extrude and my attempt to find the normal's and extrude along them.
sdivide = DivideSurface(Surface=loft, UCount=10, VCount=10)  # -> Points, Normals, Parameters
divide = DivideDomain²(Domain=loft, UCount=Slider(7, range=0..20), VCount=Slider(10, range=0..20))
srf_cp = SurfaceClosestPoint(Point=sdivide.Points, Surface=loft)  # -> Point, UVPoint, Distance
subsrf = Isotrim(Surface=loft, Domain=divide)
evalsrf = EvaluateSurface(Surface=loft, Point=sdivide.Parameters)  # -> Point, Normal, Frame
number_slider_12 = Slider(29, range=0..50)

# ---- group: 2
pt_16 = ConstructPoint(XCoordinate=0.5, YCoordinate=0.5, ZCoordinate=0)
evalsrf_2 = EvaluateSurface(Surface=reparameterize(subsrf), Point=pt_16)  # -> Point, Normal, Frame
rev = Reverse(Vector=evalsrf_2.Normal)
amp = Amplitude(Vector=rev, Amplitude=number_slider_12)
extr = Extrude(Base=subsrf, Direction=amp)

# ----
# 2: Here we are taking the subsurfaces you have created, and evaluating the center of each.
# Evaluate gives you a normal along with a point.
# We use the normal to extrude the surfaces... Mango.
area = Area(Geometry=subsrf)  # -> Area, Centroid
panel = Panel(pt_16)
amp_2 = Amplitude(Vector=evalsrf.Normal, Amplitude=number_slider_12)
srf_cp_2 = SurfaceClosestPoint(Point=area.Centroid, Surface=loft)  # -> Point, UVPoint, Distance

# ----
# Not 100% on the extrusion you are looking for, so I've done two.
rev_2 = Reverse(Vector=sdivide.Normals)
# 1: This is taking the points from the surface division, assinging a "Start, Direction and Length" line at those points (along with the normals). These are then lofted.
line = LineSDL(Start=sdivide.Points, Direction=rev_2, Length=number_slider_12)
loft_2 = Loft(Curves=line, Options={Adjust=False, Closed=False, LoftEnds=0, LoftSimp=0, LoftType=0, Rebuild=10, Refit=0.01})

evalsrf_3 = EvaluateSurface(Surface=loft, Point=srf_cp_2.UVPoint)  # -> Point, Normal, Frame
amp_3 = Amplitude(Vector=evalsrf_3.Normal, Amplitude=number_slider_12)
extr_2 = Extrude(Base=loft, Direction=amp_3)
