# Grasshopper definition MT002 - AB Comments.gh (Grasshopper 0.9.76)

inside_z = Slider(25, range=0..50)
inside_x = Slider(50, range=0..100)
inside_y = Slider(16, range=0..50)
middle_x = Slider(102, range=0..204)
middle_z = Slider(40, range=0..100)
outside_y = Slider(34, range=0..50)
outside_x = Slider(35, range=0..100)
y_max = Slider(226, range=0..226)
inside_z_2 = Slider(40, range=0..100)
inside_x_2 = Slider(53, range=0..100)
number_slider = Slider(0, range=0..100)
int = Integer(204)
number_slider_2 = Slider(300, range=0..300)
number_slider_3 = Slider(-50, range=-50..50)
number_slider_4 = Slider(300, range=0..300)
subtraction = Subtraction(A=int, B=inside_x)
subtraction_2 = Subtraction(A=int, B=outside_x)
subtraction_3 = Subtraction(A=y_max, B=outside_y)
subtraction_4 = Subtraction(A=y_max, B=inside_y)
int_2 = Integer(204)
subtraction_5 = Subtraction(A=int_2, B=inside_x_2)
subtraction_6 = Subtraction(A=Slider(204, range=0..204), B=number_slider)
pt = ConstructPoint(XCoordinate=number_slider, YCoordinate=113, ZCoordinate=0)
pt_2 = ConstructPoint(XCoordinate=Slider(102, range=0..204), YCoordinate=113, ZCoordinate=Slider(17, range=0..50))
pt_3 = ConstructPoint(XCoordinate=subtraction_5, YCoordinate=113, ZCoordinate=inside_z_2)
pt_4 = ConstructPoint(XCoordinate=subtraction_6, YCoordinate=113, ZCoordinate=0)
pt_5 = ConstructPoint(XCoordinate=inside_x_2, YCoordinate=113, ZCoordinate=inside_z_2)
pt_6 = ConstructPoint(XCoordinate=number_slider_3, YCoordinate=number_slider_4, ZCoordinate=0)
pt_7 = ConstructPoint(XCoordinate=number_slider_2, YCoordinate=number_slider_4, ZCoordinate=0)
pt_8 = ConstructPoint(XCoordinate=number_slider_3, YCoordinate=number_slider_3, ZCoordinate=0)
pt_9 = ConstructPoint(XCoordinate=number_slider_2, YCoordinate=number_slider_3, ZCoordinate=0)
pt_10 = ConstructPoint(XCoordinate=outside_x, YCoordinate=outside_y, ZCoordinate=0)
pt_11 = ConstructPoint(XCoordinate=inside_x, YCoordinate=inside_y, ZCoordinate=inside_z)
pt_12 = ConstructPoint(XCoordinate=middle_x, YCoordinate=0, ZCoordinate=middle_z)
pt_13 = ConstructPoint(XCoordinate=subtraction, YCoordinate=inside_y, ZCoordinate=inside_z)
pt_14 = ConstructPoint(XCoordinate=subtraction_2, YCoordinate=outside_y, ZCoordinate=0)
pt_15 = ConstructPoint(XCoordinate=outside_x, YCoordinate=subtraction_3, ZCoordinate=0)
pt_16 = ConstructPoint(XCoordinate=inside_x, YCoordinate=subtraction_4, ZCoordinate=inside_z)
pt_17 = ConstructPoint(XCoordinate=middle_x, YCoordinate=y_max, ZCoordinate=middle_z)
pt_18 = ConstructPoint(XCoordinate=subtraction, YCoordinate=subtraction_4, ZCoordinate=inside_z)
pt_19 = ConstructPoint(XCoordinate=subtraction_2, YCoordinate=subtraction_3, ZCoordinate=0)
intcrv = Interpolate(Vertices=[pt_10, pt_11, pt_12, pt_13, pt_14], Degree=3, Periodic=False, KnotStyle=1)  # -> Curve, Length, Domain
srf4pt = _4PointSurface(CornerA=pt_8, CornerB=pt_6, CornerC=pt_7, CornerD=pt_9)
intcrv_2 = Interpolate(Vertices=[pt_15, pt_16, pt_17, pt_18, pt_19], Degree=3, Periodic=False, KnotStyle=1)  # -> Curve, Length, Domain
intcrv_3 = Interpolate(Vertices=[pt, pt_5, pt_2, pt_3, pt_4], Degree=3, Periodic=False, KnotStyle=1)  # -> Curve, Length, Domain
trim_height = Slider(5, range=0..10)
Z = UnitZ(Factor=expr("-x", Slider(20, range=0..100)))
extr = Extrude(Base=srf4pt, Direction=Z)
loft = Loft(
    Curves=[intcrv.Curve, intcrv_3.Curve, intcrv_2.Curve],
    Options={Adjust=False, Closed=False, LoftEnds=0, LoftSimp=0, LoftType=0, Rebuild=10, Refit=0.01})
Z_2 = UnitZ(Factor=trim_height)
move = Move(Geometry=extr, Motion=Z_2)  # -> Geometry, Transform
area = Area(Geometry=loft)  # -> Area, Centroid
offset = Offset(Surface=loft, Distance=expr("-x", Slider(20, range=0..30)), Retrim=True)
loft_2 = Loft(Curves=[offset, loft], Options={Adjust=False, Closed=False, LoftEnds=0, LoftSimp=0, LoftType=0, Rebuild=10, Refit=0.01})
join = BrepJoin(Breps=[loft, loft_2, offset])  # -> Breps, Closed
sdiff = SolidDifference(BrepsA=join.Breps, BrepsB=move.Geometry)
bbox = BoundingBox(Content=sdiff, Plane=PlaneXY(0, 0, 0))  # -> Box, Box_2
debox = DeconstructBox(Box=bbox.Box)  # -> Plane, X, Y, Z
dedomain = DeconstructDomain(Domain=debox.X)  # -> Start, End
dedomain_2 = DeconstructDomain(Domain=debox.Y)  # -> Start, End
dedomain_3 = DeconstructDomain(Domain=debox.Z)  # -> Start, End
subtraction_7 = Subtraction(A=dedomain.Start, B=dedomain.End)
subtraction_8 = Subtraction(A=dedomain_2.Start, B=dedomain_2.End)
subtraction_9 = Subtraction(A=dedomain_3.Start, B=dedomain_3.End)
movetoplane = MoveToPlane(Geometry=sdiff, Plane=PlaneXY(0, 0, 0), Above=True, Below=True)  # -> Geometry, Transform
panel = Panel(subtraction_7)
panel_2 = Panel(subtraction_9)
panel_3 = Panel(subtraction_8)
polygon = Polygon(Plane=PlaneXY(0, 0, 0), Radius=Slider(150, range=0..300), Segments=3, FilletRadius=0)  # -> Polygon, Length
area_2 = Area(Geometry=movetoplane.Geometry)  # -> Area, Centroid
xy = XYPlane(Origin=area_2.Centroid)
move_2 = Move(Geometry=polygon.Polygon, Motion=area_2.Centroid)  # -> Geometry, Transform
rotate = Rotate(Geometry=movetoplane.Geometry, Angle=degrees(Slider(30, range=0..100)), Plane=xy)  # -> Geometry, Transform

# ----
# creating new planes to orient on to
explode = Explode(Curve=move_2.Geometry, Recursive=True)  # -> Segments, Vertices
end = EndPoints(Curve=explode.Segments)  # -> Start, End
Z_3 = UnitZ(Factor=1)
vec2pt = Vector2Pt(PointA=end.Start, PointB=end.End, Unitize=False)  # -> Vector, Length
pl = ConstructPlane(Origin=end.Start, XAxis=vec2pt.Vector, YAxis=Z_3)
item = ListItem(List=pl, Index=0, Wrap=True)  # -> Item, Item1, Item2

dis_btwn_planes = Slider(20, range=0..20)
num_of_planes = Slider(13, range=0..30)
plane_offset = Slider(205, range=0..300)
series = Series(Start=expr("-x", plane_offset), Step=dis_btwn_planes, Count=num_of_planes)
offset_pl_a = PlaneOffset(BasePlane=item.Item, Offset=series)
offset_pl_b = PlaneOffset(BasePlane=item.Item1, Offset=series)
offset_pl_b_2 = PlaneOffset(BasePlane=item.Item2, Offset=series)
# Planes
sec = BrepPlane(Brep=rotate.Geometry, Plane=offset_pl_a)  # -> Curves, Points
sec_2 = BrepPlane(Brep=rotate.Geometry, Plane=offset_pl_b)  # -> Curves, Points
sec_3 = BrepPlane(Brep=rotate.Geometry, Plane=offset_pl_b_2)  # -> Curves, Points
graft = GraftTree(Tree=offset_pl_a, IncludeEmptyLists=True, IncludeNullItems=True)
# orient plane A
offset_of_shapes = Slider(220, range=0..1000)
surfaces_b = BoundarySurfaces(Edges=sec_2.Curves)
surfaces_c = BoundarySurfaces(Edges=sec_3.Curves)
dis_btwn_shapes = Slider(125, range=0..200)

# ----
# orient plane C
graft_2 = GraftTree(Tree=offset_pl_b_2, IncludeEmptyLists=True, IncludeNullItems=True)
lng = ListLength(List=offset_pl_b_2)
series_2 = Series(Start=0, Step=dis_btwn_shapes, Count=lng)
pt_20 = ConstructPoint(XCoordinate=Slider(770, range=0..1000), YCoordinate=series_2, ZCoordinate=0)
xy_2 = XYPlane(Origin=pt_20)
graft_3 = GraftTree(Tree=xy_2, IncludeEmptyLists=True, IncludeNullItems=True)
orient = Orient(Geometry=sec_3.Curves, Source=graft_2, Target=graft_3)  # -> Geometry, Transform

# ----
# orient plane B
graft_4 = GraftTree(Tree=offset_pl_b, IncludeEmptyLists=True, IncludeNullItems=True)
lng_2 = ListLength(List=offset_pl_b)
series_3 = Series(Start=0, Step=dis_btwn_shapes, Count=lng_2)
pt_21 = ConstructPoint(XCoordinate=Slider(500, range=0..1000), YCoordinate=series_3, ZCoordinate=0)
xy_3 = XYPlane(Origin=pt_21)
graft_5 = GraftTree(Tree=xy_3, IncludeEmptyLists=True, IncludeNullItems=True)
orient_2 = Orient(Geometry=sec_2.Curves, Source=graft_4, Target=graft_5)  # -> Geometry, Transform

surfaces_a = BoundarySurfaces(Edges=sec.Curves)
lng_3 = ListLength(List=offset_pl_a)
series_4 = Series(Start=0, Step=dis_btwn_shapes, Count=lng_3)
# Intersect of BC on A
graft_6 = GraftTree(Tree=surfaces_a, IncludeEmptyLists=True, IncludeNullItems=True)
pt_22 = ConstructPoint(XCoordinate=offset_of_shapes, YCoordinate=series_4, ZCoordinate=0)
flatten = FlattenTree(Tree=surfaces_b, Path="{0}")
graft_7 = GraftTree(Tree=surfaces_a, IncludeEmptyLists=True, IncludeNullItems=True)
# Intersect of AC on B
graft_8 = GraftTree(Tree=surfaces_b, IncludeEmptyLists=True, IncludeNullItems=True)
flatten_2 = FlattenTree(Tree=surfaces_c, Path="{0}")
flatten_3 = FlattenTree(Tree=[surfaces_c, surfaces_a], Path="{0}")
# Intersect of AB on C
graft_9 = GraftTree(Tree=surfaces_c, IncludeEmptyLists=True, IncludeNullItems=True)
flatten_4 = FlattenTree(Tree=surfaces_a, Path="{0}")
graft_10 = GraftTree(Tree=surfaces_c, IncludeEmptyLists=True, IncludeNullItems=True)
flatten_5 = FlattenTree(Tree=surfaces_b, Path="{0}")
bbx = BrepBrep(BrepA=graft_6, BrepB=flatten)  # -> Curves, Points
bbx_2 = BrepBrep(BrepA=graft_7, BrepB=flatten_2)  # -> Curves, Points
bbx_3 = BrepBrep(BrepA=graft_8, BrepB=flatten_3)  # -> Curves, Points
xy_4 = XYPlane(Origin=pt_22)
bbx_4 = BrepBrep(BrepA=graft_9, BrepB=flatten_4)  # -> Curves, Points
bbx_5 = BrepBrep(BrepA=graft_10, BrepB=flatten_5)  # -> Curves, Points
crv = Curve(bbx_3.Curves)
crv_2 = Curve(bbx_2.Curves)
crv_3 = Curve(bbx.Curves)
graft_11 = GraftTree(Tree=xy_4, IncludeEmptyLists=True, IncludeNullItems=True)
crv_4 = Curve(bbx_5.Curves)
crv_5 = Curve(bbx_4.Curves)
slot_thickness = Slider(3, range=0..5)
flip = FlipCurve(Curve=crv)  # -> Curve, Flag
flip_2 = FlipCurve(Curve=crv_4)  # -> Curve, Flag
flip_3 = FlipCurve(Curve=crv_2)  # -> Curve, Flag
orient_3 = Orient(Geometry=sec.Curves, Source=graft, Target=graft_11)  # -> Geometry, Transform
trim = TrimTree(Tree=flip.Curve, Depth=2)
trim_2 = TrimTree(Tree=[flip_2.Curve, crv_5], Depth=2)
trim_3 = TrimTree(Tree=[flip_3.Curve, crv_3], Depth=2)
dom = ConstructDomain(DomainStart=Slider(0.5, range=0..1), DomainEnd=Slider(1, range=0..1))
orient_4 = Orient(Geometry=trim_3, Source=graft, Target=graft_11)  # -> Geometry, Transform
orient_5 = Orient(Geometry=trim, Source=graft_4, Target=graft_5)  # -> Geometry, Transform
dom_2 = ConstructDomain(DomainStart=Slider(0, range=0..1), DomainEnd=Slider(0.5, range=0..1))
dom_3 = ConstructDomain(DomainStart=Slider(0, range=0..1), DomainEnd=Slider(0.5, range=0..1))
orient_6 = Orient(Geometry=trim_2, Source=graft_2, Target=graft_3)  # -> Geometry, Transform

# ---- group: 1
graft_12 = GraftTree(Tree=orient_4.Geometry, IncludeEmptyLists=True, IncludeNullItems=True)
graft_13 = GraftTree(Tree=orient_5.Geometry, IncludeEmptyLists=True, IncludeNullItems=True)
graft_14 = GraftTree(Tree=orient_6.Geometry, IncludeEmptyLists=True, IncludeNullItems=True)
eval = EvaluateLength(Curve=graft_12, Length=[0, 1], Normalized=True)  # -> Point, Tangent, Parameter
eval_2 = EvaluateLength(Curve=graft_13, Length=[0, 1], Normalized=True)  # -> Point, Tangent, Parameter
eval_3 = EvaluateLength(Curve=graft_14, Length=[0, 1], Normalized=True)  # -> Point, Tangent, Parameter
# 1: For some reason the boolean has changed the orientation of the surface cuts. We can fix that by force the direction of the lines here. We are sorting the end points by the Y direction.
pdecon = Deconstruct(Point=eval.Point)  # -> XComponent, YComponent, ZComponent
pdecon_2 = Deconstruct(Point=eval_2.Point)  # -> XComponent, YComponent, ZComponent
pdecon_3 = Deconstruct(Point=eval_3.Point)  # -> XComponent, YComponent, ZComponent
sort = SortList(Keys=pdecon.YComponent, ValuesA=eval.Point)  # -> Keys, ValuesA
sort_2 = SortList(Keys=pdecon_2.YComponent, ValuesA=eval_2.Point)  # -> Keys, ValuesA
sort_3 = SortList(Keys=pdecon_3.YComponent, ValuesA=eval_3.Point)  # -> Keys, ValuesA
pline = PolyLine(Vertices=sort.ValuesA, Closed=False)
pline_2 = PolyLine(Vertices=sort_2.ValuesA, Closed=False)
pline_3 = PolyLine(Vertices=sort_3.ValuesA, Closed=False)
trim_4 = TrimTree(Tree=pline, Depth=1)
trim_5 = TrimTree(Tree=pline_3, Depth=1)
trim_6 = TrimTree(Tree=pline_2, Depth=1)

# ----
subcrv = SubCurve(BaseCurve=reparameterize(trim_4), Domain=dom)
subcrv_2 = SubCurve(BaseCurve=reparameterize(trim_6), Domain=dom_2)
subcrv_3 = SubCurve(BaseCurve=reparameterize(pline_3), Domain=dom_3)
expression = Expression(x=slot_thickness, Expression="(x/(cos(π/6)))+(x*tan(π/6))")
ext = ExtendCurve(Curve=subcrv, Type=0, Start=0, End=Slider(8, range=0..10))
ext_2 = ExtendCurve(Curve=subcrv_2, Type=0, Start=Slider(8, range=0..10), End=0)
ext_3 = ExtendCurve(Curve=subcrv_3, Type=0, Start=Slider(8, range=0..10), End=0)
xy_5 = XYPlane(Origin=Point(0, 0, 0))
xy_6 = XYPlane(Origin=Point(0, 0, 0))
xy_7 = XYPlane(Origin=Point(0, 0, 0))
offset_l = OffsetLoose(Curve=ext_2, Distance=expr("x/2", expression), Plane=xy_6)  # -> graft(Curve)
offset_l_2 = OffsetLoose(Curve=ext_3, Distance=expr("x/2", expression), Plane=xy_7)  # -> graft(Curve)
offset_l_3 = OffsetLoose(Curve=ext, Distance=expr("x/2", expression), Plane=xy_5)  # -> graft(Curve)
offset_l_4 = OffsetLoose(Curve=ext, Distance=expr("-x/2", expression), Plane=xy_5)
offset_l_5 = OffsetLoose(Curve=ext_2, Distance=expr("-x/2", expression), Plane=xy_6)
offset_l_6 = OffsetLoose(Curve=ext_3, Distance=expr("-x/2", expression), Plane=xy_7)
flip_4 = FlipCurve(Curve=offset_l_4)  # -> graft(Curve), Flag
flip_5 = FlipCurve(Curve=offset_l_5)  # -> graft(Curve), Flag; disabled
flip_6 = FlipCurve(Curve=offset_l_6)  # -> graft(Curve), Flag; disabled
connect = ConnectCurves(Curves=[flip_4.Curve, offset_l_3], Continuity=0, Close=True, Bulge=1)  # disabled
crv_6 = Curve(orient_3.Geometry)  # disabled
connect_2 = ConnectCurves(Curves=[flip_5.Curve, offset_l], Continuity=0, Close=True, Bulge=1)  # disabled
crv_7 = Curve(orient_2.Geometry)  # disabled
connect_3 = ConnectCurves(Curves=[flip_6.Curve, offset_l_2], Continuity=0, Close=True, Bulge=1)  # disabled
crv_8 = Curve(orient.Geometry)  # disabled
graft_15 = GraftTree(Tree=crv_6, IncludeEmptyLists=True, IncludeNullItems=True)  # disabled
graft_16 = GraftTree(Tree=crv_7, IncludeEmptyLists=True, IncludeNullItems=True)  # disabled
flatten_6 = FlattenTree(Tree=connect, Path="{0}")  # disabled
flatten_7 = FlattenTree(Tree=connect_2, Path="{0}")  # disabled
graft_17 = GraftTree(Tree=crv_8, IncludeEmptyLists=True, IncludeNullItems=True)  # disabled
flatten_8 = FlattenTree(Tree=connect_3, Path="{0}")  # disabled
number_slider_5 = Slider(0, range=0..3)  # disabled
rdiff = RegionDifference(CurvesA=graft_15, CurvesB=flatten_6)  # -> simplify(Result); disabled
rdiff_2 = RegionDifference(CurvesA=graft_16, CurvesB=flatten_7)  # -> simplify(Result); disabled
rdiff_3 = RegionDifference(CurvesA=graft_17, CurvesB=flatten_8)  # -> simplify(Result); disabled
graft_18 = GraftTree(Tree=offset_pl_a, IncludeEmptyLists=True, IncludeNullItems=True)  # disabled
graft_19 = GraftTree(Tree=offset_pl_b, IncludeEmptyLists=True, IncludeNullItems=True)  # disabled
graft_20 = GraftTree(Tree=offset_pl_b_2, IncludeEmptyLists=True, IncludeNullItems=True)  # disabled
trim_7 = TrimTree(Tree=rdiff, Depth=number_slider_5)  # disabled
trim_8 = TrimTree(Tree=rdiff_2, Depth=number_slider_5)  # disabled
trim_9 = TrimTree(Tree=rdiff_3, Depth=number_slider_5)  # disabled
orient_7 = Orient(Geometry=trim_8, Source=graft_5, Target=graft_19)  # -> Geometry, Transform; disabled
orient_8 = Orient(Geometry=trim_7, Source=graft_11, Target=graft_18)  # -> Geometry, Transform; disabled
orient_9 = Orient(Geometry=trim_9, Source=graft_3, Target=graft_20)  # -> Geometry, Transform; disabled
boundary = BoundarySurfaces(Edges=orient_8.Geometry)  # disabled
boundary_2 = BoundarySurfaces(Edges=orient_7.Geometry)  # disabled
boundary_3 = BoundarySurfaces(Edges=orient_9.Geometry)  # disabled
number_slider_6 = Slider(3, range=0..10)  # disabled
planar = IsPlanar(Surface=boundary, Interior=True)  # -> Planar, Plane; disabled
number_slider_7 = Slider(3, range=0..10)  # disabled
planar_2 = IsPlanar(Surface=boundary_2, Interior=True)  # -> Planar, Plane; disabled
number_slider_8 = Slider(3, range=0..10)  # disabled
planar_3 = IsPlanar(Surface=boundary_3, Interior=True)  # -> Planar, Plane; disabled
deplane = DeconstructPlane(Plane=planar.Plane)  # -> Origin, XAxis, YAxis, ZAxis; disabled
deplane_2 = DeconstructPlane(Plane=planar_2.Plane)  # -> Origin, XAxis, YAxis, ZAxis; disabled
deplane_3 = DeconstructPlane(Plane=planar_3.Plane)  # -> Origin, XAxis, YAxis, ZAxis; disabled
amp = Amplitude(Vector=deplane.ZAxis, Amplitude=expr("-x/2", number_slider_6))  # disabled
amp_2 = Amplitude(Vector=deplane_2.ZAxis, Amplitude=expr("-x/2", number_slider_7))  # disabled
amp_3 = Amplitude(Vector=deplane.ZAxis, Amplitude=number_slider_6)  # disabled
amp_4 = Amplitude(Vector=deplane_2.ZAxis, Amplitude=number_slider_7)  # disabled
amp_5 = Amplitude(Vector=deplane_3.ZAxis, Amplitude=expr("-x/2", number_slider_8))  # disabled
amp_6 = Amplitude(Vector=deplane_3.ZAxis, Amplitude=number_slider_8)  # disabled
number_slider_9 = Slider(0, range=0..100)  # disabled
number_slider_10 = Slider(0, range=0..100)  # disabled
extr_2 = Extrude(Base=boundary, Direction=amp_3)  # disabled
extr_3 = Extrude(Base=boundary_2, Direction=amp_4)  # disabled
extr_4 = Extrude(Base=boundary_3, Direction=amp_6)  # disabled
move_3 = Move(Geometry=extr_2, Motion=amp)  # -> Geometry, Transform; disabled
move_4 = Move(Geometry=extr_3, Motion=amp_2)  # -> Geometry, Transform; disabled
move_5 = Move(Geometry=extr_4, Motion=amp_5)  # -> Geometry, Transform; disabled
Z_4 = UnitZ(Factor=expr("-x", number_slider_9))  # disabled
Z_5 = UnitZ(Factor=number_slider_10)  # disabled
move_6 = Move(Geometry=move_5.Geometry, Motion=Z_4)  # -> Geometry, Transform; disabled
move_7 = Move(Geometry=move_3.Geometry, Motion=Z_5)  # -> Geometry, Transform; disabled
