# Grasshopper definition ZA003 - AB Comments.gh (Grasshopper 0.9.76)

# Errors in Red
# Success in Green
# Corrections in Blue
# Unnecessary in Orange
# 0: Numbers in panels relate to the numbers on the groups.
# I'm related to the "0" Panel
boundary = BoundarySurfaces(Edges=<geometry referenced from the Rhino model>)
number_slider = Slider(21, range=0..100)
Z = UnitZ(Factor=Slider(9, range=0..10))
extr = Extrude(Base=boundary, Direction=Z)
geo = Geometry(extr)
bbox = BoundingBox(Content=geo, Plane=PlaneXY(0, 0, 0))  # -> Box, Box_2
debox = DeconstructBox(Box=bbox.Box)  # -> Plane, X, Y, Z
range = Range(Domain=debox.Y, Steps=number_slider)
range_2 = Range(Domain=Domain(0, 1), Steps=10)
range_3 = Range(Domain=debox.X, Steps=number_slider)
remove_ends = RemoveEnds(L=range_3)
pt = ConstructPoint(XCoordinate=remove_ends, YCoordinate=0, ZCoordinate=0)
yz = YZPlane(Origin=pt)
item = ListItem(List=yz, Index=0, Wrap=True)
lng = ListLength(List=yz)
graft = GraftTree(Tree=yz, IncludeEmptyLists=True, IncludeNullItems=True)
# 2: Here, you have used the wrong output from the BREP|Plane intersection function. The output you've used is for points, when we want curves instead.
series = Series(Start=0, Step=Slider(16, range=0..100), Count=lng)
pt_2 = ConstructPoint(XCoordinate=0, YCoordinate=series, ZCoordinate=0)
xy = XYPlane(Origin=pt_2)
number_slider_2 = Slider(1, range=0..5)
graft_2 = GraftTree(Tree=xy, IncludeEmptyLists=True, IncludeNullItems=True)
int = Integer(2)
panel = Panel(int)
dom = ConstructDomain(DomainStart=Slider(0, range=0..1), DomainEnd=Slider(0.5, range=0..1))
dom_2 = ConstructDomain(DomainStart=Slider(0, range=0..1), DomainEnd=Slider(0.5, range=0..1))
number_slider_3 = Slider(3, range=0..10)
number_slider_4 = Slider(3, range=0..10)
_5 = Panel("""D EXPRESSION:
	-x/2

D EXPRESSION:
	x/2""")
xy_2 = XYPlane(Origin=Point(0, 0, 0))
xy_3 = XYPlane(Origin=Point(0, 0, 0))

remove_ends_2 = RemoveEnds(L=range)
pt_3 = ConstructPoint(XCoordinate=0, YCoordinate=remove_ends_2, ZCoordinate=0)
xz = XZPlane(Origin=pt_3)
item_2 = ListItem(List=xz, Index=0, Wrap=True)
graft_3 = GraftTree(Tree=xz, IncludeEmptyLists=True, IncludeNullItems=True)
lng_2 = ListLength(List=xz)
series_2 = Series(Start=0, Step=Slider(21, range=0..100), Count=lng_2)
pt_4 = ConstructPoint(XCoordinate=Slider(218, range=0..600), YCoordinate=series_2, ZCoordinate=0)
xy_4 = XYPlane(Origin=pt_4)
graft_4 = GraftTree(Tree=xy_4, IncludeEmptyLists=True, IncludeNullItems=True)

# ---- group: 2
sec = BrepPlane(Brep=geo, Plane=xz)  # -> simplify(Curves), Points
boundary_2 = BoundarySurfaces(Edges=sec.Points)
boundary_3 = BoundarySurfaces(Edges=boundary_2)

sec_2 = BrepPlane(Brep=geo, Plane=xz)  # -> simplify(Curves), Points
boundary_4 = BoundarySurfaces(Edges=sec_2.Curves)

# ----
boundary_5 = BoundarySurfaces(Edges=sec.Curves)
planar = IsPlanar(Surface=boundary_5, Interior=True)  # -> Planar, Plane
deplane = DeconstructPlane(Plane=planar.Plane)  # -> Origin, XAxis, YAxis, ZAxis
amp = Amplitude(Vector=deplane.ZAxis, Amplitude=expr("-x/2", number_slider_2))
amp_2 = Amplitude(Vector=deplane.ZAxis, Amplitude=number_slider_2)

orient = Orient(Geometry=sec.Curves, Source=graft_3, Target=graft_4)  # -> Geometry, Transform

extr_2 = Extrude(Base=boundary_5, Direction=amp_2)
move = Move(Geometry=extr_2, Motion=amp)  # -> Geometry, Transform
flatten = FlattenTree(Tree=boundary_4, Path="{0}")
graft_5 = GraftTree(Tree=boundary_4, IncludeEmptyLists=True, IncludeNullItems=True)

# ---- group: 3
# 3: The slots that are generated need to be calculated from the geometry in 3D space. We cannot use the oriented geometry to creat these.
# That means not from "Red 3" but from "Blue 3".
# Note: Keep "Red 3", it is a neccessary part of the process.
# You have done this correctly in 2.
sec_3 = BrepPlane(Brep=geo, Plane=yz)  # -> simplify(Curves), Points

# ----
boundary_6 = BoundarySurfaces(Edges=sec_3.Curves)
planar_2 = IsPlanar(Surface=boundary_6, Interior=True)  # -> Planar, Plane
deplane_2 = DeconstructPlane(Plane=planar_2.Plane)  # -> Origin, XAxis, YAxis, ZAxis
amp_3 = Amplitude(Vector=deplane_2.ZAxis, Amplitude=expr("-x/2", number_slider_2))
amp_4 = Amplitude(Vector=deplane_2.ZAxis, Amplitude=number_slider_2)
extr_3 = Extrude(Base=boundary_6, Direction=amp_4)
boundary_7 = BoundarySurfaces(Edges=sec_3.Curves)
move_2 = Move(Geometry=extr_3, Motion=amp_3)  # -> Geometry, Transform
panel_2 = Panel(move_2.Geometry)

# ---- group: 3 (continued)
graft_6 = GraftTree(Tree=boundary_7, IncludeEmptyLists=True, IncludeNullItems=True)
flatten_2 = FlattenTree(Tree=boundary_7, Path="{0}")

# ----
bbx = BrepBrep(BrepA=graft_6, BrepB=flatten)  # -> Curves, Points
bbx_2 = BrepBrep(BrepA=graft_5, BrepB=flatten_2)  # -> Curves, Points
crv = Curve(bbx_2.Curves)
crv_2 = Curve(bbx.Curves)
trim = TrimTree(Tree=crv, Depth=int)
trim_2 = TrimTree(Tree=crv_2, Depth=int)

# ---- group: 5
boundary_8 = BoundarySurfaces(Edges=bbx.Curves)
planar_3 = IsPlanar(Surface=boundary_8, Interior=True)  # -> Planar, Plane
# 5: None of this is required. Can you please explain what you were trying to do here for me?
deplane_3 = DeconstructPlane(Plane=planar_3.Plane)  # -> Origin, XAxis, YAxis, ZAxis
amp_5 = Amplitude(Vector=deplane_3.ZAxis, Amplitude=1)
amp_6 = Amplitude(Vector=deplane_3.ZAxis, Amplitude=Slider(3, range=0..10))
extr_4 = Extrude(Base=boundary_8, Direction=amp_6)
panel_3 = Panel(deplane_3.ZAxis)
move_3 = Move(Geometry=extr_4, Motion=amp_5)  # -> Geometry, Transform
panel_4 = Panel(move_3.Geometry)

# ---- group: 4
orient_2 = Orient(Geometry=trim_2, Source=graft, Target=graft_2)  # -> Geometry, Transform

# 4: Small mistake here. You use the origin planes from the secondary axis.
orient_3 = Orient(Geometry=trim_2, Source=graft_3, Target=graft_2)  # -> Geometry, Transform

# 4: You did this one correctly! Good job!
orient_4 = Orient(Geometry=trim, Source=graft_3, Target=graft_4)  # -> Geometry, Transform

# ----
subcrv = SubCurve(BaseCurve=reparameterize(orient_2.Geometry), Domain=dom)
subcrv_2 = SubCurve(BaseCurve=reparameterize(orient_4.Geometry), Domain=dom_2)
ext = ExtendCurve(Curve=subcrv_2, Type=0, Start=Slider(3, range=0..10), End=Slider(0, range=0..1))
ext_2 = ExtendCurve(Curve=subcrv, Type=0, Start=Slider(3, range=0..10), End=Slider(0, range=0..1))

# ---- group: 5
offset_l = OffsetLoose(Curve=simplify(ext_2), Distance=expr("-x/2", number_slider_4), Plane=xy_2)  # -> simplify(graft(Curve))
offset_l_2 = OffsetLoose(Curve=ext_2, Distance=expr("x/2", number_slider_4), Plane=xy_2)  # -> simplify(graft(Curve))

# 5: You've just missed putting a graft on the output of this offset. Plus, make sure you have the expression in the D input.
offset_l_3 = OffsetLoose(Curve=simplify(ext_2), Distance=number_slider_4, Plane=xy_2)  # -> simplify(graft(Curve))
offset_l_4 = OffsetLoose(Curve=ext_2, Distance=number_slider_4, Plane=xy_2)  # -> simplify(Curve)

# ----
offset_l_5 = OffsetLoose(Curve=ext, Distance=expr("x/2", number_slider_3), Plane=xy_3)  # -> simplify(graft(Curve))
offset_l_6 = OffsetLoose(Curve=ext, Distance=expr("-x/2", number_slider_3), Plane=xy_3)  # -> simplify(graft(Curve))
flip = FlipCurve(Curve=offset_l_2)  # -> Curve, Flag
flip_2 = FlipCurve(Curve=offset_l_5)  # -> simplify(graft(Curve)), Flag

# ---- group: 6
# 5: The G input should be set to Position, otherwise you'll get curvy slots
connect = ConnectCurves(Curves=[offset_l, flip.Curve], Continuity=2, Close=True, Bulge=1)

connect_2 = ConnectCurves(Curves=[offset_l, flip.Curve], Continuity=0, Close=True, Bulge=1)

# ----
connect_3 = ConnectCurves(Curves=[offset_l_6, flip_2.Curve], Continuity=0, Close=True, Bulge=1)
flatten_3 = FlattenTree(Tree=connect, Path="{0}")
flatten_4 = FlattenTree(Tree=connect_2, Path="{0}")
flatten_5 = FlattenTree(Tree=connect_3, Path="{0}")

# ---- group: 3
orient_5 = Orient(Geometry=sec_3.Curves, Source=graft, Target=graft_2)  # -> Geometry, Transform

# ---- group: 1
# 1: You don't need to use this function twice.
boundary_9 = BoundarySurfaces(Edges=orient_5.Geometry)
boundary_10 = BoundarySurfaces(Edges=boundary_9)

boundary_11 = BoundarySurfaces(Edges=orient_5.Geometry)

# ---- group: 3 (continued)
graft_7 = GraftTree(Tree=boundary_11, IncludeEmptyLists=True, IncludeNullItems=True)
flatten_6 = FlattenTree(Tree=boundary_11, Path="{0}")

# ==== cluster RemoveEnds: Removes first and last item of a list
L = ClusterInput()
cull_i = CullIndex(List=reverse(L), Indices=0, Wrap=True)
cull_i_2 = CullIndex(List=reverse(cull_i), Indices=0, Wrap=True)
L_2 = ClusterOutput(cull_i_2)
