# Grasshopper definition ZA005 - AB Comments.gh (Grasshopper 0.9.76)

number_slider = Slider(65, range=-110..111)
number_slider_2 = Slider(0, range=0..110)
number_slider_3 = Slider(49, range=-110..111)
number_slider_4 = Slider(41, range=-110..111)
number_slider_5 = Slider(65, range=-110..111)
number_slider_6 = Slider(15, range=-110..111)
number_slider_7 = Slider(2, range=-110..111)
number_slider_8 = Slider(41, range=-110..111)
number_slider_9 = Slider(49, range=-110..111)
number_slider_10 = Slider(35, range=0..110)
number_slider_11 = Slider(76, range=0..100)
pt = ConstructPoint(XCoordinate=number_slider_4, YCoordinate=Slider(90, range=0..1000), ZCoordinate=0)
pt_2 = ConstructPoint(XCoordinate=Slider(86, range=-110..111), YCoordinate=number_slider_7, ZCoordinate=0)
pt_3 = ConstructPoint(XCoordinate=number_slider_4, YCoordinate=number_slider_6, ZCoordinate=number_slider_4)
pt_4 = ConstructPoint(XCoordinate=number_slider_6, YCoordinate=number_slider_7, ZCoordinate=0)
pt_5 = ConstructPoint(XCoordinate=Slider(86, range=-110..111), YCoordinate=Slider(74, range=-110..111), ZCoordinate=number_slider_4)
pt_6 = ConstructPoint(XCoordinate=number_slider_8, YCoordinate=Slider(90, range=0..1000), ZCoordinate=number_slider_10)
pt_7 = ConstructPoint(XCoordinate=Slider(86, range=-110..111), YCoordinate=Slider(2, range=-110..111), ZCoordinate=number_slider_10)
pt_8 = ConstructPoint(XCoordinate=Slider(86, range=-110..111), YCoordinate=Slider(74, range=-110..111), ZCoordinate=number_slider_11)
pt_9 = ConstructPoint(XCoordinate=number_slider_8, YCoordinate=Slider(15, range=-110..111), ZCoordinate=number_slider_11)
srf4pt = _4PointSurface(CornerA=pt, CornerB=pt_3, CornerC=pt_2, CornerD=pt_5)
srf4pt_2 = _4PointSurface(CornerA=pt_6, CornerB=pt_9, CornerC=pt_7, CornerD=pt_8)
loft = Loft(
    Curves=[srf4pt_2, srf4pt],
    Options={Adjust=False, Closed=False, LoftEnds=0, LoftSimp=0, LoftType=0, Rebuild=10, Refit=0.01})
# Errors in Red
# Success in Green
# Corrections in Blue
# Unnecessary in Orange
# 0: Numbers in panels relate to the numbers on the groups.
# I'm related to the "0" Panel
number_slider_12 = Slider(9, range=0..10)
Z = UnitZ(Factor=number_slider_12)
extr = Extrude(Base=srf4pt, Direction=Z)
geo = Geometry(extr)
bbox = BoundingBox(Content=geo, Plane=PlaneXY(0, 0, 0))  # -> Box, Box_2
debox = DeconstructBox(Box=bbox.Box)  # -> Plane, X, Y, Z
range = Range(Domain=debox.Y, Steps=Slider(11, range=0..100))
range_2 = Range(Domain=Domain(0, 1), Steps=10)
range_3 = Range(Domain=debox.X, Steps=Slider(7, range=0..100))
remove_ends = RemoveEnds(L=range_3)
pt_10 = ConstructPoint(XCoordinate=remove_ends, YCoordinate=0, ZCoordinate=0)
yz = YZPlane(Origin=pt_10)
item = ListItem(List=yz, Index=0, Wrap=True)
lng = ListLength(List=yz)
graft = GraftTree(Tree=yz, IncludeEmptyLists=True, IncludeNullItems=True)
series = Series(Start=0, Step=Slider(20, range=0..100), Count=lng)
pt_11 = ConstructPoint(XCoordinate=Slider(100, range=0..100), YCoordinate=series, ZCoordinate=0)
xy = XYPlane(Origin=pt_11)
number_slider_13 = Slider(1, range=0..5)
graft_2 = GraftTree(Tree=xy, IncludeEmptyLists=True, IncludeNullItems=True)
int = Integer(2)
panel = Panel(int)
dom = ConstructDomain(DomainStart=Slider(0, range=0..1), DomainEnd=Slider(0.5, range=0..1))
dom_2 = ConstructDomain(DomainStart=Slider(0, range=0..1), DomainEnd=Slider(0.5, range=0..1))
number_slider_14 = Slider(0, range=0..1)
number_slider_15 = Slider(3, range=0..10)
number_slider_16 = Slider(3, range=0..10)
number_slider_17 = Slider(3, range=0..10)
xy_2 = XYPlane(Origin=Point(0, 0, 0))
ext = ExtendCurve(Type=0, Start=Slider(3, range=0..10), End=Slider(0, range=0..1))
xy_3 = XYPlane(Origin=Point(0, 0, 0))
number_slider_18 = Slider(25, range=0..110)  # disabled
offset_l = OffsetLoose(Curve=ext, Distance=expr("x/2", number_slider_16), Plane=xy_3)  # -> simplify(graft(Curve))
offset_l_2 = OffsetLoose(Curve=ext, Distance=expr("-x/2", number_slider_16), Plane=xy_3)  # -> simplify(graft(Curve))
flip = FlipCurve(Curve=offset_l)  # -> simplify(graft(Curve)), Flag
connect = ConnectCurves(Curves=[offset_l_2, flip.Curve], Continuity=0, Close=True, Bulge=1)
number_slider_19 = Slider(0, range=0..100)
flatten = FlattenTree(Tree=connect, Path="{0}")
number_slider_20 = Slider(3, range=0..10)  # disabled
number_slider_21 = Slider(3, range=0..10)  # disabled
number_slider_22 = Slider(0, range=0..100)  # disabled
number_slider_23 = Slider(0, range=0..100)  # disabled
Z_2 = UnitZ(Factor=expr("-x", number_slider_22))  # disabled
Z_3 = UnitZ(Factor=expr("-x", number_slider_23))  # disabled

remove_ends_2 = RemoveEnds(L=range)
pt_12 = ConstructPoint(XCoordinate=0, YCoordinate=remove_ends_2, ZCoordinate=0)
xz = XZPlane(Origin=pt_12)
item_2 = ListItem(List=xz, Index=0, Wrap=True)
graft_3 = GraftTree(Tree=xz, IncludeEmptyLists=True, IncludeNullItems=True)
lng_2 = ListLength(List=xz)
series_2 = Series(Start=0, Step=Slider(21, range=0..100), Count=lng_2)
pt_13 = ConstructPoint(XCoordinate=Slider(218, range=0..600), YCoordinate=series_2, ZCoordinate=0)
xy_4 = XYPlane(Origin=pt_13)
graft_4 = GraftTree(Tree=xy_4, IncludeEmptyLists=True, IncludeNullItems=True)

# ---- group: 2
sec = BrepPlane(Brep=geo, Plane=xz)  # -> simplify(Curves), Points
boundary = BoundarySurfaces(Edges=sec.Curves)

sec_2 = BrepPlane(Brep=geo, Plane=xz)  # -> simplify(Curves), Points
boundary_2 = BoundarySurfaces()
boundary_3 = BoundarySurfaces(Edges=boundary_2)

# ----
boundary_4 = BoundarySurfaces(Edges=sec_2.Curves)
planar = IsPlanar(Surface=boundary_4, Interior=True)  # -> Planar, Plane
deplane = DeconstructPlane(Plane=planar.Plane)  # -> Origin, XAxis, YAxis, ZAxis
amp = Amplitude(Vector=deplane.ZAxis, Amplitude=expr("-x/2", number_slider_13))
amp_2 = Amplitude(Vector=deplane.ZAxis, Amplitude=number_slider_13)
extr_2 = Extrude(Base=boundary_4, Direction=amp_2)
move = Move(Geometry=extr_2, Motion=amp)  # -> Geometry, Transform

orient = Orient(Geometry=sec_2.Curves, Source=graft_3, Target=graft_4)  # -> Geometry, Transform

flatten_2 = FlattenTree(Tree=boundary, Path="{0}")
graft_5 = GraftTree(Tree=boundary, IncludeEmptyLists=True, IncludeNullItems=True)
crv = Curve(orient.Geometry)
graft_6 = GraftTree(Tree=crv, IncludeEmptyLists=True, IncludeNullItems=True)

# ---- group: 3
sec_3 = BrepPlane(Brep=geo, Plane=yz)  # -> simplify(Curves), Points

# ----
boundary_5 = BoundarySurfaces(Edges=sec_3.Curves)
planar_2 = IsPlanar(Surface=boundary_5, Interior=True)  # -> Planar, Plane
deplane_2 = DeconstructPlane(Plane=planar_2.Plane)  # -> Origin, XAxis, YAxis, ZAxis
amp_3 = Amplitude(Vector=deplane_2.ZAxis, Amplitude=expr("-x/2", number_slider_13))
amp_4 = Amplitude(Vector=deplane_2.ZAxis, Amplitude=number_slider_13)
extr_3 = Extrude(Base=boundary_5, Direction=amp_4)
boundary_6 = BoundarySurfaces(Edges=sec_3.Curves)
move_2 = Move(Geometry=extr_3, Motion=amp_3)  # -> Geometry, Transform
panel_2 = Panel(move_2.Geometry)

# ---- group: 3 (continued)
graft_7 = GraftTree(Tree=boundary_6, IncludeEmptyLists=True, IncludeNullItems=True)
flatten_3 = FlattenTree(Tree=boundary_6, Path="{0}")

# ----
bbx = BrepBrep(BrepA=graft_7, BrepB=flatten_2)  # -> Curves, Points
bbx_2 = BrepBrep(BrepA=graft_5, BrepB=flatten_3)  # -> Curves, Points
crv_2 = Curve(bbx_2.Curves)
crv_3 = Curve(bbx.Curves)
trim = TrimTree(Tree=crv_2, Depth=int)

# ---- group: 4
orient_2 = Orient(Geometry=trim, Source=graft_3, Target=graft_4)  # -> Geometry, Transform

# ----
trim_2 = TrimTree(Tree=crv_3, Depth=int)

# ---- group: 4
orient_3 = Orient(Geometry=trim_2, Source=graft_3, Target=graft_2)  # -> Geometry, Transform

orient_4 = Orient(Geometry=trim_2, Source=graft, Target=graft_2)  # -> Geometry, Transform

# ----
crv_4 = Curve(orient_4.Geometry)
subcrv = SubCurve(BaseCurve=reparameterize(orient_2.Geometry), Domain=dom)
subcrv_2 = SubCurve(BaseCurve=reparameterize(orient_4.Geometry), Domain=dom_2)
ext_2 = ExtendCurve(Curve=subcrv_2, Type=0, Start=number_slider_15, End=number_slider_14)
ext_3 = ExtendCurve(Curve=subcrv, Type=0, Start=number_slider_15, End=number_slider_14)

# ---- group: 5
offset_l_3 = OffsetLoose(Curve=ext_3, Distance=expr("x/2", number_slider_17), Plane=xy_2)  # -> simplify(graft(Curve))
offset_l_4 = OffsetLoose(Curve=simplify(ext_3), Distance=expr("-x/2", number_slider_17), Plane=xy_2)  # -> simplify(graft(Curve))

offset_l_5 = OffsetLoose(Curve=ext_2, Distance=expr("x/2", number_slider_17), Plane=xy_2)  # -> simplify(graft(Curve))
offset_l_6 = OffsetLoose(Curve=simplify(ext_2), Distance=expr("-x/2", number_slider_17), Plane=xy_2)  # -> simplify(graft(Curve))

offset_l_7 = OffsetLoose(Curve=simplify(ext_2), Distance=number_slider_17, Plane=xy_2)  # -> simplify(graft(Curve)); disabled
offset_l_8 = OffsetLoose(Curve=ext_2, Distance=number_slider_17, Plane=xy_2)  # -> simplify(Curve); disabled

# ----
flip_2 = FlipCurve(Curve=offset_l_3)  # -> Curve, Flag
flip_3 = FlipCurve(Curve=offset_l_5)  # -> Curve, Flag
flip_4 = FlipCurve(Curve=offset_l_8)  # -> Curve, Flag; disabled
graft_8 = GraftTree(Tree=crv_4, IncludeEmptyLists=True, IncludeNullItems=True)

# ---- group: 6
connect_2 = ConnectCurves(Curves=[offset_l_4, flip_2.Curve], Continuity=0, Close=True, Bulge=1)

connect_3 = ConnectCurves(Curves=[offset_l_6, flip_3.Curve], Continuity=0, Close=True, Bulge=1)

connect_4 = ConnectCurves(Curves=[offset_l_7, flip_4.Curve], Continuity=2, Close=True, Bulge=1)  # disabled

# ----
flatten_4 = FlattenTree(Tree=connect_4, Path="{0}")  # disabled
flatten_5 = FlattenTree(Tree=connect_2, Path="{0}")
flatten_6 = FlattenTree(Tree=connect_3, Path="{0}")
rdiff = RegionDifference(CurvesA=graft_8, CurvesB=flatten_4)  # -> simplify(Result); disabled
rdiff_2 = RegionDifference(CurvesA=graft_6, CurvesB=flatten_6)  # -> simplify(Result); disabled
trim_3 = TrimTree(Tree=rdiff, Depth=number_slider_19)  # disabled
trim_4 = TrimTree(Tree=rdiff_2, Depth=number_slider_19)  # disabled
orient_5 = Orient(Geometry=trim_4, Source=graft_4, Target=PlaneXY(0, 0, 0))  # -> Geometry, Transform; disabled
orient_6 = Orient(Geometry=trim_3, Source=PlaneXY(0, 0, 0), Target=PlaneXY(0, 0, 0))  # -> Geometry, Transform; disabled
boundary_7 = BoundarySurfaces(Edges=orient_5.Geometry)  # disabled
boundary_8 = BoundarySurfaces(Edges=orient_6.Geometry)  # disabled
planar_3 = IsPlanar(Surface=boundary_7, Interior=True)  # -> Planar, Plane; disabled
planar_4 = IsPlanar(Surface=boundary_8, Interior=True)  # -> Planar, Plane; disabled
deplane_3 = DeconstructPlane(Plane=planar_3.Plane)  # -> Origin, XAxis, YAxis, ZAxis; disabled
deplane_4 = DeconstructPlane(Plane=planar_4.Plane)  # -> Origin, XAxis, YAxis, ZAxis; disabled
amp_5 = Amplitude(Vector=deplane_3.ZAxis, Amplitude=expr("-x/2", number_slider_20))  # disabled
amp_6 = Amplitude(Vector=deplane_3.ZAxis, Amplitude=number_slider_20)  # disabled
amp_7 = Amplitude(Vector=deplane_4.ZAxis, Amplitude=expr("-x/2", number_slider_21))  # disabled
amp_8 = Amplitude(Vector=deplane_4.ZAxis, Amplitude=number_slider_21)  # disabled
extr_4 = Extrude(Base=boundary_7, Direction=amp_6)  # disabled
extr_5 = Extrude(Base=boundary_8, Direction=amp_8)  # disabled
move_3 = Move(Geometry=extr_4, Motion=amp_5)  # -> Geometry, Transform; disabled
move_4 = Move(Geometry=extr_5, Motion=amp_7)  # -> Geometry, Transform; disabled
move_5 = Move(Geometry=move_3.Geometry, Motion=Z_2)  # -> Geometry, Transform; disabled
move_6 = Move(Geometry=move_4.Geometry, Motion=Z_3)  # -> Geometry, Transform; disabled

# ---- group: 3
orient_7 = Orient(Geometry=sec_3.Curves, Source=graft, Target=graft_2)  # -> Geometry, Transform

# ---- group: 1
boundary_9 = BoundarySurfaces(Edges=orient_7.Geometry)

# ---- group: 3 (continued)
graft_9 = GraftTree(Tree=boundary_9, IncludeEmptyLists=True, IncludeNullItems=True)
flatten_7 = FlattenTree(Tree=boundary_9, Path="{0}")

# ----
# Zahra, you've actually done enough to laser cut your model.
# Bake the below 4 curves. When you lazer cut these, everything should work.
crv_5 = Curve(orient_7.Geometry)
crv_6 = Curve(orient.Geometry)
crv_7 = Curve(flatten_6)
crv_8 = Curve(flatten_5)

# ==== cluster RemoveEnds: Removes first and last item of a list
L = ClusterInput()
cull_i = CullIndex(List=reverse(L), Indices=0, Wrap=True)
cull_i_2 = CullIndex(List=reverse(cull_i), Indices=0, Wrap=True)
L_2 = ClusterOutput(cull_i_2)
