# Grasshopper definition waffle.gh (Grasshopper 0.9.76)

pt = Point(<point referenced from the Rhino model>)
geo = Geometry(<brep referenced from the Rhino model>)
xz = XZPlane(Origin=pt)
number_slider = Slider(20, range=0..500)
number_slider_2 = Slider(4, range=0..500)
bbox = BoundingBox(Content=geo, Plane=PlaneXY(0, 0, 0))  # -> Box, Box_2
debox = DeconstructBox(Box=bbox.Box)  # -> Plane, X, Y, Z
range = Range(Domain=debox.Y, Steps=number_slider_2)
range_2 = Range(Domain=debox.X, Steps=number_slider_2)
crv = Curve(<curve referenced from the Rhino model>)
crv_2 = Curve(<curve referenced from the Rhino model>)
remove_ends = RemoveEnds(L=range)
remove_ends_2 = RemoveEnds(L=range_2)
divide = DivideCurve(Curve=crv, Count=10, Kinks=False)  # -> Points, Tangents, Parameters
divide_2 = DivideCurve(Curve=crv_2, Count=8, Kinks=False)  # -> Points, Tangents, Parameters
ln = Line(StartPoint=divide.Points, EndPoint=divide_2.Points)
panel = Panel(range_2)
pt_2 = ConstructPoint(XCoordinate=remove_ends_2, YCoordinate=0, ZCoordinate=0)
pt_3 = ConstructPoint(XCoordinate=0, YCoordinate=remove_ends, ZCoordinate=0)
yz = YZPlane(Origin=pt_2)  # -> simplify(Plane)
item = ListItem(List=yz, Index=0, Wrap=True)
xz_2 = XZPlane(Origin=pt_3)
lng = ListLength(List=xz_2)
sec = BrepPlane(Brep=geo, Plane=xz_2)  # -> simplify(Curves), Points
sec_2 = BrepPlane(Brep=geo, Plane=yz)  # -> simplify(Curves), Points
graft = GraftTree(Tree=xz_2, IncludeEmptyLists=True, IncludeNullItems=True)  # -> simplify(Tree)

boundary = BoundarySurfaces(Edges=sec.Curves)
boundary_2 = BoundarySurfaces(Edges=sec_2.Curves)

graft_2 = GraftTree(Tree=yz, IncludeEmptyLists=True, IncludeNullItems=True)  # -> simplify(Tree)
boundary_3 = BoundarySurfaces(Edges=sec_2.Curves)
series = Series(Start=0, Step=Slider(20.8, range=0..500), Count=lng)
boundary_4 = BoundarySurfaces(Edges=sec.Curves)
number_slider_3 = Slider(1, range=0..5)
graft_3 = GraftTree(Tree=boundary, IncludeEmptyLists=True, IncludeNullItems=True)
flatten = FlattenTree(Tree=boundary, Path="{0}")
graft_4 = GraftTree(Tree=boundary_2, IncludeEmptyLists=True, IncludeNullItems=True)
flatten_2 = FlattenTree(Tree=boundary_2, Path="{0}")
planar = IsPlanar(Surface=boundary_4, Interior=True)  # -> Planar, Plane
planar_2 = IsPlanar(Surface=boundary_3, Interior=True)  # -> Planar, Plane
deplane = DeconstructPlane(Plane=planar.Plane)  # -> Origin, XAxis, YAxis, ZAxis
deplane_2 = DeconstructPlane(Plane=planar_2.Plane)  # -> Origin, XAxis, YAxis, ZAxis
bbx = BrepBrep(BrepA=graft_3, BrepB=flatten_2)  # -> Curves, Points
bbx_2 = BrepBrep(BrepA=graft_4, BrepB=flatten)  # -> Curves, Points
pt_4 = ConstructPoint(XCoordinate=Slider(219.2, range=0..500), YCoordinate=series, ZCoordinate=0)
lng_2 = ListLength(List=yz)
D = Depth(2)
amp = Amplitude(Vector=deplane.ZAxis, Amplitude=expr("-x/2", number_slider_3))
amp_2 = Amplitude(Vector=deplane.ZAxis, Amplitude=number_slider_3)
amp_3 = Amplitude(Vector=deplane_2.ZAxis, Amplitude=expr("-x/2", number_slider_3))
amp_4 = Amplitude(Vector=deplane_2.ZAxis, Amplitude=number_slider_3)
crv_3 = Curve(bbx.Curves)
crv_4 = Curve(bbx_2.Curves)
xy = XYPlane(Origin=pt_4)
series_2 = Series(Start=0, Step=Slider(21.248, range=0..200), Count=lng_2)
trim = TrimTree(Tree=crv_3, Depth=D)
trim_2 = TrimTree(Tree=crv_4, Depth=D)
panel_2 = Panel(D)
extr = Extrude(Base=boundary_4, Direction=amp_2)
extr_2 = Extrude(Base=boundary_3, Direction=amp_4)
graft_5 = GraftTree(Tree=xy, IncludeEmptyLists=True, IncludeNullItems=True)  # -> simplify(Tree)
pt_5 = ConstructPoint(XCoordinate=0, YCoordinate=series_2, ZCoordinate=0)
move = Move(Geometry=extr, Motion=amp)  # -> Geometry, Transform
xy_2 = XYPlane(Origin=pt_5)
graft_6 = GraftTree(Tree=xy_2, IncludeEmptyLists=True, IncludeNullItems=True)  # -> simplify(Tree)
move_2 = Move(Geometry=extr_2, Motion=amp_3)  # -> Geometry, Transform
orient = Orient(Geometry=trim, Source=graft, Target=graft_5)  # -> Geometry, Transform
orient_2 = Orient(Geometry=sec_2.Curves, Source=graft_2, Target=graft_6)  # -> Geometry, Transform
orient_3 = Orient(Geometry=trim_2, Source=graft_2, Target=graft_6)  # -> Geometry, Transform
orient_4 = Orient(Geometry=sec.Curves, Source=graft, Target=graft_5)  # -> Geometry, Transform
panel_3 = Panel(move_2.Geometry)
dom = ConstructDomain(DomainStart=Slider(0.5, range=0..1), DomainEnd=Slider(0, range=0..1))
dom_2 = ConstructDomain(DomainStart=Slider(0, range=0..1), DomainEnd=Slider(0.5, range=0..1))
subcrv = SubCurve(BaseCurve=reparameterize(orient.Geometry), Domain=dom)
subcrv_2 = SubCurve(BaseCurve=reparameterize(orient_3.Geometry), Domain=dom_2)
ext = ExtendCurve(Curve=subcrv, Type=0, Start=Slider(3, range=0..3), End=Slider(0, range=0..3))
ext_2 = ExtendCurve(Curve=subcrv_2, Type=0, Start=Slider(3, range=0..20), End=Slider(0, range=0..3))
number_slider_4 = Slider(3, range=0..3)
number_slider_5 = Slider(3, range=0..3)
xy_3 = XYPlane(Origin=Point(0, 0, 0))
xy_4 = XYPlane(Origin=Point(0, 0, 0))
expressions = Panel("""1: -x/2
2: x/2""")
offset_l = OffsetLoose(Curve=ext, Distance=expr("-x/2", number_slider_4), Plane=xy_3)  # -> simplify(graft(Curve))

# ---- group: 1
offset_l_2 = OffsetLoose(Curve=ext_2, Distance=expr("-x/2", number_slider_5), Plane=xy_4)  # -> simplify(graft(Curve))

# ----
offset_l_3 = OffsetLoose(Curve=ext, Distance=expr("x/2", number_slider_4), Plane=xy_3)

# ---- group: 2
offset_l_4 = OffsetLoose(Curve=ext_2, Distance=expr("x/2", number_slider_5), Plane=xy_4)

# ----
flip = FlipCurve(Curve=offset_l_3)  # -> simplify(graft(Curve)), Flag
flip_2 = FlipCurve(Curve=offset_l_4)  # -> simplify(graft(Curve)), Flag
# Oriented Surface
connect = ConnectCurves(Curves=[offset_l_2, flip_2.Curve], Continuity=0, Close=True, Bulge=1)
connect_2 = ConnectCurves(Curves=[offset_l, flip.Curve], Continuity=0, Close=True, Bulge=1)
crv_5 = Curve(orient_2.Geometry)

# ==== cluster RemoveEnds: Removes first and last item of a list
L = ClusterInput()
cull_i = CullIndex(List=reverse(L), Indices=0, Wrap=True)
cull_i_2 = CullIndex(List=reverse(cull_i), Indices=0, Wrap=True)
L_2 = ClusterOutput(cull_i_2)
