# Grasshopper definition 01_BucklingBridge.gh (Grasshopper 0.9.76)
# Copyright: B+G Engineers
# plug-ins: Karamba

# create geometry
pt = Point(Point(5, 5, 0))
pt_2 = Point(Point(55, 5, 0))
spacing = Slider(2.8, range=0.5..5)
width = Slider(5, range=2..12)
height = Slider(4, range=0.5..10)
vec2pt = Vector2Pt(PointA=pt, PointB=pt_2, Unitize=False)  # -> Vector, Length
division = Division(A=vec2pt.Length, B=spacing)
panel = Panel("""-0.5
-0.5
0.0
0.5
0.5""")
panel_2 = Panel("""1
0
0
0
1""")
# 01 - Buckling Bridge
# Difficulty: Moderate (PRO version only)
# A U-shaped bridge is analyzed using Second Order Theory to view the buckling modes. Scroll through the loadcases to see how the structure buckles. The diagonal members are treated as truss elements.
# The vibrations of the bridge can be view with the Natural Vibrations component.
align = AlignPlane(Plane=pt, Direction=vec2pt.Vector)  # -> Plane, Angle
range = Range(Domain=vec2pt.Length, Steps=division)
multiplication = Multiplication(A=width, B=panel)
multiplication_2 = Multiplication(A=height, B=panel_2)
aligndim = AlignedDimension(Plane=PlaneXY(0, 0, 0), PointA=pt, PointB=pt_2, Offset=-5, Text="{0:0.00}", Size=1)
pt_3 = PointOriented(BasePlane=align.Plane, UComponent=range, VComponent=graft(multiplication), WComponent=graft(multiplication_2))  # -> simplify(Point)
bang = ExplodeTree(Data=pt_3)  # -> Branch0, Branch1, Branch2, Branch3, Branch4
pline = PolyLine(Vertices=pt_3, Closed=False)  # -> flatten(Polyline)
flip = FlipMatrix(Data=pt_3)
cluster = Cluster_3(pt=bang.Branch0, pt_2=bang.Branch1)
cluster_2 = Cluster_3(pt=bang.Branch4, pt_2=bang.Branch3)
shift = ShiftList(List=bang.Branch2, Shift=1, Wrap=False)
pline_2 = PolyLine(Vertices=flip, Closed=False)
cull_i = CullIndex(List=pline, Indices="2", Wrap=True)
ln = Line(StartPoint=bang.Branch1, EndPoint=shift)
ln_2 = Line(StartPoint=bang.Branch3, EndPoint=shift)
explode = Explode(Curve=pline_2, Recursive=True)  # -> Segments, Vertices
explode_2 = Explode(Curve=cull_i, Recursive=True)  # -> Segments, Vertices
line = Line([cluster, cluster_2, ln, ln_2])
crosecrselect = CrossSectionRangeSelectorKaramba(MaximumHeight_cm=-1, MaximumWidth_cm=-1, menu=[dropdown(0), dropdown(1), dropdown(3)])
panel_3 = Panel("""1
2""")
mass_kg_m² = Panel("500")
panel_4 = Panel("""1
2""")
cluster_3 = Cluster(P=flatten(pt_3))
entwine = Entwine(Branch00=explode.Segments, Branch01=explode_2.Segments, Branch02=line, FlattenInputs=True)
item = ListItem(List=cull_i, Index=panel_3, Wrap=True)
item_2 = ListItem(List=cull_i, Index=panel_4, Wrap=True)
i = Slider(3, range=0..20)
i_2 = Slider(5, range=0..20)
i_3 = Slider(8, range=0..20)
panel_5 = Panel("D")
deplane = DeconstructPlane(Plane=align.Plane)  # -> Origin, XAxis, YAxis, ZAxis
panel_6 = Panel("""U
M
D""")
end = EndPoints(Curve=item)  # -> Start, End
Z = UnitZ(Factor="-5")
panel_7 = Panel("U")
cluster_4 = Cluster_2(M=cluster_3, x=mass_kg_m², C=item_2)  # -> R, i
panel_8 = Panel("U")
panel_9 = Panel("M")
panel_10 = Panel("U")
panel_11 = Panel("M")
panel_12 = Panel("""U
M
D""")
panel_13 = Panel("D")
pln = Plane(align.Plane)
# define material
matselect = MaterialSelectionKaramba(ElementsIdentifiers=panel_12, menu=[dropdown(1), dropdown(2)])
# convert line to beam
linetobeam = LineToBeamKaramba(Line=entwine, New=True, Remove=True, LimitDistance_m=0.005, BeamIdentifier=graft(panel_6))  # -> Points, flatten(Element), Info
# define cross sections
crosecselect = CrossSectionSelectorKaramba(ElementsIdentifiers=panel_8, NameOrListIndexOfCrossSection=i_2, CrossSections=crosecrselect)  # -> CrossSection, Info
crosecselect_2 = CrossSectionSelectorKaramba(ElementsIdentifiers=panel_9, NameOrListIndexOfCrossSection=i_3, CrossSections=crosecrselect)  # -> CrossSection, Info
crosecselect_3 = CrossSectionSelectorKaramba(ElementsIdentifiers=panel_5, NameOrListIndexOfCrossSection=i, CrossSections=crosecrselect)  # -> CrossSection, Info
# modify elements
modifyelem = ModifyElementKaramba(BeamIdentifier=panel_10, ZOri=deplane.XAxis, Alpha_deg="90", mode="Beam")
modifyelem_2 = ModifyElementKaramba(BeamIdentifier=panel_11, Alpha_deg="90", mode="Beam")
pmass = PointMassKaramba(Mass=cluster_4.R, PosInd=cluster_4.i, Density=7850)
modifyelem_3 = ModifyElementKaramba(BeamIdentifier=panel_13, Bending=Toggle(False), mode="Beam")
loads = LoadsKaramba(
    Vector=Z,
    Mesh=cluster_3,
    BeamIdentifiers=panel_7,
    LCase=0,
    mode="Mesh Load",
    menu=[buttons(off, on, off), buttons(off, on)])
# define supports
supp = SupportKaramba(PosInd=end.Start, PlaneOfReference=pln, menu=[buttons(on, on, on, off, off, off)])
supp_2 = SupportKaramba(PosInd=end.End, PlaneOfReference=pln, menu=[buttons(off, on, on, off, off, off)])
# define loads
loads_2 = LoadsKaramba(Vector=Vector(0, 0, -1), LCase=0, mode="Gravity")
element = ElementKaramba([linetobeam.Element, modifyelem_3, modifyelem, modifyelem_2])
support = SupportKaramba([supp, supp_2])
load = LoadKaramba(flatten([loads_2, loads, pmass]))
crosec = CrossSectionKaramba([crosecselect.CrossSection, crosecselect_2.CrossSection, crosecselect_3.CrossSection])
# assemble model
assemble = AssembleModelKaramba(Elem=element, Support=support, Load=load, CrossSection=crosec, Material=matselect, LimitDistance_m=0.005)  # -> Model, Info, Mass_kg, CenterOfGravity
# analyze model using
# second order theory
analyzethii = AnalyzeThIIKaramba(Model=assemble.Model, LoadCase=-1, RTolerance=1e-07, MaxIterations=50, NoTensionalNII=False)  # -> CalculatedModel, MaximumDisplacement_m, ResultingForceOfGravity_kN, ElasticEnergy_kNm
# view buckling modes
bmodes = BucklingModesKaramba(Model=analyzethii.CalculatedModel, FromIndex=1, NumberOfModes="10", MaximumNumberOfIterations=300, Epsilon=1e-07)  # -> ModelWithBucklingModesAsLoadCaseResults, BucklingLoadFactors
beam_solution = Panel(bmodes.BucklingLoadFactors)
lc = Slider(1, range=1..10)
# utilization
modelview = ModelViewKaramba(Model=analyzethii.CalculatedModel, LoadCaseFactorsForLinearSuperposition=1, IndexIncrementOfVisibleLoadcase=0)  # -> Model, DeformedMesh, DeformedAxes, DeformedModel
# natural vibrations
nvibes = NaturalVibrationsKaramba(Model=analyzethii.CalculatedModel, FromIndex=1, NumberOfModes="10", MaximumNumberOfIterations=30, Epsilon=1e-05)  # -> ModelWithVibrationModesAsLoadCaseResults, NaturalFrequencies_Hz, ModalMass_kg, ParticipationFactorInGlobalXYAndZDirection
beam_solution_2 = Panel(nvibes.NaturalFrequencies_Hz)
lc_2 = Slider(1, range=1..10)
beamview = BeamViewKaramba(Model=modelview.Model)  # -> Model, MeshesOfRenderedBeams, DeformedBeamAxes, LegendColors, LegendTags
modelview_2 = ModelViewKaramba(
    Model=bmodes.ModelWithBucklingModesAsLoadCaseResults,
    LoadCaseFactorsForLinearSuperposition=1,
    IndexIncrementOfVisibleLoadcase=lc)  # -> Model, DeformedMesh, DeformedAxes, DeformedModel
modelview_3 = ModelViewKaramba(
    Model=nvibes.ModelWithVibrationModesAsLoadCaseResults,
    LoadCaseFactorsForLinearSuperposition=1,
    IndexIncrementOfVisibleLoadcase=lc_2)  # -> Model, DeformedMesh, DeformedAxes, DeformedModel
legend = Legend(Colour=beamview.LegendColors, Tags=beamview.LegendTags, LegendType=1)
beamview_2 = BeamViewKaramba(Model=modelview_2.Model)  # -> Model, MeshesOfRenderedBeams, DeformedBeamAxes, LegendColors, LegendTags
beamview_3 = BeamViewKaramba(Model=modelview_3.Model)  # -> Model, MeshesOfRenderedBeams, DeformedBeamAxes, LegendColors, LegendTags

# ==== cluster Cluster
P = ClusterInput()
hull = ConvexHull(Points=P, Plane=PlaneXY(0, 0, 0))  # -> Hull, HullZ, Indices
Z = UnitZ(Factor="-0.1")
move = Move(Geometry=hull.Hull, Motion=Z)  # -> Geometry, Transform
mesh = MeshBrep(
    Brep=move.Geometry,
    Settings={GridMaxCount=0, GridMinCount=0, JaggedSeams=False, MaxEdgeLength=0.4, MinEdgeLength=0.4, MinTolerance=0, Refine=False, RefineAngle=0, RelativeTolerance=0, SimplePlanes=False, Tolerance=0})
tri = Triangulate(Mesh=mesh)  # -> Mesh, Count
M = ClusterOutput(tri.Mesh)

# ==== cluster Cluster_2
M = ClusterInput()
C = ClusterInput()
x = ClusterInput()
area = MeshArea(Mesh=M)  # -> Area, Centroid
facen = FaceNormals(Mesh=M)  # -> Centers, Normals
cp = ControlPoints(Curve=C)  # -> flatten(Points), Weights, Knots
lng = ListLength(List=facen.Centers)
pull = PullPoint(Point=facen.Centers, Geometry=cp.Points, ClosestOnly=True)  # -> ClosestPoint, Distance
division = Division(A=area.Area, B=lng)
pgroups = PointGroups(Points=pull.ClosestPoint, Distance=0.01)  # -> Groups, Indices
lng_2 = ListLength(List=pgroups.Groups)  # -> flatten(Length)
expression = Expression(x=x, y=division, z=lng_2, Expression="x*y*z")
item = ListItem(List=pgroups.Groups, Index=0, Wrap=True)  # -> flatten(Item)
R = ClusterOutput(expression)
i = ClusterOutput(item)

# ==== cluster Cluster_3
pt = ClusterInput()
pt_2 = ClusterInput()
pt_3 = Point(pt)
pt_4 = Point(pt_2)
shift = ShiftList(List=pt_3, Shift=1, Wrap=False)
shift_2 = ShiftList(List=pt_4, Shift=1, Wrap=False)
short = ShortestList(ListA=pt_4, ListB=shift, TrimMode=2)  # -> ListA, ListB
short_2 = ShortestList(ListA=pt_3, ListB=shift_2, TrimMode=2)  # -> ListA, ListB
ln = Line(StartPoint=short.ListA, EndPoint=short.ListB)
ln_2 = Line(StartPoint=short_2.ListA, EndPoint=short_2.ListB)
cull_i = CullIndex(List=ln, Indices=0, Wrap=True)
culln = CullNth(List=cull_i, CullFrequency=2)
culln_2 = CullNth(List=ln_2, CullFrequency=2)
line = Line([culln_2, culln])
line_2 = ClusterOutput(line)
