# Grasshopper definition 01_TruckOnABridge.gh (Grasshopper 0.9.76)
# Copyright: B+G Engineers
# plug-ins: Karamba

beam_spacing = Slider(1.8, range=0..10)
bridge_width = Slider(10, range=8..20)
panel = Panel("""-0.5
0.0
0.5""")
pt = Point([Point(10, 15, 0), Point(45, 15, 0), Point(95, 15, 0), Point(140, 15, 0)])
pline = PolyLine(Vertices=pt, Closed=False)
multiplication = Multiplication(A=panel, B=bridge_width)
offset_l = OffsetLoose(Curve=pline, Distance=multiplication)
explode = Explode(Curve=offset_l, Recursive=True)  # -> Segments, Vertices
# 01 - Truck on a Bridge
# Difficulty: Moderate (FREE/PRO versions only)
# A truck moves over a simple bridge. It is simulated using mesh loads. Beam IDs are set to define several cross section sizes. Various Load Cases act on the model including gravity, point loads of the trucks and wind loads.
# See the vibrations of the structure by enabling the Natural Vibrations component. See the eigenmodes of the structure by enabling the Eingenmodes component.
flip = FlipMatrix(Data=explode.Segments)
# create geometry
len = Length(Curve=flip)
division = Division(A=len, B=beam_spacing)
cluster = Cluster_4(D=explode.Vertices)  # -> i, item_2_2, L_2, L
avr = Average(Input=division)
aligndim = AlignedDimension(
    Plane=PlaneXY(0, 0, 0),
    PointA=[cluster.i, cluster.L],
    PointB=[cluster.item_2_2, cluster.L_2],
    Offset=-5,
    Text="{0:0.00}",
    Size=1)
divide = DivideCurve(Curve=flip, Count=avr, Kinks=False)  # -> simplify(Points), Tangents, Parameters
path_mapper = PathMapper(divide.Points, source="{A;B}", target="{B}")
dcon = DeleteConsecutive(Set=path_mapper, Wrap=False)  # -> Set, Count
flip_2 = FlipMatrix(Data=dcon.Set)
pline_2 = PolyLine(Vertices=dcon.Set, Closed=False)
pline_3 = PolyLine(Vertices=flip_2, Closed=False)
length_of_truck = Slider(6, range=3..10)
loas_cases = Slider(26, range=2..30)
explode_2 = Explode(Curve=pline_2, Recursive=True)  # -> Segments, Vertices
explode_3 = Explode(Curve=pline_3, Recursive=True)  # -> Segments, Vertices
list = ValueList({"left side": 0, "right side": 2}, selected="left side")
entwine = Entwine(Branch00=explode_2.Segments, Branch01=explode_3.Segments, FlattenInputs=True)
number_slider = Slider(1, range=0..3)
cluster_2 = Cluster(D=dcon.Set, B=beam_spacing, I=list, N=loas_cases, A=length_of_truck)  # -> M, F
crosecrselect = CrossSectionRangeSelectorKaramba(MaximumHeight_cm=-1, MaximumWidth_cm=-1, menu=[dropdown(1), dropdown(1), dropdown(3)])
lng = ListLength(List=crosecrselect)  # -> expr("x-1", Length)
pt_2 = Point(explode.Vertices)
load_of_truck = Panel("-100")
multiplication_2 = Multiplication(A=[Slider(0.84, range=0..1), Slider(0.46, range=0..1)], B=lng)
ids = Panel("""Main
Sec""")
lng_2 = ListLength(List=cluster_2.M)
ids_2 = Panel("Sec")
Z = UnitZ(Factor=load_of_truck)
cull_i = CullIndex(List=pt_2, Indices=number_slider, Wrap=True)  # -> flatten(List)
series = Series(Start=0, Step=1, Count=lng_2)
# define supports
item = ListItem(List=pt_2, Index=number_slider, Wrap=True)  # -> flatten(Item)
ids_3 = Panel("""Main
Sec""")
# define materials
matselect = MaterialSelectionKaramba(ElementsIdentifiers=ids, menu=[dropdown(1), dropdown(2)])
crosecselect = CrossSectionSelectorKaramba(ElementsIdentifiers=graft(ids), NameOrListIndexOfCrossSection=graft(multiplication_2), CrossSections=crosecrselect)  # -> flatten(CrossSection), Info
# define cross sections
panel_2 = Panel(crosecselect.CrossSection)
# convert line to beam
linetobeam = LineToBeamKaramba(Line=entwine, New=True, Remove=True, LimitDistance_m=0.005, BeamIdentifier=graft(ids_3))  # -> Points, Element, Info
loads = LoadsKaramba(
    Vector=Z,
    Mesh=cluster_2.M,
    BeamIdentifiers=ids_2,
    LCase=series,
    mode="Mesh Load",
    menu=[buttons(off, off, on), buttons(on, off)])
supp = SupportKaramba(PosInd=item, menu=[buttons(on, on, on, off, off, on)])
supp_2 = SupportKaramba(PosInd=cull_i, menu=[buttons(off, on, on, off, off, off)])
# define loads
loads_2 = LoadsKaramba(Vector=Vector(0, 0, -1), LCase="-1", mode="Gravity")
load = LoadKaramba(flatten([loads_2, loads]))
support = SupportKaramba([supp, supp_2])
# assemble model
assemble = AssembleModelKaramba(
    Elem=flatten(linetobeam.Element),
    Support=flatten(support),
    Load=flatten(load),
    CrossSection=flatten(crosecselect.CrossSection),
    Material=matselect,
    LimitDistance_m=0.005)  # -> Model, Info, Mass_kg, CenterOfGravity
select_loadcase = Slider(0.458, range=0..1)
# analyze model
analyzethi = AnalyzeThIKaramba(Model=assemble.Model)  # -> CalculatedModel, MaximumDisplacement_m, ResultingForceOfGravity_kN, ElasticEnergy_kNm
cluster_3 = Cluster_2(L=analyzethi.MaximumDisplacement_m, y=select_loadcase)
number_of_mode = Slider(3, range=0..10)  # disabled
number_of_mode_2 = Slider(1, range=0..3)  # disabled
# view eigenmodes
emodes = EigenModes(Model=assemble.Model, FromIndex=1, NumberOfModes=15)  # -> ModelWithEigenModesAsLoadCaseResults, Eigenvalues; disabled
# view natural vibrations
nvibes = NaturalVibrationsKaramba(Model=assemble.Model, FromIndex=1, NumberOfModes=20, MaximumNumberOfIterations=30, Epsilon=1e-05)  # -> ModelWithVibrationModesAsLoadCaseResults, NaturalFrequencies_Hz, ModalMass_kg, ParticipationFactorInGlobalXYAndZDirection; disabled
# view results
modelview = ModelViewKaramba(Model=analyzethi.CalculatedModel, LoadCaseFactorsForLinearSuperposition=1, IndexIncrementOfVisibleLoadcase=cluster_3)  # -> Model, MeshOfRendering, DeformedStructure, DeformedModel
modelview_2 = ModelViewKaramba(
    Model=emodes.ModelWithEigenModesAsLoadCaseResults,
    LoadCaseFactorsForLinearSuperposition=1,
    IndexIncrementOfVisibleLoadcase=number_of_mode)  # -> Model, MeshOfRendering, DeformedStructure, DeformedModel; disabled
modelview_3 = ModelViewKaramba(
    Model=nvibes.ModelWithVibrationModesAsLoadCaseResults,
    LoadCaseFactorsForLinearSuperposition=1,
    IndexIncrementOfVisibleLoadcase=number_of_mode_2)  # -> Model, MeshOfRendering, DeformedStructure, DeformedModel; disabled
def_scale = Panel("10")
beamview = BeamViewKaramba(Model=modelview.Model)  # -> Model, MeshesOfRenderedBeams, DeformedBeamAxes, LegendColors, LegendTags
beamview_2 = BeamViewKaramba(Model=modelview_2.Model)  # -> Model, MeshOfRendering, DeformedBeamAxes, LegendColors, LegendTags; disabled
beamview_3 = BeamViewKaramba(Model=modelview_3.Model)  # -> Model, MeshOfRendering, DeformedBeamAxes, LegendColors, LegendTags; disabled
cluster_4 = Cluster_3(model=modelview.Model, num=cluster_3, num_2=def_scale, pln=cluster_2.F, F=length_of_truck)
legend = Legend(Colour=beamview.LegendColors, Tags=beamview.LegendTags, LegendType=1)
preview = CustomPreview(Geometry=cluster_4, Shader=ColourSwatch(SwatchColor=RGBA(56, 56, 56, 153)))

# ==== cluster Cluster
D = ClusterInput()
B = ClusterInput()
I = ClusterInput()
N = ClusterInput()
A = ClusterInput()
path = ConstructPath(Indices=I)
split = SplitTree(Data=simplify(D), Masks=flatten(path))  # -> Positive, Negative
range = Range(Domain=Domain(0, 1), Steps=N)
division = Division(A=A, B=B)
lng = ListLength(List=split.Negative)
expression = Expression(x=lng, y=range, z=division, Expression="min((x-1)*y+z/2,x-1)")
expression_2 = Expression(x=lng, y=range, z=division, Expression="max((x-1)*y-z/2,0)")
item = ListItem(List=split.Negative, Index=expression_2, Wrap=True)
item_2 = ListItem(List=split.Negative, Index=expression, Wrap=False)
bang = ExplodeTree(Data=item)  # -> Branch0, Branch1
bang_2 = ExplodeTree(Data=item_2)  # -> Branch0, Branch1
srf4pt = _4PointSurface(CornerA=bang.Branch0, CornerB=bang.Branch1, CornerC=bang_2.Branch1, CornerD=bang_2.Branch0)  # -> reparameterize(graft(Surface))
panel = Panel(""""0 to "&0.5/x/0.8
1-0.5/0.8/x&" to 1"
""")
area = Area(Geometry=srf4pt)  # -> Area, Centroid
evalsrf = EvaluateSurface(Surface=reparameterize(srf4pt), Point="0.5,0.5,0")  # -> Point, Normal, flatten(Frame)
eval = Evaluate(F=panel, x=area.Area)
dom² = ConstructDomain²(DomainU="0.1 to 0.9", DomainV=eval)
subsrf = Isotrim(Surface=srf4pt, Domain=dom²)
mesh = MeshBrep(
    Brep=subsrf,
    Settings={GridMaxCount=0, GridMinCount=60, JaggedSeams=False, MaxEdgeLength=0, MinEdgeLength=0.0001, MinTolerance=0, Refine=False, RefineAngle=0, RelativeTolerance=0, SimplePlanes=False, Tolerance=0})
mjoin = MeshJoin(Meshes=mesh)  # -> flatten(Mesh)
M = ClusterOutput(mjoin)
F = ClusterOutput(evalsrf.Frame)

# ==== cluster Cluster_2
y = ClusterInput()
L = ClusterInput()
lng = ListLength(List=L)
expression = Expression(x=lng, y=y, Expression="(x-1)*y+1")
R = ClusterOutput(expression)

# ==== cluster Cluster_3
mesh = Mesh(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)
model = ClusterInput()
num = ClusterInput()
num_2 = ClusterInput()
pln = ClusterInput()
F = ClusterInput()
num_3 = Number(expr("x-1", num))
nodedisp = NodalDisplacementsKaramba(AnalyzedModel=model)  # -> AnalyzedModel, NodalTranslations_m, NodalRotations_rad
disassemble = DisassembleModelKaramba(Model=model)  # -> Model, Point, Beam, Shell, Support, Load, Line, Mesh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
scale = Scale(Geometry=mesh, Center=Point(0, 0, 0), Factor=expr("x/3.8", F))  # -> Geometry, Transform
num_4 = Number(num_2)
pln_2 = Plane(pln)
item = ListItem(List=pln_2, Index=num_3, Wrap=True)
branch = TreeBranch(Tree=simplify(nodedisp.NodalTranslations_m), Path=num_3, MaintainPaths=True)
branch_2 = TreeBranch(Tree=simplify(nodedisp.NodalRotations_rad), Path=num_3, MaintainPaths=True)
cps = ClosestPoints(Point=item, Cloud=disassemble.Point, Count="4")  # -> ClosestPoint, CPIndex, Distance
item_2 = ListItem(List=branch_2, Index=cps.CPIndex, Wrap=True)
item_3 = ListItem(List=branch, Index=cps.CPIndex, Wrap=True)
multiplication = Multiplication(A=item_3, B=num_4)
multiplication_2 = Multiplication(A=item_2, B=num_4)
avr = Average(Input=multiplication)
avr_2 = Average(Input=multiplication_2)
move = Move(Geometry=item, Motion=avr)  # -> Geometry, Transform
devec = DeconstructVector(Vector=avr_2)  # -> XComponent, expr("-x", YComponent), ZComponent
move_2 = Move(Geometry=item, Motion=avr)  # -> Geometry, Transform
deplane = DeconstructPlane(Plane=move_2.Geometry)  # -> Origin, XAxis, YAxis, ZAxis
pt = Point(move_2.Geometry)
rot3d = Rotate3D(Geometry=move_2.Geometry, Angle=devec.XComponent, Center=pt, Axis=deplane.YAxis)  # -> Geometry, Transform
rot3d_2 = Rotate3D(Geometry=rot3d.Geometry, Angle=devec.YComponent, Center=pt, Axis=deplane.XAxis)  # -> Geometry, Transform
rot3d_3 = Rotate3D(Geometry=rot3d_2.Geometry, Angle=devec.ZComponent, Center=pt, Axis=deplane.ZAxis)  # -> Geometry, Transform
orient = Orient(Geometry=scale.Geometry, Source=PlaneXY(0, 0, 0), Target=rot3d_3.Geometry)  # -> Geometry, Transform
G = ClusterOutput(orient.Geometry)

# ==== cluster Cluster_4
D = ClusterInput()
flip = FlipMatrix(Data=D)
item = ListItem(List=flatten(flip), Index=0, Wrap=True)  # -> Item, Item1, Item2
item_2 = ListItem(List=flip, Index=0, Wrap=True)  # -> flatten(Item)
i = ClusterOutput(item.Item)
item_2_2 = ClusterOutput(item.Item2)
cull_i = CullIndex(List=reverse(item_2), Indices=0, Wrap=True)  # -> reverse(List)
cull_i_2 = CullIndex(List=item_2, Indices=0, Wrap=True)
L = ClusterOutput(cull_i_2)
L_2 = ClusterOutput(cull_i)
