# Grasshopper definition 03_BESOBracingWalls.gh (Grasshopper 0.9.76)
# Copyright: B+G Engineers
# plug-ins: Karamba

# create axis geometry
pt = Point(Point(0, 0, 4))
panel = Panel("""0.25
0.75
0.5""")
panel_2 = Panel("""0.25
0.25
0.75""")

wall_1 = Slider(0.692, range=0..1)
wall_2 = Slider(0.691, range=0..1)
wall_3 = Slider(0.284, range=0..1)

vec = VectorXYZ(XComponent=panel, YComponent=panel_2, ZComponent=0)  # -> Vector, Length
# 03 - BESO of Bracing Walls
# Difficulty: Moderate (FREE/PRO versions only)
# The effect of the orientation of three walls on their effectiveness as bracing elements for horizontal loads on a floor plate. There are three load cases: wind in X and Y-direction and vertical point loads. Contains a workaround to display
# the loadcase with the largest deformance. Topology resulting from applying the BESO for Beams component to the structure begins to eliminate certain members. The cross section optimizer is not available in the FREE version.
planesrf = PlaneSurface(Plane=pt, XSize="-10 to 10", YSize="-10 to 10")
evalsrf = EvaluateSurface(Surface=reparameterize(planesrf), Point=vec.Vector)  # -> Point, Normal, Frame
expression = Expression(x=[wall_1, wall_2, wall_3], Expression="x*pi")
deplane = DeconstructPlane(Plane=evalsrf.Frame)  # -> Origin, XAxis, YAxis, ZAxis
vrot = Rotate(Vector=deplane.XAxis, Axis=deplane.ZAxis, Angle=expression)
Z = UnitZ(Factor=-1)
pl = ConstructPlane(Origin=evalsrf.Point, XAxis=vrot, YAxis=Z)
devec = DeconstructVector(Vector=pt)  # -> XComponent, YComponent, ZComponent
planesrf_2 = PlaneSurface(Plane=pl, XSize="-2 to 2", YSize=devec.ZComponent)

cluster = Cluster_3(C=[planesrf, planesrf_2])  # -> F, P, P_2
aligndim = AlignedDimension(
    Plane=cluster.F,
    PointA=cluster.P,
    PointB=cluster.P_2,
    Offset=Slider(1.4, range=0..10),
    Text="{0:0.00}",
    Size=Slider(0.54, range=0..1))

sdivide = DivideSurface(Surface=planesrf_2, UCount="4", VCount="4")  # -> Points, Normals, Parameters
sdivide_2 = DivideSurface(Surface=planesrf, UCount="20", VCount="20")  # -> Points, Normals, Parameters
pull = PullPoint(Point=sdivide_2.Points, Geometry=planesrf_2, ClosestOnly=True)  # -> ClosestPoint, Distance
larger = LargerThan(FirstNumber=pull.Distance, SecondNumber="0.8")  # -> LargerThan, OrEqualTo
item = ListItem(List=reverse(sdivide.Points), Index=0, Wrap=True)  # -> flatten(Item)
trim = TrimTree(Tree=simplify(sdivide.Points), Depth=1)
item_2 = ListItem(List=sdivide.Points, Index=0, Wrap=True)
cull = CullPattern(List=sdivide_2.Points, CullPattern=larger.LargerThan)
prox = Proximity3D(Points=flatten([cull, item_2]), Group="9", MaxRadius="1.9")  # -> Links, Topology
prox_2 = Proximity3D(Points=trim, Group="9", MaxRadius="1.9")  # -> Links, Topology
trim_2 = TrimTree(Tree=simplify(prox_2.Links), Depth=1)
cluster_2 = Cluster(L=flatten(prox.Links), P=pt)  # -> A, B
cluster_3 = Cluster(L=trim_2, P=graft(planesrf_2))  # -> A, B
pt_2 = Point(sdivide_2.Points)
flip = FlipMatrix(Data=pt_2)
entwine = Entwine(Branch00=cluster_2.A, Branch01=cluster_2.B, Branch02=cluster_3.A, Branch03=cluster_3.B, FlattenInputs=True)
item_3 = ListItem(List=flip, Index=0, Wrap=True)
item_4 = ListItem(List=pt_2, Index=0, Wrap=True)
panel_3 = Panel("""50,0,0
0,50,0""")
panel_4 = Panel("""0
1""")
entwine_2 = Entwine(Branch00=item_3, Branch01=item_4, FlattenInputs=True)
range = Range(Domain="5 to 75", Steps=10)
# create axis geometry
# convert lines to beams
# assemble model
# BESO
# view results
# define supports
# define loads
# define cross sections
expression_2 = Expression(x=range, Expression="x*0.05")
# define cross sections
panel_5 = Panel("-1")
panel_6 = Panel("""A
B
C
D""")
# define loads
loads = LoadsKaramba(ForceVector=graft(panel_3), Local=True, PosInd=entwine_2, LCase=graft(panel_4), mode="Point")  # -> flatten(Load)
# convert lines to beams
linetobeam = LineToBeamKaramba(Line=entwine, New=True, Remove=True, LDist=0.005, Identifier=graft(panel_6))  # -> Point, flatten(Beam), Info
cross_sections = CrossSectionsKaramba(Diameter_cm=range, WallThickness_cm=expression_2, mode="Circular Hollow")
# define supports
supp = SupportKaramba(PosInd=item, menu=[buttons(on, on, on, off, off, off)])
loads_2 = LoadsKaramba(Vector="0,0,-1", LCase=panel_5, mode="Gravity")
item_5 = ListItem(List=cross_sections, Index=0, Wrap=True)
# assemble model
assemble = AssembleModelKaramba(
    Elem=flatten(linetobeam.Beam),
    Support=flatten(supp),
    Load=flatten([loads, loads_2]),
    CrossSection=flatten(item_5),
    LDist=0.005)  # -> Model, Info, Mass, CenterOfGravity
number_slider = Slider(0.3, range=0..1)
panel_7 = Panel("""B
D""")
panel_8 = Panel("""0
1""")
# BESO
besobeam = BESOForBeamsKaramba(
    Model=assemble.Model,
    ElemIdentifiers=panel_7,
    LCases=panel_8,
    TargetMassRatio=number_slider,
    NumberOfChangeIterations="3",
    NumberOfConvergenceIterations="0",
    WeightingFactorForTension=1,
    WeightingFactorForCompression=1,
    WeightingFactorForShear=0,
    WeightingFactorForMoments=0,
    BESOFactor=0,
    MinimumDistanceBetweenChangingElements=0,
    RelativeWeightLimit=0)  # -> MaximumDisplacement, OptimizedModel, HistoryOfTheBESO, ElementIsActive, DistributionOfWeights
# cross section optimization
opticrosec = OptimizeCrossSectionKaramba(
    Model=besobeam.OptimizedModel,
    CrossSections=flatten(cross_sections),
    MaximumUtilization="0.7",
    MaximumDisplacement_m=-1,
    UltimateLimitStateIterations=5,
    DisplacementIterations=5,
    NumberOfSamplePoints=3,
    ElasticDesign=True,
    GammaM0=1,
    GammaM1=1)  # -> ModelWithOptimizedCrossSections, Info, Mass_kg, MaximumDisplacement_m, ElasticEnergy_kNm
# analyze (free version)
analyzethi = AnalyzeThIKaramba(Model=besobeam.OptimizedModel)  # -> CalculatedModel, MaximumDisplacement_m, ResultingForceOfGravity_kN, ElasticEnergy_kNm; disabled
# select
# LoadCase
# with highest
# deflection
cluster_4 = Cluster_2(K=analyzethi.MaximumDisplacement_m)
# select
# LoadCase
# with highest
# deflection
cluster_5 = Cluster_2(K=opticrosec.MaximumDisplacement_m)
total_mass = Panel(opticrosec.Mass_kg)
displacement = Panel(opticrosec.MaximumDisplacement_m)
# view results
modelview = ModelViewKaramba(Model=analyzethi.CalculatedModel, LoadCaseFactorsForLinearSuperposition=1, IndexIncrementOfVisibleLoadcase=cluster_4)  # -> Model, MeshOfRendering, DeformedStructure, DeformedModel; disabled
# view results
modelview_2 = ModelViewKaramba(
    Model=opticrosec.ModelWithOptimizedCrossSections,
    LoadCaseFactorsForLinearSuperposition=1,
    IndexIncrementOfVisibleLoadcase=cluster_5)  # -> Model, MeshOfRendering, DeformedStructure, DeformedModel
beamview = BeamViewKaramba(Model=modelview.Model)  # -> Model, MeshOfRendering, DeformedBeamAxes, LegendColors, LegendTags; disabled
beamview_2 = BeamViewKaramba(Model=modelview_2.Model)  # -> Model, MeshOfRendering, DeformedBeamAxes, LegendColors, LegendTags
legend = Legend(Colour=beamview.LegendColors, Tags=beamview.LegendTags, LegendType=1)  # disabled
legend_2 = Legend(Colour=beamview_2.LegendColors, Tags=beamview_2.LegendTags, LegendType=1)

# ==== cluster Cluster
L = ClusterInput()
P = ClusterInput()
rdlines = RemoveDuplicateLinesKaramba(Line=L, LimitDistance=0.005)  # -> OutLine, Info, Indexes
deplane = DeconstructPlane(Plane=P)  # -> Origin, XAxis, YAxis, ZAxis
angle = Angle(VectorA=rdlines.OutLine, VectorB=deplane.XAxis)  # -> Angle, Reflex
expression = Expression(x=angle.Angle, Expression="(x+0.3)%(pi/2)<0.5")
dispatch = Dispatch(List=rdlines.OutLine, DispatchPattern=expression)  # -> ListA, ListB
A = ClusterOutput(dispatch.ListA)
B = ClusterOutput(dispatch.ListB)

# ==== cluster Cluster_2
K = ClusterInput()
lng = ListLength(List=K)
series = Series(Start="1", Step=1, Count=lng)
sort = SortList(Keys=K, ValuesA=series)  # -> Keys, ValuesA
item = ListItem(List=reverse(sort.ValuesA), Index=0, Wrap=True)
i = ClusterOutput(item)

# ==== cluster Cluster_3
C = ClusterInput()
bbox = BoundingBox(Content=C, Plane=PlaneXY(0, 0, 0), UnionBox=True)  # -> Box, Box_2
panel = Panel("""4
4
3""")
debrep = DeconstructBrep(Brep=bbox.Box)  # -> Faces, Edges, Vertices
item = ListItem(List=flatten(debrep.Faces), Index=panel, Wrap=True)
panel_2 = Panel("""0,0,0
0,1,0
1,1,0""")
panel_3 = Panel("""0,1,0
1,1,0
1,0,0""")
evalsrf = EvaluateSurface(Surface=reparameterize(item), Point=panel_3)  # -> Point, Normal, Frame
evalsrf_2 = EvaluateSurface(Surface=reparameterize(item), Point=panel_2)  # -> Point, Normal, Frame
F = ClusterOutput(evalsrf.Frame)
P = ClusterOutput(evalsrf_2.Point)
P_2 = ClusterOutput(evalsrf.Point)
