# Grasshopper definition 03_Optimization_SupportPositions.gh (Grasshopper 0.9.76)
# plug-ins: Karamba

# create geometry
slider = Slider(20, range=2..40)
# parameters for supports
genes = GeneList(Decimals=3, Maximum=1, Minimum=0, Value=[0.964, 0.561, 0.275, 0.278, 0, 0.812, 0.686, 0.097, 0.552, 0.797])
galapagos = Galapagos(fitness=displacement, gene=genes)
range = Range(Domain="0 to 20", Steps=slider)
# 03 - Optimization of Support Positions
# Difficulty: Simple
# This definition uses Galapagos to find the support positions for the minimum deflection of a rectangular grid of beams.
# Set the Grid to 2x3 to view in the TRIAL version. The FREE version does not include the cross section optimizer.
pt = ConstructPoint(XCoordinate=range, YCoordinate=graft(range), ZCoordinate=0)
bbox = BoundingBox(Content=flatten(pt), Plane=PlaneXY(0, 0, 0), UnionBox=True)  # -> Box, Box_2
flip = FlipMatrix(Data=pt)
multiplication = Multiplication(A=slider, B=genes)
debrep = DeconstructBrep(Brep=bbox.Box)  # -> Faces, Edges, Vertices
pline = PolyLine(Vertices=pt, Closed=False)
pline_2 = PolyLine(Vertices=flip, Closed=False)
dispatch = Dispatch(List=multiplication, DispatchPattern=[True, False])  # -> ListA, ListB
item = ListItem(List=debrep.Vertices, Index=0, Wrap=True)  # -> Item, Item1, Item2, Item3
explode = Explode(Curve=[pline, pline_2], Recursive=True)  # -> flatten(Segments), Vertices
item_2 = TreeItem(Tree=simplify(pt), Path=dispatch.ListA, Index=dispatch.ListB, Wrap=True)
aligndim = AlignedDimension(
    Plane=PlaneXY(0, 0, 0),
    PointA=[item.Item1, item.Item2],
    PointB=[item.Item2, item.Item3],
    Offset=-1,
    Text="{0:0.00}",
    Size=1)
# define cross sections
panel = Panel("HEA200")
crosecrselect = CrossSectionRangeSelectorKaramba(MaximumHeight_cm=-1, MaximumWidth_cm=-1, menu=[dropdown(0), dropdown(0), dropdown(3)])
crosecselect = CrossSectionSelectorKaramba(NameOrListIndexOfCrossSection=panel, CrossSections=crosecrselect)  # -> CrossSection, Info
# convert lines to beams
linetobeam = LineToBeamKaramba(Line=explode.Segments, New=True, Remove=True, LDist=0.005)  # -> Point, Beam, Info
# define supports
supp = SupportKaramba(PosInd=item_2, menu=[buttons(on, on, on, off, off, off)])
# define loads
loads = LoadsKaramba(Vector=Vector(0, 0, -1), LCase=0, mode="Gravity")
# assemble model
assemble = AssembleModelKaramba(Elem=linetobeam.Beam, Support=supp, Load=loads, CrossSection=crosecselect.CrossSection, LDist=0.005)  # -> Model, Info, Mass, CenterOfGravity
# analyze model (free version)
analyzethi = AnalyzeThIKaramba(Model=assemble.Model)  # -> ModelWithDisplacements, MaximumDisplacement_m, ResultingForceOfGravity_kN, ElasticEnergy_kNm
# optimize cross sections
opticrosec = OptimizeCrossSectionKaramba(
    Model=assemble.Model,
    CrossSections=crosecrselect,
    MaximumUtilization=1,
    MaximumDisplacement_m=-1,
    UltimateLimitStateIterations=5,
    DisplacementIterations=5,
    NumberOfSamplePoints=3,
    ElasticDesign=True,
    GammaM0=1,
    GammaM1=1)  # -> ModelWithOptimizedCrossSections, Info, Mass_kg, MaximumDisplacement_m, ElasticEnergy_kNm
displacement = Number(opticrosec.MaximumDisplacement_m)
displacement_2 = Panel(displacement)
# view results
modelview = ModelViewKaramba(
    Model=opticrosec.ModelWithOptimizedCrossSections,
    LoadCaseFactorsForLinearSuperposition=1,
    IndexIncrementOfVisibleLoadcase=0)  # -> Model, MeshOfRendering, DeformedStructure, DeformedModel
beamview = BeamViewKaramba(Model=modelview.Model)  # -> Model, MeshOfRendering, DeformedBeamAxes, LegendColors, LegendTags
