# Grasshopper definition Bar Example.gh (Grasshopper 0.9.76)
# plug-ins: Karamba

box = CenterBox(Base=PlaneXY(0, 0, 0), X=3, Y=1, Z=1.15)
debox = DeconstructBox(Box=box)  # -> Plane, X, Y, Z
debox_2 = DeconstructBox(Box=box)  # -> Plane, X, Y, Z
dedomain = DeconstructDomain(Domain=debox.Z)  # -> Start, End
dedomain_2 = DeconstructDomain(Domain=debox_2.Z)  # -> Start, End
pt = ConstructPoint(XCoordinate=0, YCoordinate=0, ZCoordinate=dedomain.End)
pt_2 = ConstructPoint(XCoordinate=0, YCoordinate=0, ZCoordinate=dedomain_2.Start)
xy = XYPlane(Origin=pt)
xy_2 = XYPlane(Origin=pt_2)
pop2d = Populate2D(Region=box, Count=7, Seed=634)
pop2d_2 = Populate2D(Region=box, Count=10, Seed=1)
project = Project(Geometry=pop2d_2, Plane=xy_2)  # -> Geometry, Transform
pop3d = Populate3D(Region=box, Count=100, Seed=1)
project_2 = Project(Geometry=pop2d, Plane=xy)  # -> Geometry, Transform
pt_3 = Point(flatten([pop3d, project.Geometry, project_2.Geometry]))
graft = GraftTree(Tree=pt_3, IncludeEmptyLists=True, IncludeNullItems=True)
cps = ClosestPoints(Point=graft, Cloud=pt_3, Count=5)  # -> ClosestPoint, CPIndex, Distance
cull_i = CullIndex(List=cps.ClosestPoint, Indices=0, Wrap=True)
ln = Line(StartPoint=graft, EndPoint=cull_i)  # -> flatten(Line)
eval = EvaluateLength(Curve=ln, Length=0.5, Normalized=True)  # -> Point, Tangent, Parameter
con = DelaunayEdges(Points=project_2.Geometry, Plane=PlaneXY(0, 0, 0))  # -> Connectivity, Edges
number_slider = Slider(4.2, range=0..10)
cullpt = CullDuplicates(Points=eval.Point, Tolerance=0.1, CullMode=1)  # -> Points, Indices, Valence
split = SplitList(List=project.Geometry, Index="3")  # -> ListA, ListB
vec = VectorXYZ(XComponent=Slider(2, range=0..10), YComponent=Slider(2, range=0..10), ZComponent=0)  # -> Vector, Length
item = ListItem(List=project_2.Geometry, Index=Slider(5, range=0..10), Wrap=True)
devec = DeconstructVector(Vector=item)  # -> XComponent, YComponent, ZComponent
item_2 = ListItem(List=ln, Index=cullpt.Indices, Wrap=True)
item_3 = ListItem(List=con.Edges, Index=Slider(7, range=0..20), Wrap=True)
Z = UnitZ(Factor=Slider(0.088, range=0.02..0.2))
divide = DivideCurve(Curve=item_3, Count=2, Kinks=False)  # -> Points, Tangents, Parameters
readmattable = ReadMaterialTableFromFileKaramba()
shatter = Shatter(Curve=item_3, Parameters=divide.Parameters)
neg = Negative(Value=Z)
cross_sections = CrossSectionsKaramba(Height_cm=number_slider, UpperFlangeWidth_cm=number_slider, LowerFlangeWidth_cm=number_slider, mode="Trapezoid")
matselect = MaterialSelectionKaramba(NameOrListIndexOfMaterial="Wood", Materials=readmattable, menu=[dropdown(0), dropdown(0)])
linetobeam = LineToBeamKaramba(Line=flatten([con.Edges, shatter]), New=True, Remove=True, LimitDistance_m=0.005, BeamIdentifier="Top")  # -> Points, Element, Info
supp = SupportKaramba(PosInd=split.ListA, menu=[buttons(on, on, on, off, off, off)])
loads = LoadsKaramba(ForceVector=vec.Vector, Local=True, PosInd=item, LCase=0, mode="Point")
supp_2 = SupportKaramba(PosInd=split.ListB, menu=[buttons(on, off, on, off, off, off)])
loads_2 = LoadsKaramba(ForceVector=neg, Local=True, PosInd=[project_2.Geometry, divide.Points], LCase=0, mode="Point")  # -> flatten(Load)
linetobeam_2 = LineToBeamKaramba(Line=item_2, New=True, Remove=True, LimitDistance_m=0.005, BeamIdentifier="Frame")  # -> Points, Element, Info
loads_3 = LoadsKaramba(Vector=Vector(0, 0, -1), LCase=0, mode="Gravity")
assemble = AssembleModelKaramba(
    Point=divide.Points,
    Elem=flatten([linetobeam_2.Element, linetobeam.Element]),
    Support=flatten([supp, supp_2]),
    Load=flatten([loads_3, loads_2, loads]),
    CrossSection=cross_sections,
    Material=matselect,
    LimitDistance_m=0.005)  # -> Model, Info, Mass_kg, CenterOfGravity
modelview = ModelViewKaramba(Model=assemble.Model, LoadCaseFactorsForLinearSuperposition=1, IndexIncrementOfVisibleLoadcase=0)  # -> Model, DeformedMesh, DeformedAxes, DeformedModel
besobeam = BESOForBeamsKaramba(
    Model=modelview.Model,
    LCases=0,
    TargetMassRatio=Slider(1, range=0..1),
    NumberOfChangeIterations=10,
    NumberOfConvergenceIterations=20,
    WeightingFactorForTension=1,
    WeightingFactorForCompression=1,
    WeightingFactorForShear=0,
    WeightingFactorForMoments=0,
    BESOFactor=0,
    MinimumDistanceBetweenChangingElements=0,
    RelativeWeightLimit=0)  # -> MaximumDisplacement, OptimizedModel, HistoryOfTheBESO, ElementIsActive, DistributionOfWeights
analyzethi = AnalyzeThIKaramba(Model=modelview.Model)  # -> CalculatedModel, MaximumDisplacement_m, ResultingForceOfGravity_kN, ElasticEnergy_kNm
modelview_2 = ModelViewKaramba(Model=analyzethi.CalculatedModel, LoadCaseFactorsForLinearSuperposition=1, IndexIncrementOfVisibleLoadcase=0)  # -> Model, DeformedMesh, DeformedAxes, DeformedModel
modelview_3 = ModelViewKaramba(Model=besobeam.OptimizedModel, LoadCaseFactorsForLinearSuperposition=1, IndexIncrementOfVisibleLoadcase=0)  # -> Model, DeformedMesh, DeformedAxes, DeformedModel
beamview = BeamViewKaramba(Model=modelview_2.Model)  # -> Model, MeshesOfRenderedBeams, DeformedBeamAxes, LegendColors, LegendTags
beamview_2 = BeamViewKaramba(Model=modelview_3.Model)  # -> Model, MeshesOfRenderedBeams, DeformedBeamAxes, LegendColors, LegendTags
mesh = Mesh(beamview.MeshesOfRenderedBeams)
legend = Legend(Colour=beamview.LegendColors, Tags=beamview.LegendTags, LegendType=1)
legend_2 = Legend(Colour=beamview_2.LegendColors, Tags=beamview_2.LegendTags, LegendType=1)
