# Grasshopper definition Mesh.gh (Grasshopper 0.9.76)

number_slider = Slider(5, range=1..100)
crv = Curve([<curve referenced from the Rhino model> x148])
crv_2 = Curve([<curve referenced from the Rhino model> x148])
topoly = CurveToPolyline(Curve=crv, ToleranceDistance=0, ToleranceAngle=0, MaxEdge=5)  # -> Polyline, Segments
bbox = BoundingBox(Content=crv_2, Plane=PlaneXY(0, 0, 0))  # -> Box, Box_2
debox = DeconstructBox(Box=bbox.Box)  # -> Plane, X, Y, Z
explode = Explode(Curve=topoly.Polyline, Recursive=True)  # -> Segments, Vertices
flatten = FlattenTree(Tree=explode.Vertices, Path="{0}")
project = Project(Geometry=flatten, Plane=PlaneXY(0, 0, 0))  # -> Geometry, Transform
Z = UnitZ(Factor=-100)
range = Range(Domain=debox.Y, Steps=100)  # disabled
crv_3 = Curve(<curve referenced from the Rhino model>)
project_2 = Project(Geometry=crv_3, Plane=PlaneXY(0, 0, 0))  # -> Geometry, Transform
debox_2 = DeconstructBox(Box=project_2.Geometry)  # -> Plane, X, Y, Z
planesrf = PlaneSurface(Plane=debox_2.Plane, XSize=debox_2.X, YSize=debox_2.Y)
divide = DivideDomain²(Domain=planesrf, UCount=3, VCount=4)
subsrf = Isotrim(Surface=planesrf, Domain=divide)
debox_3 = DeconstructBox(Box=subsrf)  # -> Plane, X, Y, Z
dedomain = DeconstructDomain(Domain=debox_3.X)  # -> Start, End
dedomain_2 = DeconstructDomain(Domain=debox_3.Y)  # -> Start, End
expression = Expression(x=dedomain_2.Start, y=dedomain_2.End, z=number_slider, Expression="(y-x)/z")
expression_2 = Expression(x=dedomain.Start, y=dedomain.End, z=number_slider, Expression="(y-x)/z")
planesrf_2 = PlaneSurface(Plane=debox_3.Plane, XSize=debox_3.X, YSize=debox_3.Y)
sdivide = DivideSurface(Surface=subsrf, UCount=expression_2, VCount=expression)  # -> simplify(Points), Normals, Parameters
Z_2 = UnitZ(Factor=-100)
incurve = PointInCurve(Point=project.Geometry, Curve=project_2.Geometry)  # -> Relationship, Point
move = Move(Geometry=crv_3, Motion=Z)  # -> Geometry, Transform
Z_3 = UnitZ(Factor=200)
dim = Dimensions(Surface=subsrf)  # -> UDimension, VDimension
pt = ConstructPoint(XCoordinate=0, YCoordinate=range, ZCoordinate=0)  # disabled
crv_4 = Curve(flatten([<curve referenced from the Rhino model> x147]))  # disabled
int = Integer(2)
move_2 = Move(Geometry=sdivide.Points, Motion=Z_2)  # -> Geometry, Transform
del = DelaunayMesh(Points=flatten(explode.Vertices), Plane=PlaneXY(0, 0, 0))
xz = XZPlane(Origin=pt)  # disabled
boundary = BoundarySurfaces(Edges=move.Geometry)
extr = Extrude(Base=move.Geometry, Direction=Z_3)
mindex = MemberIndex(Set=incurve.Relationship, Member=int)  # -> Index, Count
panel = Panel(dim.VDimension)
item = ListItem(Index=0, Wrap=True)
graft = GraftTree(Tree=xz, IncludeEmptyLists=True, IncludeNullItems=True)  # -> simplify(Tree); disabled
pcx = CurvePlane(Curve=crv_4, Plane=graft(xz))  # -> Points, ParamsC, ParamsP; disabled
mesh = MeshBrep(
    Brep=extr,
    Settings={GridMaxCount=0, GridMinCount=16, JaggedSeams=False, MaxEdgeLength=0, MinEdgeLength=0.0001, MinTolerance=0, Refine=True, RefineAngle=0, RelativeTolerance=0.65, SimplePlanes=True, Tolerance=0})
item_2 = ListItem(List=flatten, Index=mindex.Index, Wrap=True)
mmx = MeshMesh(MeshA=del, MeshB=extr, UseMeshMeshFast=True)
trim = TrimTree(Tree=pcx.Points, Depth=1)  # -> simplify(Tree); disabled
msplit = MeshSplit(Mesh=del, Splitters=mesh)
crv_5 = Curve(flatten([<curve referenced from the Rhino model> x147]))
plcoord = PlaneCoordinates(Point=trim, System=simplify(graft))  # -> XCoordinate, YCoordinate, ZCoordinate; disabled
topoly_2 = CurveToPolyline(Curve=mmx, ToleranceDistance=0, ToleranceAngle=0, MaxEdge=5)  # -> Polyline, Segments
sort = SortList(Keys=plcoord.XCoordinate, ValuesA=trim)  # -> Keys, ValuesA; disabled
explode_2 = Explode(Curve=topoly_2.Polyline, Recursive=True)  # -> Segments, Vertices
pt_2 = Point(explode_2.Vertices)
pline = PolyLine(Vertices=sort.ValuesA, Closed=False)  # disabled
panel_2 = Panel(trim)  # disabled
Z_4 = UnitZ(Factor=1)
del_2 = DelaunayMesh(Points=flatten([pt_2, item_2]), Plane=PlaneXY(0, 0, 0))
meshray = MeshRay(Mesh=del_2, Point=move_2.Geometry, Direction=Z_4)  # -> simplify(Point), Hit
trim_2 = TrimTree(Tree=meshray.Point, Depth=1)
bbox_2 = BoundingBox(Content=del_2, Plane=PlaneXY(0, 0, 0))  # -> Box, Box_2
expression_3 = Expression(Expression="1/1000")
del_3 = DelaunayMesh(Points=trim_2, Plane=PlaneXY(0, 0, 0))  # -> flatten(Mesh)
area = Area(Geometry=planesrf)  # -> Area, Centroid
debox_4 = DeconstructBox(Box=bbox_2.Box)  # -> Plane, X, Y, Z
xy = XYPlane(Origin=area.Centroid)
dedomain_3 = DeconstructDomain(Domain=debox_4.Z)  # -> Start, End
xy_2 = XYPlane(Origin=Point(0, 0, 0))
cull_i = CullIndex(List=del_3, Indices=[4, 5, 6, 7], Wrap=True)
expression_4 = Expression(x=dedomain_3.Start, y=dedomain_3.End, Expression="y-x")
orient = Orient(Geometry=cull_i, Source=xy, Target=xy_2)  # -> Geometry, Transform
panel_3 = Panel(expression_4)
xy_3 = XYPlane(Origin=Point(0, 0, 0))
scale = Scale(Geometry=orient.Geometry, Center=xy_2, Factor=expression_3)  # -> Geometry, Transform
sec = MeshPlane(Mesh=scale.Geometry, Plane=xy_3)
