# Grasshopper definition Rigid Node Example.gh (Grasshopper 0.9.76)
# plug-ins: Karamba

box = DomainBox(Base=PlaneXY(0, 0, 0), X=Domain(0, 5), Y=Domain(0, 5), Z=Domain(0, 5))
box_2 = DomainBox(Base=PlaneXY(0, 0, 0), X=Domain(0, 5), Y=Domain(0, 5), Z=Domain(0, 5))
volume = Volume(Geometry=box)  # -> Volume, Centroid
debrep = DeconstructBrep(Brep=box)  # -> Faces, Edges, Vertices
pdecon = Deconstruct(Point=debrep.Vertices)  # -> XComponent, YComponent, ZComponent
volume_2 = Volume(Geometry=box_2)  # -> Volume, Centroid
debrep_2 = DeconstructBrep(Brep=box_2)  # -> Faces, Edges, Vertices
pdecon_2 = Deconstruct(Point=debrep_2.Vertices)  # -> XComponent, YComponent, ZComponent
expression = Expression(x=pdecon.ZComponent, Expression="x≤0")
expression_2 = Expression(x=pdecon_2.ZComponent, Expression="x≤0")
dispatch = Dispatch(List=debrep.Vertices, DispatchPattern=expression)  # -> ListA, ListB
dispatch_2 = Dispatch(List=debrep_2.Vertices, DispatchPattern=expression_2)  # -> ListA, ListB
pline = PolyLine(Vertices=dispatch.ListB, Closed=True)
item = ListItem(List=dispatch.ListA, Index=0, Wrap=True)
pline_2 = PolyLine(Vertices=dispatch_2.ListB, Closed=True)
item_2 = ListItem(List=dispatch_2.ListA, Index=0, Wrap=True)
pt = Point(flatten([dispatch.ListB, volume.Centroid]))
explode = Explode(Curve=pline, Recursive=True)  # -> Segments, Vertices
pt_2 = Point(flatten([dispatch_2.ListB, volume_2.Centroid]))
ln = Line(StartPoint=volume.Centroid, EndPoint=flatten([item, dispatch.ListB]))
explode_2 = Explode(Curve=pline_2, Recursive=True)  # -> Segments, Vertices
ln_2 = Line(StartPoint=volume_2.Centroid, EndPoint=flatten([item_2, dispatch_2.ListB]))
pt_3 = Point(item)
pt_4 = Point(item_2)
neg = Negative(Value=Slider(0.02, range=0.02..20))
# With the rigid node off, the system starts to warp and bend.
panel = Panel("Frame")
# This is the example joint
dots = DotDisplay(Point=volume.Centroid, Colour=RGB(0, 0, 0), Size=0.2)
neg_2 = Negative(Value=Slider(0.02, range=0.02..20))
# T and R for supports limit movement.
# So, with Rx Ry Rz selected we can create rigid nodes in the system.
# 
# Check below for a different example
panel_2 = Panel("Frame")
# This is the example joint
dots_2 = DotDisplay(Point=volume_2.Centroid, Colour=RGB(0, 0, 0), Size=0.2)
Z = UnitZ(Factor=neg)
Z_2 = UnitZ(Factor=neg_2)
loads = LoadsKaramba(ForceVector=Z, Local=True, PosInd=pt, LCase=0, mode="Point")  # -> flatten(Load)
supp = SupportKaramba(PosInd=volume.Centroid, menu=[buttons(off, off, off, off, off, off)])
linetobeam = LineToBeamKaramba(Line=[ln, explode.Segments], New=True, Remove=True, LimitDistance_m=0.005, BeamIdentifier=panel)  # -> Points, Element, Info
supp_2 = SupportKaramba(PosInd=pt_3, menu=[buttons(on, on, on, on, on, on)])
loads_2 = LoadsKaramba(Vector=Vector(0, 0, -1), LCase=0, mode="Gravity")
loads_3 = LoadsKaramba(ForceVector=Z_2, Local=True, PosInd=pt_2, LCase=0, mode="Point")  # -> flatten(Load)
supp_3 = SupportKaramba(PosInd=volume_2.Centroid, menu=[buttons(off, off, off, on, on, on)])
linetobeam_2 = LineToBeamKaramba(Line=[ln_2, explode_2.Segments], New=True, Remove=True, LimitDistance_m=0.005, BeamIdentifier=panel_2)  # -> Points, Element, Info
supp_4 = SupportKaramba(PosInd=pt_4, menu=[buttons(on, on, on, on, on, on)])
loads_4 = LoadsKaramba(Vector=Vector(0, 0, -1), LCase=0, mode="Gravity")
assemble = AssembleModelKaramba(Elem=flatten(linetobeam.Element), Support=flatten([supp_2, supp]), Load=flatten([loads_2, loads]), LimitDistance_m=0.005)  # -> Model, Info, Mass_kg, CenterOfGravity
assemble_2 = AssembleModelKaramba(
    Elem=flatten(linetobeam_2.Element),
    Support=flatten([supp_4, supp_3]),
    Load=flatten([loads_4, loads_3]),
    LimitDistance_m=0.005)  # -> Model, Info, Mass_kg, CenterOfGravity
modelview = ModelViewKaramba(Model=assemble.Model, LoadCaseFactorsForLinearSuperposition=1, IndexIncrementOfVisibleLoadcase=0)  # -> Model, DeformedMesh, DeformedAxes, DeformedModel
modelview_2 = ModelViewKaramba(Model=assemble_2.Model, LoadCaseFactorsForLinearSuperposition=1, IndexIncrementOfVisibleLoadcase=0)  # -> Model, DeformedMesh, DeformedAxes, DeformedModel
analyzethi = AnalyzeThIKaramba(Model=modelview.Model)  # -> CalculatedModel, MaximumDisplacement_m, ResultingForceOfGravity_kN, ElasticEnergy_kNm
analyzethi_2 = AnalyzeThIKaramba(Model=modelview_2.Model)  # -> CalculatedModel, MaximumDisplacement_m, ResultingForceOfGravity_kN, ElasticEnergy_kNm
modelview_3 = ModelViewKaramba(Model=analyzethi.CalculatedModel, LoadCaseFactorsForLinearSuperposition=1, IndexIncrementOfVisibleLoadcase=0)  # -> Model, DeformedMesh, DeformedAxes, DeformedModel
modelview_4 = ModelViewKaramba(Model=analyzethi_2.CalculatedModel, LoadCaseFactorsForLinearSuperposition=1, IndexIncrementOfVisibleLoadcase=0)  # -> Model, DeformedMesh, DeformedAxes, DeformedModel
beamview = BeamViewKaramba(Model=modelview_3.Model)  # -> Model, MeshesOfRenderedBeams, DeformedBeamAxes, LegendColors, LegendTags
panel_3 = Panel("Preview this")
beamview_2 = BeamViewKaramba(Model=modelview_4.Model)  # -> Model, MeshesOfRenderedBeams, DeformedBeamAxes, LegendColors, LegendTags
mesh = Mesh(beamview.MeshesOfRenderedBeams)
mesh_2 = Mesh(beamview_2.MeshesOfRenderedBeams)
legend = Legend(Colour=beamview.LegendColors, Tags=beamview.LegendTags, LegendType=1)
legend_2 = Legend(Colour=beamview_2.LegendColors, Tags=beamview_2.LegendTags, LegendType=1)
