# Grasshopper definition Shear Example.gh (Grasshopper 0.9.76)
# plug-ins: Karamba

srf = Surface(<surface referenced from the Rhino model>)
pt = Point([<point referenced from the Rhino model> x4])
item = ListItem(List=pt, Index=0, Wrap=True)
item_2 = ListItem(List=pt, Index=[1, 2, 3], Wrap=True)
mesh_breps = MeshBreps(Brep=srf, MeshResolution=1, EdgeRefinementFactor=0.67, PointReduction=False, SmoothingStepSize=0, SmoothingIterations=5)  # -> Mesh, Info
Z = UnitZ(Factor=1)
neg = Negative(Value=Z)
cross_sections = CrossSectionsKaramba(Heights_cm=1, mode="Shell")
loads = LoadsKaramba(ForceVector=neg, Local=True, PosInd=item, LCase=0, mode="Point")
supp = SupportKaramba(PosInd=item_2, menu=[buttons(on, on, on, on, on, on)])
meshtoshell = MeshToShellKaramba(Mesh=mesh_breps.Mesh, LDist=0.005)  # -> Point, Element, Info
assemble = AssembleModelKaramba(Elem=meshtoshell.Element, Support=supp, Load=loads, LimitDistance_m=0.005)  # -> Model, Info, Mass_kg, CenterOfGravity
analyzethi = AnalyzeThIKaramba(Model=assemble.Model)  # -> CalculatedModel, MaximumDisplacement_m, ResultingForceOfGravity_kN, ElasticEnergy_kNm
modelview = ModelViewKaramba(Model=analyzethi.CalculatedModel, LoadCaseFactorsForLinearSuperposition=1, IndexIncrementOfVisibleLoadcase=0)  # -> Model, DeformedMesh, DeformedAxes, DeformedModel
X = UnitX(Factor=1)
shellview = ShellViewKaramba(Model=modelview.Model)  # -> Model, MeshesOfRenderedShells, LegendColors, LegendTags
shelllineresults = LineResultsOnShellsKaramba(
    AnalyzedModel=modelview.Model,
    Layer=Slider(1, range=0..1),
    ListOfSourcesOfPrincipalStressLinesLinesPoints=meshtoshell.Point,
    SegmentLength_m=0.5,
    DA_deg=5,
    mode="PrincStress")  # -> AnalyzedModel, Lines1, Lines2
