# Grasshopper definition AS_001 - .gh (Grasshopper 0.9.76)
# plug-ins: Karamba

pt = ConstructPoint(XCoordinate=Slider(1845, range=0..10000), YCoordinate=Slider(479, range=0..1000), ZCoordinate=-803)
pt_2 = ConstructPoint(XCoordinate=Slider(1113, range=0..10000), YCoordinate=Slider(479, range=0..1000), ZCoordinate=-803)
box = DomainBox(Base=pt, X=Domain(-2, 2), Y=Domain(-0.5, 0.5), Z=Domain(0, 0.25))
crv = Curve(<curve referenced from the Rhino model>)
box_2 = DomainBox(Base=pt_2, X=Domain(-2, 2), Y=Domain(-0.5, 0.5), Z=Domain(0, 0.25))
panel = Panel("42")  # disabled
area = Area(Geometry=box)  # -> Area, Centroid
area_2 = Area(Geometry=box_2)  # -> Area, Centroid
crv_2 = Curve([<curve referenced from the Rhino model> x5])  # disabled
Z = UnitZ(Factor=panel)  # disabled
readmattable = ReadMaterialTableFromFileKaramba()
divide = DivideCurve(Curve=crv, Count=Slider(14, range=0..14), Kinks=False)  # -> Points, Tangents, Parameters
extr = Extrude(Base=crv_2, Direction=Z)  # disabled
number_slider = Slider(2000, range=0..10000)
pt_3 = Point([<point referenced from the Rhino model> x6])
pt_4 = Point([<point referenced from the Rhino model> x6])
matselect = MaterialSelectionKaramba(NameOrListIndexOfMaterial="wood", Materials=readmattable, menu=[dropdown(0), dropdown(0)])
ln = Line(StartPoint=pt_4, EndPoint=area_2.Centroid)  # -> flatten(Line)
ln_2 = Line(StartPoint=pt_3, EndPoint=area.Centroid)  # -> flatten(Line)
mesh = MeshBrep(
    Brep=extr,
    Settings={GridMaxCount=0, GridMinCount=16, JaggedSeams=False, MaxEdgeLength=0, MinEdgeLength=0.0001, MinTolerance=0, Refine=True, RefineAngle=0, RelativeTolerance=0.65, SimplePlanes=True, Tolerance=0})  # disabled
item = ListItem(List=divide.Points, Index=11, Wrap=True)
item_2 = ListItem(List=divide.Points, Index=14, Wrap=True)
item_3 = ListItem(List=divide.Points, Index=13, Wrap=True)
item_4 = ListItem(List=divide.Points, Index=12, Wrap=True)
item_5 = ListItem(List=divide.Points, Index=6, Wrap=True)
item_6 = ListItem(List=divide.Points, Index=4, Wrap=True)
item_7 = ListItem(List=divide.Points, Index=8, Wrap=True)
item_8 = ListItem(List=divide.Points, Index=7, Wrap=True)
item_9 = ListItem(List=divide.Points, Index=10, Wrap=True)
item_10 = ListItem(List=divide.Points, Index=9, Wrap=True)
item_11 = ListItem(List=divide.Points, Index=5, Wrap=True)
item_12 = ListItem(List=divide.Points, Index=3, Wrap=True)
item_13 = ListItem(List=divide.Points, Index=2, Wrap=True)
table_truss = Curve(<curve referenced from the Rhino model>)
item_14 = ListItem(List=divide.Points, Index=1, Wrap=True)
Z_2 = UnitZ(Factor=Slider(0.1, range=0..0.1))
ln_3 = Line(StartPoint=item_4, EndPoint=item)
bbox = BoundingBox(Content=mesh, Plane=PlaneXY(0, 0, 0))  # -> Box, Box_2; disabled
ln_4 = Line(StartPoint=item_10, EndPoint=item_7)
ln_5 = Line(StartPoint=item_6, EndPoint=item_12)
ln_6 = Line(StartPoint=item_3, EndPoint=item_4)
ln_7 = Line(StartPoint=item_7, EndPoint=item_8)
ln_8 = Line(StartPoint=item_8, EndPoint=item_5)
ln_9 = Line(StartPoint=item_11, EndPoint=item_6)
ln_10 = Line(StartPoint=item, EndPoint=item_9)
ln_11 = Line(StartPoint=item_5, EndPoint=item_11)
ln_12 = Line(StartPoint=item_13, EndPoint=item_14)
ln_13 = Line(StartPoint=item_9, EndPoint=item_10)
ln_14 = Line(StartPoint=item_2, EndPoint=item_3)
ln_15 = Line(StartPoint=item_12, EndPoint=item_13)
ln_16 = Line(StartPoint=item_2, EndPoint=item_14)
join = JoinCurves(Curves=[ln_14, ln_6, ln_3, ln_10, ln_13, ln_4, ln_7, ln_8, ln_11, ln_9, ln_5, ln_15, ln_12, ln_16], Preserve=False)
neg = Negative(Value=Z_2)
debox = DeconstructBox(Box=bbox.Box)  # -> Plane, X, Y, Z; disabled
cross_sections = CrossSectionsKaramba(Height_cm=number_slider, UpperFlangeWidth_cm=number_slider, LowerFlangeWidth_cm=number_slider, mode="Trapezoid")
linetobeam = LineToBeamKaramba(Line=flatten([table_truss, join]), New=True, Remove=True, LimitDistance_m=0.005, BeamIdentifier="top")  # -> Points, Element, Info
supp = SupportKaramba(PosInd=area.Centroid, menu=[buttons(on, on, on, on, off, off)])
supp_2 = SupportKaramba(PosInd=area_2.Centroid, menu=[buttons(on, on, on, on, off, off)])
linetobeam_2 = LineToBeamKaramba(Line=[ln_2, ln], New=True, Remove=True, LimitDistance_m=0.005, BeamIdentifier="frame")  # -> Points, Element, Info
loads = LoadsKaramba(ForceVector=neg, Local=True, PosInd=[pt_3, pt_4], LCase=0, mode="Point")  # -> flatten(Load)
assemble = AssembleModelKaramba(
    Point=[pt_4, pt_3],
    Elem=flatten([linetobeam_2.Element, linetobeam.Element]),
    Support=flatten([supp, supp_2]),
    Load=flatten(loads),
    CrossSection=cross_sections,
    Material=matselect,
    LimitDistance_m=0.005)  # -> Model, Info, Mass_kg, CenterOfGravity
analyzethi = AnalyzeThIKaramba(Model=assemble.Model)  # -> CalculatedModel, MaximumDisplacement_m, ResultingForceOfGravity_kN, ElasticEnergy_kNm
modelview = ModelViewKaramba(Model=analyzethi.CalculatedModel, LoadCaseFactorsForLinearSuperposition=1, IndexIncrementOfVisibleLoadcase=0)  # -> Model, DeformedMesh, DeformedAxes, DeformedModel
beamview = BeamViewKaramba(Model=modelview.Model)  # -> Model, MeshesOfRenderedBeams, DeformedBeamAxes, LegendColors, LegendTags
