# Grasshopper definition AS_001 - AB Comments.gh (Grasshopper 0.9.76)
# plug-ins: Karamba

# 3: Yes, the method you use was very inefficient. Below is a better method.
number_slider = Slider(14, range=0..14)
crv = Curve(<curve referenced from the Rhino model>)
# 3: Find the closest points of the divide to each line.
# Sort these points based on their location on the line, and then test for which points have a distance of roughly 0.
# Dispatch the points that test true.
divide = DivideCurve(Curve=crv, Count=number_slider, Kinks=False)  # -> Points, Tangents, Parameters

# ---- group: 3
# 3: Explode the rectangle, dispatch to get the first and third line.
# Dispatch again, and flip the third line. (This way it has the same direction as the first line)
explode = Explode(Curve=crv, Recursive=True)  # -> Segments, Vertices
dispatch = Dispatch(List=explode.Segments, DispatchPattern=[True, False])  # -> ListA, ListB
dispatch_2 = Dispatch(List=dispatch.ListA, DispatchPattern=[True, False])  # -> ListA, ListB
flip = FlipCurve(Curve=dispatch_2.ListB)  # -> Curve, Flag
crv_2 = Curve(dispatch_2.ListA)
crv_cp = CurveClosestPoint(Point=divide.Points, Curve=flip.Curve)  # -> Point, Parameter, Distance
crv_cp_2 = CurveClosestPoint(Point=divide.Points, Curve=crv_2)  # -> Point, Parameter, Distance
sort = SortList(Keys=crv_cp.Parameter, ValuesB=crv_cp.Point, ValuesA=crv_cp.Distance)  # -> Keys, ValuesB, ValuesA
sort_2 = SortList(Keys=crv_cp_2.Parameter, ValuesB=crv_cp_2.Point, ValuesA=crv_cp_2.Distance)  # -> Keys, ValuesB, ValuesA
expression = Expression(x=sort.ValuesA, Expression="x≈0")
expression_2 = Expression(x=sort_2.ValuesA, Expression="x≈0")
dispatch_3 = Dispatch(List=sort.ValuesB, DispatchPattern=expression)  # -> ListA, ListB
dispatch_4 = Dispatch(List=sort_2.ValuesB, DispatchPattern=expression_2)  # -> ListA, ListB
# 3: Run a default weave to bring the points together in a zig-zag pattern. Polyline between them. Explode for Karamba.
# Also, produced a polyline of the original devided points, to create the border lines.
pt = Point(dispatch_3.ListA)
pt_2 = Point(dispatch_4.ListA)
weave = Weave(Pattern=[0, 1], Stream0=pt_2, Stream1=pt, NullGaps=False)
pline = PolyLine(Vertices=weave, Closed=False)
pline_2 = PolyLine(Vertices=divide.Points, Closed=True)
explode_2 = Explode(Curve=flatten([pline, pline_2]), Recursive=True)  # -> flatten(Segments), Vertices

# ----
# QUESTIONS: 1. The beams are showing up for the members underneath the table top but not the table top frame itself.
# 
# 2. The scaling of the thickness of the beams is way off, even though I have baked and measured the distances myself. I have had to drastically increase the number on the slider that is connected to the cross section component.
# 
# 3. Trying to get the lines in between the points to be individual on the table top, as you can see I had to use an extremely inefficient method of using list item and line from two points. I was wondering what would be the best way to achieve this. I had to make these lines individual so that Karamba would treat them as structural members.
panel = Panel("42")  # disabled
crv_3 = Curve([<curve referenced from the Rhino model> x5])  # disabled
Z = UnitZ(Factor=panel)  # disabled
extr = Extrude(Base=crv_3, Direction=Z)  # disabled
mesh = MeshBrep(
    Brep=extr,
    Settings={GridMaxCount=0, GridMinCount=16, JaggedSeams=False, MaxEdgeLength=0, MinEdgeLength=0.0001, MinTolerance=0, Refine=True, RefineAngle=0, RelativeTolerance=0.65, SimplePlanes=True, Tolerance=0})  # disabled
bbox = BoundingBox(Content=mesh, Plane=PlaneXY(0, 0, 0))  # -> Box, Box_2; disabled

# ---- group: 2
# 2: Karamba seems to work in only meters. I've scale the file and your script to work in meters now.
expression_3 = Expression(x=Slider(1845, range=0..10000), Expression="x/1000")
expression_4 = Expression(x=Slider(479, range=0..1000), Expression="x/1000")
expression_5 = Expression(x=Slider(1113, range=0..10000), Expression="x/1000")
expression_6 = Expression(x=Slider(479, range=0..1000), Expression="x/1000")

# ----
debox = DeconstructBox(Box=bbox.Box)  # -> Plane, X, Y, Z; disabled
Z_2 = Z(Domain(0, 0.0025))
Y = Y(Domain(0, 0.005))
X = X(Domain(-0.02, 0.02))
pt_3 = ConstructPoint(XCoordinate=expression_3, YCoordinate=expression_4, ZCoordinate=-0.803)
pt_4 = ConstructPoint(XCoordinate=expression_5, YCoordinate=expression_6, ZCoordinate=-0.803)
box = DomainBox(Base=pt_3, X=X, Y=Y, Z=Z_2)
box_2 = DomainBox(Base=pt_4, X=X, Y=Y, Z=Z_2)
area = Area(Geometry=box)  # -> Area, Centroid
area_2 = Area(Geometry=box_2)  # -> Area, Centroid
readmattable = ReadMaterialTableFromFileKaramba()
# 2: Karamba only works with lines or meshes, it wont work with polylines. You will need to explode every polyline before you convert to beams. This is why Karamba wasn't registering these as beams.
join = JoinCurves(Curves=explode_2.Segments, Preserve=False)
pt_5 = Point([<point referenced from the Rhino model> x6])
pt_6 = Point([<point referenced from the Rhino model> x6])
matselect = MaterialSelectionKaramba(NameOrListIndexOfMaterial="wood", Materials=readmattable, menu=[dropdown(0), dropdown(0)])

# ---- group: 2
explode_3 = Explode(Curve=join, Recursive=True)  # -> Segments, Vertices

# ----
ln = Line(StartPoint=pt_6, EndPoint=area_2.Centroid)  # -> flatten(Line)
ln_2 = Line(StartPoint=pt_5, EndPoint=area.Centroid)  # -> flatten(Line)
number_slider_2 = Slider(4.2, range=0..10000)
item = ListItem(List=divide.Points, Index=11, Wrap=True)
item_2 = ListItem(List=divide.Points, Index=14, Wrap=True)
item_3 = ListItem(List=divide.Points, Index=13, Wrap=True)
item_4 = ListItem(List=divide.Points, Index=12, Wrap=True)
item_5 = ListItem(List=divide.Points, Index=6, Wrap=True)
item_6 = ListItem(List=divide.Points, Index=4, Wrap=True)
item_7 = ListItem(List=divide.Points, Index=8, Wrap=True)
Z_3 = UnitZ(Factor=Slider(0.1, range=0..0.1))
item_8 = ListItem(List=divide.Points, Index=7, Wrap=True)
item_9 = ListItem(List=divide.Points, Index=10, Wrap=True)
item_10 = ListItem(List=divide.Points, Index=9, Wrap=True)
item_11 = ListItem(List=divide.Points, Index=5, Wrap=True)
item_12 = ListItem(List=divide.Points, Index=3, Wrap=True)
item_13 = ListItem(List=divide.Points, Index=2, Wrap=True)
item_14 = ListItem(List=divide.Points, Index=1, Wrap=True)
neg = Negative(Value=Z_3)
ln_3 = Line(StartPoint=item_4, EndPoint=item)
ln_4 = Line(StartPoint=item_10, EndPoint=item_7)
ln_5 = Line(StartPoint=item_6, EndPoint=item_12)
ln_6 = Line(StartPoint=item_3, EndPoint=item_4)
ln_7 = Line(StartPoint=item_7, EndPoint=item_8)
ln_8 = Line(StartPoint=item_8, EndPoint=item_5)
ln_9 = Line(StartPoint=item_11, EndPoint=item_6)
ln_10 = Line(StartPoint=item, EndPoint=item_9)
ln_11 = Line(StartPoint=item_5, EndPoint=item_11)
ln_12 = Line(StartPoint=item_13, EndPoint=item_14)
ln_13 = Line(StartPoint=item_9, EndPoint=item_10)
ln_14 = Line(StartPoint=item_2, EndPoint=item_3)
ln_15 = Line(StartPoint=item_12, EndPoint=item_13)
ln_16 = Line(StartPoint=item_2, EndPoint=item_14)
linetobeam = LineToBeamKaramba(Line=flatten(explode_3.Segments), New=True, Remove=True, LimitDistance_m=0.005, BeamIdentifier="top")  # -> Points, Element, Info
supp = SupportKaramba(PosInd=area.Centroid, menu=[buttons(on, on, on, on, off, off)])
supp_2 = SupportKaramba(PosInd=area_2.Centroid, menu=[buttons(on, on, on, on, off, off)])
linetobeam_2 = LineToBeamKaramba(Line=[ln_2, ln], New=True, Remove=True, LimitDistance_m=0.005, BeamIdentifier="frame")  # -> Points, Element, Info
loads = LoadsKaramba(ForceVector=neg, Local=True, PosInd=[pt_5, pt_6], LCase=0, mode="Point")  # -> flatten(Load)
cross_sections = CrossSectionsKaramba(Height_cm=number_slider_2, UpperFlangeWidth_cm=number_slider_2, LowerFlangeWidth_cm=number_slider_2, mode="Trapezoid")
assemble = AssembleModelKaramba(
    Point=[pt_6, pt_5],
    Elem=flatten([linetobeam_2.Element, linetobeam.Element]),
    Support=flatten([supp, supp_2]),
    Load=flatten(loads),
    CrossSection=cross_sections,
    Material=matselect,
    LimitDistance_m=0.005)  # -> Model, Info, Mass_kg, CenterOfGravity
analyzethi = AnalyzeThIKaramba(Model=assemble.Model)  # -> CalculatedModel, MaximumDisplacement_m, ResultingForceOfGravity_kN, ElasticEnergy_kNm
modelview = ModelViewKaramba(Model=analyzethi.CalculatedModel, LoadCaseFactorsForLinearSuperposition=1, IndexIncrementOfVisibleLoadcase=0)  # -> Model, DeformedMesh, DeformedAxes, DeformedModel
# COMMENTS: One of your nodes has no support. Its most likely going to be the weakest point of the bar.
# 
# You have a whole bunch of members crossing each other. Karamba says its possible, because Karamba doesn't test for collisions. How are you planning of having the timber members intersect themselves?
beamview = BeamViewKaramba(Model=modelview.Model)  # -> Model, MeshesOfRenderedBeams, DeformedBeamAxes, LegendColors, LegendTags
