# Grasshopper definition IC_006 - AB Comments.gh (Grasshopper 0.9.76)
# plug-ins: Karamba

# ---- group: Table Top
box = CenterBox(Base=PlaneXY(0, 0, 0), X=3, Y=1, Z=1.15)
movetoplane = MoveToPlane(Geometry=box, Plane=PlaneXY(0, 0, 0), Above=True, Below=True)  # -> Geometry, Transform
debrep = DeconstructBrep(Brep=movetoplane.Geometry)  # -> Faces, Edges, Vertices
edges = BrepEdges(Brep=movetoplane.Geometry)  # -> Naked, Interior, NonManifold
pt = Point(debrep.Vertices)
item = ListItem(List=pt, Index=Slider(6, range=0..10), Wrap=True)
item_2 = ListItem(List=pt, Index=Slider(4, range=0..10), Wrap=True)
rec_2pt = Rectangle2Pt(Plane=item_2, PointA=item_2, PointB=item, Radius=0)  # -> Rectangle, Length
Z = UnitZ(Factor=Slider(0.05, range=0..100))
neg = Negative(Value=Z)
extr = Extrude(Base=rec_2pt.Rectangle, Direction=neg)
cap = CapHoles(Brep=extr)

# ----
number_slider = Slider(0.3, range=0..1)
number_slider_2 = Slider(0.5, range=0..1)
number_slider_3 = Slider(7, range=6..20)
number_slider_4 = Slider(78, range=0..100)
item_3 = ListItem(List=debrep.Faces, Index=Slider(4, range=0..10), Wrap=True)
vec = VectorXYZ(XComponent=number_slider_2, YComponent=number_slider, ZComponent=0)  # -> Vector, Length
vec_2 = VectorXYZ(XComponent=number_slider_2, YComponent=number_slider, ZComponent=0)  # -> Vector, Length
neg_2 = Negative(Value=vec.Vector)
rectangle = Rectangle(Plane=PlaneXY(0, 0, 0), XSize=Domain(-0.023, 0.023), YSize=Domain(-0.023, 0.023), Radius=0)  # -> Rectangle, Length
X = UnitX(Factor=Slider(4, range=0..10))
pop2d = Populate2D(Region=item_3, Count=number_slider_3, Seed=number_slider_4)
panel = Panel(pop2d)

# ---- group: Bottom Beams Move to Top Left Point
item_4 = ListItem(List=pop2d, Index=Slider(8, range=0..10), Wrap=True)
item_5 = ListItem(List=pop2d, Index=Slider(3, range=0..10), Wrap=True)

# ---- group: Bottom Beams Moved to Top Right Point
item_6 = ListItem(List=pop2d, Index=Slider(4, range=0..10), Wrap=True)
item_7 = ListItem(List=pop2d, Index=Slider(2, range=0..10), Wrap=True)

# ----
rec_2pt_2 = Rectangle2Pt(Plane=PlaneXY(0, 0, 0), PointA=neg_2, PointB=vec_2.Vector, Radius=0)  # -> Rectangle, Length
debrep_2 = DeconstructBrep(Brep=cap)  # -> Faces, Edges, Vertices
move = Move(Geometry=rectangle.Rectangle, Motion=X)  # -> Geometry, Transform
brep = Brep(cap)
Z_2 = UnitZ(Factor=Slider(0.15, range=0..1))
# Need Help In Orienting to the points so that the object aligns with the beams. Is there a way I can mass orient in the right direction?
Z_3 = UnitZ(Factor=Slider(0.1, range=0..0.1))
bottom_mid_point = Area(Geometry=item_3)  # -> Area, Centroid
extr_2 = Extrude(Base=rec_2pt_2.Rectangle, Direction=Z_2)
item_8 = ListItem(List=debrep_2.Faces, Index=Slider(1, range=0..10), Wrap=True)
extr_3 = Extrude(Base=move.Geometry, Direction=Z_3)
neg_3 = Negative(Value=Slider(0.1, range=0..1))
cap_2 = CapHoles(Brep=extr_2)
offset = Offset(Curve=item_8, Distance=neg_3, Plane=PlaneXY(0, 0, 0), Corners=1)
number_slider_5 = Slider(13, range=0..100)
number_slider_6 = Slider(7, range=6..20)
neg_4 = Negative(Value=0.3)
panel_2 = Panel("""2
4
5
1""")
pop2d_2 = Populate2D(Region=offset, Count=number_slider_6, Seed=number_slider_5)

# ---- group: Top Beams to Bottom Right Point
item_9 = ListItem(List=pop2d_2, Index=Slider(4, range=0..10), Wrap=True)
item_10 = ListItem(List=pop2d_2, Index=Slider(1, range=0..10), Wrap=True)

# ---- group: Top Beams to Bottom Left Point
item_11 = ListItem(List=pop2d_2, Index=Slider(5, range=0..10), Wrap=True)
item_12 = ListItem(List=pop2d_2, Index=Slider(2, range=0..10), Wrap=True)

# ----
vec_3 = VectorXYZ(XComponent=0.3, YComponent=0, ZComponent=0)  # -> Vector, Length
vec_4 = VectorXYZ(XComponent=neg_4, YComponent=0, ZComponent=0)  # -> Vector, Length
panel_3 = Panel("""8
3
4
2""")
cull_i = CullIndex(List=pop2d_2, Indices=panel_2, Wrap=True)
bottom_left_point = Move(Geometry=bottom_mid_point.Centroid, Motion=vec_3.Vector)  # -> Geometry, Transform
bottom_right_point = Move(Geometry=bottom_mid_point.Centroid, Motion=vec_4.Vector)  # -> Geometry, Transform
cull_i_2 = CullIndex(List=pop2d, Indices=panel_3, Wrap=True)
top_mid_point = Area(Geometry=item_8)  # -> Area, Centroid
_1 = Panel("Mass orienting example")
ln = Line(StartPoint=bottom_mid_point.Centroid, EndPoint=cull_i)
ln_2 = Line(StartPoint=bottom_right_point.Geometry, EndPoint=[item_9, item_10])
ln_3 = Line(StartPoint=bottom_left_point.Geometry, EndPoint=[item_11, item_12])
ln_4 = Line(StartPoint=top_mid_point.Centroid, EndPoint=cull_i_2)
merge = Merge(Data1=ln_3, Data2=ln, Data3=ln_2)  # -> flatten(Result)
neg_5 = Negative(Value=0.3)
pt_2 = Point(top_mid_point.Centroid)
merge_2 = Merge(Data1=pt_2, Data2=pop2d_2)  # -> simplify(flatten(Result))
vec_5 = VectorXYZ(XComponent=0.3, YComponent=0, ZComponent=0)  # -> Vector, Length
vec_6 = VectorXYZ(XComponent=neg_5, YComponent=0, ZComponent=0)  # -> Vector, Length
number_of_beams = Number(simplify(flatten([pop2d, pop2d_2])))
top_left_point = Move(Geometry=top_mid_point.Centroid, Motion=vec_5.Vector)  # -> Geometry, Transform
ln_5 = Line(StartPoint=top_left_point.Geometry, EndPoint=[item_4, item_5])
top_right_point = Move(Geometry=top_mid_point.Centroid, Motion=vec_6.Vector)  # -> Geometry, Transform
ln_6 = Line(StartPoint=top_right_point.Geometry, EndPoint=[item_6, item_7])
merge_3 = Merge(Data1=ln_5, Data2=ln_6, Data3=ln_4)  # -> flatten(Result)

# ---- group: Nodes
beam_points = Point(flatten([pop2d_2, pop2d]))
beam_curves = Line([merge, merge_3])
object_to_orient = CapHoles(Brep=extr_3)

# ---- group: 1
pframe = PerpFrame(Curve=reparameterize(beam_curves), Parameter=Slider(0, range=0..1))
pframe_2 = PerpFrame(Curve=reparameterize(beam_curves), Parameter=Slider(1, range=0..1))
area = Area(Geometry=move.Geometry)  # -> Area, Centroid
xy = XYPlane(Origin=area.Centroid)
orient = Orient(Geometry=object_to_orient, Source=xy, Target=pframe)  # -> Geometry, Transform
orient_2 = Orient(Geometry=object_to_orient, Source=xy, Target=pframe_2)  # -> Geometry, Transform

# ----
beam_distance = Number([merge_3, merge])
panel_4 = Panel(beam_distance)
Z_4 = UnitZ(Factor=Slider(2, range=0..10))
readmattable = ReadMaterialTableFromFileKaramba()
pt_3 = Point(flatten([pop2d_2, pop2d, top_left_point.Geometry, top_right_point.Geometry, bottom_left_point.Geometry, bottom_right_point.Geometry, bottom_mid_point.Centroid, top_mid_point.Centroid]))
neg_6 = Negative(Value=Z_4)
linetobeam = LineToBeamKaramba(Line=merge_3, New=True, Remove=True, LimitDistance_m=0.005, BeamIdentifier="Top to Bottom")  # -> Points, Element, Info
linetobeam_2 = LineToBeamKaramba(Line=merge, New=True, Remove=True, LimitDistance_m=0.005, BeamIdentifier="Bottom to Top")  # -> Points, Element, Info
supp = SupportKaramba(PosInd=pt_3, menu=[buttons(on, on, on, on, on, on)])
loads = LoadsKaramba(ForceVector=neg_6, Local=True, PosInd=merge_2, LCase=0, mode="Point")
galapagos = Galapagos(fitness=displacement, gene=[number_slider_3, number_slider_4, number_slider_6, number_slider_5])
loads_2 = LoadsKaramba(Vector=Vector(0, 0, -1), LCase=0, mode="Gravity")
matselect = MaterialSelectionKaramba(Materials=readmattable, menu=[dropdown(3), dropdown(0)])
cross_sections = CrossSectionsKaramba(
    Height_cm=Slider(4, range=0..10000),
    UpperFlangeWidth_cm=Slider(4.2, range=0..10000),
    LowerFlangeWidth_cm=Slider(4.2, range=0..10000),
    UpperFlangeThickness_cm=0.4,
    LowerFlangeThickness_cm=0.4,
    SidewallsThickness_cm=0.4,
    FilletRadius_cm=0.6,
    mode="Box")
crosec = CrossSectionKaramba(cross_sections)
assemble = AssembleModelKaramba(
    Elem=flatten([linetobeam_2.Element, linetobeam.Element]),
    Support=supp,
    Load=flatten([loads, loads_2]),
    CrossSection=flatten(crosec),
    Material=matselect,
    LimitDistance_m=0.005)  # -> Model, Info, Mass_kg, CenterOfGravity
modelview = ModelViewKaramba(Model=assemble.Model, LoadCaseFactorsForLinearSuperposition=1, IndexIncrementOfVisibleLoadcase=0)  # -> Model, DeformedMesh, DeformedAxes, DeformedModel
analyzethi = AnalyzeThIKaramba(Model=modelview.Model)  # -> CalculatedModel, MaximumDisplacement_m, ResultingForceOfGravity_kN, ElasticEnergy_kNm
besobeam = BESOForBeamsKaramba(
    Model=modelview.Model,
    LCases=0,
    TargetMassRatio=Slider(1, range=0..1),
    NumberOfChangeIterations=10,
    NumberOfConvergenceIterations=20,
    WeightingFactorForTension=1,
    WeightingFactorForCompression=1,
    WeightingFactorForShear=0,
    WeightingFactorForMoments=0,
    BESOFactor=0,
    MinimumDistanceBetweenChangingElements=0,
    RelativeWeightLimit=0)  # -> MaximumDisplacement, OptimizedModel, HistoryOfTheBESO, ElementIsActive, DistributionOfWeights
displacement = Number(analyzethi.MaximumDisplacement_m)
panel_5 = Panel(displacement)
modelview_2 = ModelViewKaramba(Model=analyzethi.CalculatedModel, LoadCaseFactorsForLinearSuperposition=1, IndexIncrementOfVisibleLoadcase=0)  # -> Model, DeformedMesh, DeformedAxes, DeformedModel
modelview_3 = ModelViewKaramba(Model=besobeam.OptimizedModel, LoadCaseFactorsForLinearSuperposition=1, IndexIncrementOfVisibleLoadcase=0)  # -> Model, DeformedMesh, DeformedAxes, DeformedModel
beamview = BeamViewKaramba(Model=modelview_2.Model)  # -> Model, MeshesOfRenderedBeams, DeformedBeamAxes, LegendColors, LegendTags
karamba_beams = Mesh(beamview.MeshesOfRenderedBeams)
legend = Legend(Colour=beamview.LegendColors, Tags=beamview.LegendTags, LegendType=1)
