# Grasshopper definition NB_002 - AB Comments.gh (Grasshopper 0.9.76)
# plug-ins: Karamba

number_slider = Slider(0.041, range=0..1)
number_slider_2 = Slider(1.109, range=0..10)
number_slider_3 = Slider(0.041, range=0..0.1)
number_slider_4 = Slider(2.918, range=0..10)
pt = ConstructPoint(XCoordinate=Slider(0.041, range=0..0.1), YCoordinate=number_slider_3, ZCoordinate=number_slider_2)
pt_2 = ConstructPoint(XCoordinate=number_slider, YCoordinate=number_slider, ZCoordinate=Slider(0.021, range=0..0.1))
pt_3 = ConstructPoint(XCoordinate=Slider(0.959, range=0..1), YCoordinate=Slider(0.041, range=0..0.1), ZCoordinate=Slider(0.021, range=0..0.1))
pt_4 = ConstructPoint(XCoordinate=Slider(0.959, range=0..1), YCoordinate=number_slider_3, ZCoordinate=number_slider_2)
Y = UnitY(Factor=1)
Y_2 = UnitY(Factor=1)
pt_5 = ConstructPoint(XCoordinate=Slider(0.5, range=0..1), YCoordinate=Slider(1.8, range=0..10), ZCoordinate=Slider(0.021, range=0..0.1))
line = LineSDL(Start=pt, Direction=Y, Length=number_slider_4)
line_2 = LineSDL(Start=pt_4, Direction=Y_2, Length=number_slider_4)
ln = Line(StartPoint=pt, EndPoint=pt_4)
ln_2 = Line(StartPoint=pt, EndPoint=pt_2)
ln_3 = Line(StartPoint=pt_4, EndPoint=pt_3)
ln_4 = Line(StartPoint=pt_5, EndPoint=pt_2)
ln_5 = Line(StartPoint=pt_2, EndPoint=pt_3)
ln_6 = Line(StartPoint=pt_5, EndPoint=pt_3)
ln_7 = Line(StartPoint=pt, EndPoint=pt_3)
ln_8 = Line(StartPoint=pt_4, EndPoint=pt_2)

# ---- group: Base Panel
number_slider_5 = Slider(0.021, range=0..0.1)
neg = Negative(Value=number_slider_5)
X = UnitX(Factor=number_slider_5)
Y_3 = UnitY(Factor=number_slider_5)
X_2 = UnitX(Factor=neg)
crv = Curve(ln_4)
crv_2 = Curve(ln_5)
crv_3 = Curve(ln_6)
move = Move(Geometry=crv, Motion=X)  # -> Geometry, Transform
move_2 = Move(Geometry=crv_2, Motion=Y_3)  # -> Geometry, Transform
move_3 = Move(Geometry=crv_3, Motion=X_2)  # -> Geometry, Transform
mcx = MultipleCurves(Curves=[move.Geometry, move_2.Geometry, move_3.Geometry])  # -> Points, IndexA, IndexB, ParamA, ParamB
pline = PolyLine(Vertices=mcx.Points, Closed=True)
Z = UnitZ(Factor=Slider(-0.021, range=-1..1))
move_4 = Move(Geometry=pline, Motion=Z)  # -> Geometry, Transform
boundary = BoundarySurfaces(Edges=move_4.Geometry)
Z_2 = UnitZ(Factor=Slider(0.02, range=0..0.1))
extr = Extrude(Base=boundary, Direction=Z_2)

# ----
number_slider_6 = Slider(4, range=0..40)
number_slider_7 = Slider(0.19, range=0..1)
number_slider_8 = Slider(10, range=0..100)
divide = DivideCurve(Curve=line_2, Count=10, Kinks=False)  # -> Points, Tangents, Parameters
divide_2 = DivideCurve(Curve=line, Count=10, Kinks=False)  # -> Points, Tangents, Parameters
item = ListItem(List=divide_2.Points, Index=number_slider_6, Wrap=True)
item_2 = ListItem(List=divide_2.Points, Index=number_slider_8, Wrap=True)
item_3 = ListItem(List=divide.Points, Index=number_slider_6, Wrap=True)
item_4 = ListItem(List=divide.Points, Index=number_slider_8, Wrap=True)
pt_6 = Point(item)
pt_7 = Point(item_2)
pt_8 = Point(item_3)
pt_9 = Point(item_4)
ccx = CurveCurve(CurveA=ln_7, CurveB=ln_8)  # -> Points, ParamsA, ParamsB

# ---- group: Back Panel
number_slider_9 = Slider(0.021, range=-10..1)
neg_2 = Negative(Value=number_slider_9)
X_3 = UnitX(Factor=number_slider_9)
Z_3 = UnitZ(Factor=neg_2)
Z_4 = UnitZ(Factor=neg_2)
X_4 = UnitX(Factor=neg_2)
Z_5 = UnitZ(Factor=number_slider_9)
move_5 = Move(Geometry=pt_4, Motion=X_3)  # -> Geometry, Transform
move_6 = Move(Geometry=pt_3, Motion=Z_3)  # -> Geometry, Transform
move_7 = Move(Geometry=pt_2, Motion=Z_4)  # -> Geometry, Transform
move_8 = Move(Geometry=pt, Motion=X_4)  # -> Geometry, Transform
move_9 = Move(Geometry=move_5.Geometry, Motion=Z_5)  # -> Geometry, Transform
move_10 = Move(Geometry=move_6.Geometry, Motion=X_3)  # -> Geometry, Transform
move_11 = Move(Geometry=move_7.Geometry, Motion=X_4)  # -> Geometry, Transform
move_12 = Move(Geometry=move_8.Geometry, Motion=Z_5)  # -> Geometry, Transform
merge = Merge(Data1=ccx.Points, Data2=move_11.Geometry, Data3=move_10.Geometry, Data4=move_9.Geometry, Data5=move_12.Geometry)  # -> flatten(Result)
pline_2 = PolyLine(Vertices=merge, Closed=True)
join = JoinCurves(Curves=pline_2, Preserve=False)
Y_4 = UnitY(Factor=Slider(-0.021, range=-1..1))
move_13 = Move(Geometry=join, Motion=Y_4)  # -> Geometry, Transform
boundary_2 = BoundarySurfaces(Edges=move_13.Geometry)
Y_5 = UnitY(Factor=Slider(-0.02, range=-1..1))
extr_2 = Extrude(Base=boundary_2, Direction=Y_5)

# ----
ln_9 = Line(StartPoint=item, EndPoint=item_2)
ln_10 = Line(StartPoint=pt_6, EndPoint=pt_5)
ln_11 = Line(StartPoint=pt_6, EndPoint=pt_8)
ln_12 = Line(StartPoint=[pt_7, pt_9], EndPoint=pt_5)
ln_13 = Line(StartPoint=pt_7, EndPoint=pt_9)
ln_14 = Line(StartPoint=pt_8, EndPoint=pt_5)
ln_15 = Line(StartPoint=item_3, EndPoint=item_4)
ln_16 = Line(StartPoint=pt_4, EndPoint=item_3)

# ---- group: Side Panel
number_slider_10 = Slider(0.021, range=0..0.1)
neg_3 = Negative(Value=Slider(0.041, range=0..0.1))
Z_6 = UnitZ(Factor=number_slider_10)
Y_6 = UnitY(Factor=neg_3)
move_14 = Move(Geometry=ln_16, Motion=Z_6)  # -> Geometry, Transform
move_15 = Move(Geometry=ln_3, Motion=Y_6)  # -> Geometry, Transform
X_5 = UnitX(Factor=number_slider_10)
X_6 = UnitX(Factor=number_slider_10)
move_16 = Move(Geometry=move_14.Geometry, Motion=X_5)  # -> Geometry, Transform
move_17 = Move(Geometry=move_15.Geometry, Motion=X_6)  # -> Geometry, Transform
number_slider_11 = Slider(0.021, range=0..0.1)
ext = ExtendCurve(Curve=move_16.Geometry, Type=0, Start=Slider(0.041, range=0..0.1), End=number_slider_11)
ext_2 = ExtendCurve(Curve=move_17.Geometry, Type=0, Start=number_slider_11, End=number_slider_11)
number_slider_12 = Slider(1, range=0..1)
divide_3 = DivideCurve(Curve=ext, Count=1, Kinks=False)  # -> Points, Tangents, Parameters
divide_4 = DivideCurve(Curve=ext_2, Count=1, Kinks=False)  # -> Points, Tangents, Parameters
item_5 = ListItem(List=divide_3.Points, Index=Slider(0, range=0..10), Wrap=True)
item_6 = ListItem(List=divide_3.Points, Index=number_slider_12, Wrap=True)
item_7 = ListItem(List=divide_4.Points, Index=number_slider_12, Wrap=True)
merge_2 = Merge(Data1=item_5, Data2=item_6, Data3=item_7)  # -> flatten(Result)
pline_3 = PolyLine(Vertices=merge_2, Closed=True)
join_2 = JoinCurves(Curves=pline_3, Preserve=False)
boundary_3 = BoundarySurfaces(Edges=join_2)
X_7 = UnitX(Factor=Slider(0.02, range=0..0.1))
extr_3 = Extrude(Base=boundary_3, Direction=X_7)

# ----
ln_17 = Line(StartPoint=pt, EndPoint=item)
number_slider_13 = Slider(0.1, range=0..1)
number_slider_14 = Slider(7, range=0..10)
divlength = DivideLength(Curve=ln_10, Length=number_slider_13)  # -> Points, Tangents, Parameters
divlength_2 = DivideLength(Curve=ln_14, Length=number_slider_13)  # -> Points, Tangents, Parameters
item_8 = ListItem(List=divlength.Points, Index=number_slider_14, Wrap=True)
item_9 = ListItem(List=divlength_2.Points, Index=number_slider_14, Wrap=True)
ln_18 = Line(StartPoint=item, EndPoint=item_8)
ln_19 = Line(StartPoint=item_8, EndPoint=pt_7)
ln_20 = Line(StartPoint=pt_9, EndPoint=item_9)
ln_21 = Line(StartPoint=item_8, EndPoint=pt_2)
ln_22 = Line(StartPoint=pt_3, EndPoint=item_9)
ln_23 = Line(StartPoint=pt_6, EndPoint=pt_2)
ln_24 = Line(StartPoint=pt_8, EndPoint=pt_3)
ln_25 = Line(StartPoint=item_8, EndPoint=item_9)
ln_26 = Line(StartPoint=item_8, EndPoint=pt_5)
ln_27 = Line(StartPoint=item_3, EndPoint=item_9)
ln_28 = Line(StartPoint=item_9, EndPoint=pt_5)
pt_10 = Point(ccx.Points)
crv_4 = Curve(flatten([ln, ln_2, ln_5, ln_3, ln_4, ln_6, ln_7, ln_8, ln_11, ln_12, ln_13, ln_19, ln_20, ln_21, ln_22, ln_25, ln_23, ln_24, ln_18, ln_27, ln_26, ln_28, ln_17, ln_9, ln_15, ln_16]))
linetobeam = LineToBeamKaramba(Points=pt_10, Line=crv_4, New=True, Remove=True, LimitDistance_m=0.005)  # -> Points, Element, Info
panel = Panel(linetobeam.Points)

# ---- group: Middle Movement Nodes
pdecon = Deconstruct(Point=linetobeam.Points)  # -> XComponent, YComponent, ZComponent
smaller = SmallerThan(FirstNumber=pdecon.ZComponent, SecondNumber=Slider(0.725, range=0..1))  # -> SmallerThan, OrEqualTo
cull = CullPattern(List=linetobeam.Points, CullPattern=smaller.SmallerThan)
pdecon_2 = Deconstruct(Point=cull)  # -> XComponent, YComponent, ZComponent
larger = LargerThan(FirstNumber=pdecon_2.ZComponent, SecondNumber=Slider(0.3, range=0..1))  # -> LargerThan, OrEqualTo
cull_2 = CullPattern(List=cull, CullPattern=larger.LargerThan)
supp = SupportKaramba(PosInd=cull_2, menu=[buttons(off, off, off, off, off, off)])

# ---- group: Front Load
load_in_kn = Slider(0.25, range=0..10)
pdecon_3 = Deconstruct(Point=linetobeam.Points)  # -> XComponent, YComponent, ZComponent
Z_7 = UnitZ(Factor=load_in_kn)
larger_2 = LargerThan(FirstNumber=pdecon_3.ZComponent, SecondNumber=Slider(0.951, range=0..1))  # -> LargerThan, OrEqualTo
neg_4 = Negative(Value=Z_7)
cull_3 = CullPattern(List=linetobeam.Points, CullPattern=larger_2.LargerThan)
pdecon_4 = Deconstruct(Point=cull_3)  # -> XComponent, YComponent, ZComponent
smaller_2 = SmallerThan(FirstNumber=pdecon_4.YComponent, SecondNumber=Slider(0.772, range=0..1))  # -> SmallerThan, OrEqualTo
cull_4 = CullPattern(List=cull_3, CullPattern=smaller_2.SmallerThan)
loads = LoadsKaramba(ForceVector=neg_4, Local=True, PosInd=cull_4, LCase=0, mode="Point")

# ---- group: 42 x 42mm Wooden Members
cross_sections = CrossSectionsKaramba(
    Height_cm=Slider(4.2, range=0..10),
    UpperFlangeWidth_cm=Slider(4.2, range=0..10),
    LowerFlangeWidth_cm=Slider(4.2, range=0..10),
    mode="Trapezoid")
panel_2 = Panel(cross_sections)

# ---- group: Top Rigid Nodes
pdecon_5 = Deconstruct(Point=linetobeam.Points)  # -> XComponent, YComponent, ZComponent
larger_3 = LargerThan(FirstNumber=pdecon_5.ZComponent, SecondNumber=Slider(0.772, range=0..1))  # -> LargerThan, OrEqualTo
cull_5 = CullPattern(List=linetobeam.Points, CullPattern=larger_3.LargerThan)
supp_2 = SupportKaramba(PosInd=cull_5, menu=[buttons(off, off, off, on, on, on)])

# ---- group: Back Load (with extra panel mass)
load_in_kn_2 = Slider(0.2, range=0..10)
pdecon_6 = Deconstruct(Point=linetobeam.Points)  # -> XComponent, YComponent, ZComponent
Z_8 = UnitZ(Factor=load_in_kn_2)
larger_4 = LargerThan(FirstNumber=pdecon_6.ZComponent, SecondNumber=Slider(0.951, range=0..1))  # -> LargerThan, OrEqualTo
neg_5 = Negative(Value=Z_8)
cull_6 = CullPattern(List=linetobeam.Points, CullPattern=larger_4.LargerThan)
pdecon_7 = Deconstruct(Point=cull_6)  # -> XComponent, YComponent, ZComponent
larger_5 = LargerThan(FirstNumber=pdecon_7.YComponent, SecondNumber=Slider(0.511, range=0..1))  # -> LargerThan, OrEqualTo
cull_7 = CullPattern(List=cull_6, CullPattern=larger_5.LargerThan)
loads_2 = LoadsKaramba(ForceVector=neg_5, Local=True, PosInd=cull_7, LCase=0, mode="Point")

# ---- group: Middle Load (with extra panel mass)
load_in_kn_3 = Slider(0.2, range=0..10)
pdecon_8 = Deconstruct(Point=linetobeam.Points)  # -> XComponent, YComponent, ZComponent
Z_9 = UnitZ(Factor=load_in_kn_3)
smaller_3 = SmallerThan(FirstNumber=pdecon_8.ZComponent, SecondNumber=Slider(0.465, range=0..1))  # -> SmallerThan, OrEqualTo
neg_6 = Negative(Value=Z_9)
cull_8 = CullPattern(List=linetobeam.Points, CullPattern=smaller_3.SmallerThan)
loads_3 = LoadsKaramba(ForceVector=neg_6, Local=True, PosInd=cull_8, LCase=0, mode="Point")

# ---- group: Botton Back Two Supports
pdecon_9 = Deconstruct(Point=linetobeam.Points)  # -> XComponent, YComponent, ZComponent
smaller_4 = SmallerThan(FirstNumber=pdecon_9.ZComponent, SecondNumber=Slider(0.3, range=0..1))  # -> SmallerThan, OrEqualTo
cull_9 = CullPattern(List=linetobeam.Points, CullPattern=smaller_4.SmallerThan)
pdecon_10 = Deconstruct(Point=cull_9)  # -> XComponent, YComponent, ZComponent
smaller_5 = SmallerThan(FirstNumber=pdecon_10.YComponent, SecondNumber=Slider(1, range=0..1))  # -> SmallerThan, OrEqualTo
cull_10 = CullPattern(List=cull_9, CullPattern=smaller_5.SmallerThan)
supp_3 = SupportKaramba(PosInd=cull_10, menu=[buttons(off, off, on, on, on, on)])

# ---- group: Bottom Middle Support
pdecon_11 = Deconstruct(Point=linetobeam.Points)  # -> XComponent, YComponent, ZComponent
smaller_6 = SmallerThan(FirstNumber=pdecon_11.ZComponent, SecondNumber=Slider(0.3, range=0..1))  # -> SmallerThan, OrEqualTo
cull_11 = CullPattern(List=linetobeam.Points, CullPattern=smaller_6.SmallerThan)
pdecon_12 = Deconstruct(Point=cull_11)  # -> XComponent, YComponent, ZComponent
larger_6 = LargerThan(FirstNumber=pdecon_12.YComponent, SecondNumber=Slider(1, range=0..1))  # -> LargerThan, OrEqualTo
cull_12 = CullPattern(List=cull_11, CullPattern=larger_6.LargerThan)
supp_4 = SupportKaramba(PosInd=cull_12, menu=[buttons(on, on, on, on, on, on)])

# ----
matselect = MaterialSelectionKaramba(menu=[dropdown(3), dropdown(2)])
loads_4 = LoadsKaramba(Vector=Vector(0, 0, -1), LCase=0, mode="Gravity")
assemble = AssembleModelKaramba(
    Elem=flatten(linetobeam.Element),
    Support=flatten([supp_3, supp_4, supp_2]),
    Load=flatten([loads, loads_2, loads_3, loads_4]),
    CrossSection=cross_sections,
    Material=matselect,
    LimitDistance_m=0.005)  # -> Model, Info, Mass_kg, CenterOfGravity
modelview = ModelViewKaramba(Model=assemble.Model, LoadCaseFactorsForLinearSuperposition=1, IndexIncrementOfVisibleLoadcase=0)  # -> Model, DeformedMesh, DeformedAxes, DeformedModel
analyzethi = AnalyzeThIKaramba(Model=modelview.Model)  # -> CalculatedModel, MaximumDisplacement_m, ResultingForceOfGravity_kN, ElasticEnergy_kNm
modelview_2 = ModelViewKaramba(Model=analyzethi.CalculatedModel, LoadCaseFactorsForLinearSuperposition=1, IndexIncrementOfVisibleLoadcase=0)  # -> Model, DeformedMesh, DeformedAxes, DeformedModel
besobeam = BESOForBeamsKaramba(
    Model=analyzethi.CalculatedModel,
    LCases=0,
    TargetMassRatio=0.5,
    NumberOfChangeIterations=10,
    NumberOfConvergenceIterations=20,
    WeightingFactorForTension=1,
    WeightingFactorForCompression=1,
    WeightingFactorForShear=0,
    WeightingFactorForMoments=0,
    BESOFactor=0,
    MinimumDistanceBetweenChangingElements=0,
    RelativeWeightLimit=0)  # -> MaximumDisplacement, OptimizedModel, HistoryOfTheBESO, ElementIsActive, DistributionOfWeights
modelview_3 = ModelViewKaramba(Model=besobeam.OptimizedModel, LoadCaseFactorsForLinearSuperposition=1, IndexIncrementOfVisibleLoadcase=0)  # -> Model, DeformedMesh, DeformedAxes, DeformedModel
beamview = BeamViewKaramba(Model=modelview_2.Model)  # -> Model, MeshesOfRenderedBeams, DeformedBeamAxes, LegendColors, LegendTags
beamview_2 = BeamViewKaramba(Model=modelview_3.Model)  # -> Model, MeshesOfRenderedBeams, DeformedBeamAxes, LegendColors, LegendTags
legend = Legend(Colour=beamview_2.LegendColors, Tags=beamview_2.LegendTags, LegendType=101)

# ---- group: 1
# 1: These percentages are telling you how much the design is being utilised.
legend_2 = Legend(Colour=beamview.LegendColors, Tags=beamview.LegendTags, LegendType=1)

# ----
len = Length(Curve=crv_4)
avr = Average(Input=len)
num = Number(analyzethi.MaximumDisplacement_m)
expression = Expression(x=avr, y=num, Expression="y/x*100")
this_needs_to_be_less_than_0_1 = Panel(expression)

# ---- group: Table Top
number_slider_15 = Slider(0.041, range=0..0.1)
Y_7 = UnitY(Factor=Slider(0.021, range=0..0.1))
Y_8 = UnitY(Factor=number_slider_15)
X_8 = UnitX(Factor=number_slider_15)
ext_3 = ExtendCurve(Curve=line, Type=0, Start=Y_8, End=number_slider_15)
ext_4 = ExtendCurve(Curve=line_2, Type=0, Start=Y_8, End=number_slider_15)
neg_7 = Negative(Value=Y_8)
neg_8 = Negative(Value=X_8)
move_18 = Move(Geometry=ln, Motion=neg_7)  # -> Geometry, Transform
move_19 = Move(Geometry=ext_3, Motion=neg_8)  # -> Geometry, Transform
move_20 = Move(Geometry=ext_4, Motion=X_8)  # -> Geometry, Transform
move_21 = Move(Geometry=ln_13, Motion=Y_8)  # -> Geometry, Transform
ext_5 = ExtendCurve(Curve=[move_18.Geometry, move_21.Geometry], Type=0, Start=0.041, End=0.041)
join_3 = JoinCurves(Curves=[ext_5, move_19.Geometry, move_20.Geometry], Preserve=False)
Z_10 = UnitZ(Factor=Slider(0.021, range=0..0.1))
move_22 = Move(Geometry=join_3, Motion=Z_10)  # -> Geometry, Transform
Z_11 = UnitZ(Factor=Slider(0.02, range=0..0.1))

# ----
boundary_4 = BoundarySurfaces(Edges=move_22.Geometry)

# ---- group: Table Top (continued)
extr_4 = Extrude(Base=boundary_4, Direction=Z_11)

# ---- group: Displacement Calculations: Result must be below 0.1%
len_2 = Length(Curve=crv_4)
length_of_members = Panel(len_2)
number_of_members = Slider(27, range=0..100)
ma = MassAddition(Input=length_of_members)  # -> Result, PartialResults
panel_3 = Panel(ma.Result)
max_displacemen_value_in_metres = Slider(0.02186, range=0..0.1)
division = Division(A=panel_3, B=number_of_members)
average_member_length = Panel(division)
division_2 = Division(A=max_displacemen_value_in_metres, B=average_member_length)

# ----
multiplication = Multiplication(A=Slider(100, range=0..100), B=division_2)

# ---- group: Displacement Calculations: Result must be below 0.1% (continued)
result_in = Panel(multiplication)
