# Grasshopper definition NB_005 - AB Comments.gh (Grasshopper 0.9.76)
# plug-ins: Karamba

number_slider = Slider(0.041, range=0..1)
number_slider_2 = Slider(1.109, range=0..10)
number_slider_3 = Slider(0.041, range=0..0.1)
number_slider_4 = Slider(0.4, range=0..1)
number_slider_5 = Slider(2.918, range=0..10)
pt = ConstructPoint(XCoordinate=Slider(0.041, range=0..0.1), YCoordinate=number_slider_3, ZCoordinate=number_slider_2)
pt_2 = ConstructPoint(XCoordinate=Slider(0.959, range=0..1), YCoordinate=number_slider_3, ZCoordinate=number_slider_2)
pt_3 = ConstructPoint(XCoordinate=number_slider, YCoordinate=number_slider, ZCoordinate=Slider(0.021, range=0..0.1))
pt_4 = ConstructPoint(XCoordinate=Slider(0.959, range=0..1), YCoordinate=Slider(0.041, range=0..0.1), ZCoordinate=Slider(0.021, range=0..0.1))
Y = UnitY(Factor=1)
Y_2 = UnitY(Factor=1)
pt_5 = ConstructPoint(XCoordinate=Slider(0.38, range=0..1), YCoordinate=Slider(1.5, range=0..10), ZCoordinate=Slider(0.5, range=0..1))
ln = Line(StartPoint=pt_2, EndPoint=pt_4)
ln_2 = Line(StartPoint=pt_5, EndPoint=pt_3)
line = LineSDL(Start=pt, Direction=Y, Length=number_slider_5)
line_2 = LineSDL(Start=pt_2, Direction=Y_2, Length=number_slider_5)
top_frame = Line(StartPoint=pt, EndPoint=pt_2)
ln_3 = Line(StartPoint=pt, EndPoint=pt_3)
ln_4 = Line(StartPoint=pt_3, EndPoint=pt_4)
ln_5 = Line(StartPoint=pt_5, EndPoint=pt_4)
ln_6 = Line(StartPoint=pt, EndPoint=pt_4)
Y_3 = UnitY(Factor=Slider(0.052, range=0..0.1))
number_slider_6 = Slider(0.19, range=0..1)
number_slider_7 = Slider(4, range=0..40)
number_slider_8 = Slider(10, range=0..100)

# ---- group: Back Panel Bolts
crv = Curve(flatten([ln_6, top_frame]))
crv_2 = Curve(ln)
divide = DivideCurve(Curve=crv, Count=Slider(3, range=0..100), Kinks=False)  # -> Points, Tangents, Parameters
divide_2 = DivideCurve(Curve=crv_2, Count=Slider(5, range=0..100), Kinks=False)  # -> Points, Tangents, Parameters
item = ListItem(List=divide.Points, Index=[1, 2], Wrap=True)
item_2 = ListItem(List=divide_2.Points, Index=[1, 4], Wrap=True)
number_slider_9 = Slider(0.016, range=0..0.1)
cir = Circle(Plane=[item, item_2], Radius=Slider(0.012, range=0..0.1))
cir_2 = Circle(Plane=[item, item_2], Radius=Slider(0.004, range=0..0.1))
Z = UnitZ(Factor=1)
Y_4 = UnitY(Factor=1)
Z_2 = UnitZ(Factor=1)
Y_5 = UnitY(Factor=1)
neg = Negative(Value=Slider(0.047, range=0..0.1))
rotate = Rotate(Geometry=cir, Center=[item, item_2], From=Z, To=Y_4)  # -> Geometry, Transform
rotate_2 = Rotate(Geometry=cir_2, Center=[item, item_2], From=Z_2, To=Y_5)  # -> Geometry, Transform
Y_6 = UnitY(Factor=number_slider_9)
Y_7 = UnitY(Factor=number_slider_9)
Y_8 = UnitY(Factor=neg)
move = Move(Geometry=rotate.Geometry, Motion=Y_6)  # -> Geometry, Transform
move_2 = Move(Geometry=rotate_2.Geometry, Motion=Y_7)  # -> Geometry, Transform
boundary = BoundarySurfaces(Edges=move.Geometry)
boundary_2 = BoundarySurfaces(Edges=move_2.Geometry)
extr = Extrude(Base=boundary, Direction=Y_6)
extr_2 = Extrude(Base=boundary_2, Direction=Y_8)
join = BrepJoin(Breps=[extr, extr_2])  # -> flatten(Breps), Closed

# ---- group: Back Panel
number_slider_10 = Slider(0.021, range=-10..1)
neg_2 = Negative(Value=number_slider_10)
X = UnitX(Factor=number_slider_10)
Z_3 = UnitZ(Factor=neg_2)
Z_4 = UnitZ(Factor=neg_2)
X_2 = UnitX(Factor=neg_2)
Z_5 = UnitZ(Factor=number_slider_10)
move_3 = Move(Geometry=pt_2, Motion=X)  # -> Geometry, Transform
move_4 = Move(Geometry=pt_4, Motion=Z_3)  # -> Geometry, Transform
move_5 = Move(Geometry=pt_3, Motion=Z_4)  # -> Geometry, Transform
move_6 = Move(Geometry=pt, Motion=X_2)  # -> Geometry, Transform
neg_3 = Negative(Value=Slider(0.031, range=0..0.1))
neg_4 = Negative(Value=Slider(0.021, range=0..0.1))
move_7 = Move(Geometry=move_4.Geometry, Motion=X)  # -> Geometry, Transform
move_8 = Move(Geometry=move_3.Geometry, Motion=Z_5)  # -> Geometry, Transform
move_9 = Move(Geometry=move_6.Geometry, Motion=Z_5)  # -> Geometry, Transform
X_3 = UnitX(Factor=neg_3)
X_4 = UnitX(Factor=neg_4)
move_10 = Move(Geometry=move_7.Geometry, Motion=X_3)  # -> Geometry, Transform
move_11 = Move(Geometry=move_9.Geometry, Motion=X_4)  # -> Geometry, Transform
merge = Merge(Data2=move_10.Geometry, Data3=move_7.Geometry, Data4=move_8.Geometry, Data5=move_11.Geometry)  # -> flatten(Result)
pline = PolyLine(Vertices=merge, Closed=True)
join_2 = JoinCurves(Curves=pline, Preserve=False)
Y_9 = UnitY(Factor=Slider(-0.021, range=-1..1))
move_12 = Move(Geometry=join_2, Motion=Y_9)  # -> Geometry, Transform
boundary_3 = BoundarySurfaces(Edges=move_12.Geometry)
Y_10 = UnitY(Factor=Slider(-0.02, range=-1..1))
extr_3 = Extrude(Base=boundary_3, Direction=Y_10)
sdiff = SolidDifference(BrepsA=extr_3, BrepsB=join.Breps)

# ----
divide_3 = DivideCurve(Curve=line, Count=10, Kinks=False)  # -> Points, Tangents, Parameters
divide_4 = DivideCurve(Curve=line_2, Count=10, Kinks=False)  # -> Points, Tangents, Parameters
neg_5 = Negative(Value=Slider(0.2, range=0..1))
Y_11 = UnitY(Factor=Slider(0.041, range=0..0.1))
item_3 = ListItem(List=divide_3.Points, Index=number_slider_7, Wrap=True)
item_4 = ListItem(List=divide_3.Points, Index=number_slider_8, Wrap=True)
item_5 = ListItem(List=divide_4.Points, Index=number_slider_7, Wrap=True)
item_6 = ListItem(List=divide_4.Points, Index=number_slider_8, Wrap=True)
item_7 = ListItem(List=divide_4.Points, Index=Slider(5, range=0..10), Wrap=True)
X_5 = UnitX(Factor=1)
X_6 = UnitX(Factor=neg_5)

# ---- group: BOLTS
cir_3 = Circle(Plane=PlaneXY(0, 0, 0), Radius=Slider(0.01, range=0..0.01))
cir_4 = Circle(Plane=PlaneXY(0, 0, 0), Radius=Slider(0.003, range=0..0.01))
Z_6 = UnitZ(Factor=Slider(0.003, range=0..0.01))
Z_7 = UnitZ(Factor=Slider(0.003, range=0..0.01))
boundary_4 = BoundarySurfaces(Edges=cir_3)
move_13 = Move(Geometry=cir_4, Motion=Z_7)  # -> Geometry, Transform
extr_4 = Extrude(Base=boundary_4, Direction=Z_6)
Z_8 = UnitZ(Factor=Slider(0.047, range=0..0.1))
boundary_5 = BoundarySurfaces(Edges=move_13.Geometry)
extr_5 = Extrude(Base=boundary_5, Direction=Z_8)
join_3 = BrepJoin(Breps=[extr_4, extr_5])  # -> Breps, Closed

# ----
move_14 = Move(Geometry=item_6, Motion=X_6)  # -> Geometry, Transform
move_15 = Move(Geometry=item_7, Motion=X_6)  # -> Geometry, Transform
pt_6 = Point(item_3)
pt_7 = Point(item_4)
pt_8 = Point(item_5)
pt_9 = Point(move_14.Geometry)
top_frame_2 = Line(StartPoint=pt, EndPoint=item_3)
top_frame_3 = Line(StartPoint=item_3, EndPoint=item_4)
ln_7 = Line(StartPoint=pt_6, EndPoint=pt_5)
ln_8 = Line(StartPoint=pt_6, EndPoint=pt_8)
ln_9 = Line(StartPoint=[pt_7, pt_9], EndPoint=pt_5)
top_frame_4 = Line(StartPoint=pt_7, EndPoint=pt_9)
ln_10 = Line(StartPoint=pt_8, EndPoint=pt_5)
top_frame_5 = Line(StartPoint=pt_2, EndPoint=item_5)
crv_3 = Curve(top_frame_5)
ext = ExtendCurve(Curve=crv_3, Type=0, Start=0, End=0.052)
top_frame_6 = Line(StartPoint=move_14.Geometry, EndPoint=move_15.Geometry)
crv_4 = Curve(top_frame_6)
ext_2 = ExtendCurve(Curve=crv_4, Type=0, Start=0, End=-0.052)
top_frame_7 = Line(StartPoint=item_5, EndPoint=move_15.Geometry)
crv_5 = Curve(top_frame_7)
move_16 = Move(Geometry=crv_5, Motion=Y_3)  # -> Geometry, Transform

# ---- group: Table Top Bolts
crv_6 = Curve(flatten([top_frame, top_frame_2, top_frame_3, top_frame_4, top_frame_5, top_frame_6, top_frame_7]))
number_slider_11 = Slider(0.016, range=0..0.1)
divide_5 = DivideCurve(Curve=crv_6, Count=Slider(2, range=0..100), Kinks=False)  # -> Points, Tangents, Parameters
item_8 = ListItem(List=divide_5.Points, Index=Slider(1, range=0..1), Wrap=True)
neg_6 = Negative(Value=number_slider_11)
neg_7 = Negative(Value=number_slider_11)
cir_5 = Circle(Plane=item_8, Radius=Slider(0.012, range=0..0.1))
cir_6 = Circle(Plane=item_8, Radius=Slider(0.004, range=0..0.1))
Z_9 = UnitZ(Factor=neg_6)
Z_10 = UnitZ(Factor=neg_7)
Z_11 = UnitZ(Factor=Slider(0.047, range=0..0.1))
move_17 = Move(Geometry=cir_5, Motion=Z_9)  # -> Geometry, Transform
move_18 = Move(Geometry=cir_6, Motion=Z_10)  # -> Geometry, Transform
boundary_6 = BoundarySurfaces(Edges=move_17.Geometry)
boundary_7 = BoundarySurfaces(Edges=move_18.Geometry)
extr_6 = Extrude(Base=boundary_6, Direction=Z_9)
extr_7 = Extrude(Base=boundary_7, Direction=Z_11)
join_4 = BrepJoin(Breps=[extr_6, extr_7])  # -> flatten(Breps), Closed

# ----
join_5 = JoinCurves(Curves=[ext_2, move_16.Geometry, ext], Preserve=False)
ext_3 = ExtendCurve(Curve=join_5, Type=0, Start=Y_11, End=Y_11)
pt_10 = Point(cir_6)
pt_11 = Point(move_18.Geometry)
pt_12 = Point(rotate_2.Geometry)
number_slider_12 = Slider(0.4, range=0..1)
pt_13 = Point(move_2.Geometry)
ln_11 = Line(StartPoint=pt_11, EndPoint=pt_10)
ln_12 = Line(StartPoint=pt_13, EndPoint=pt_12)
pframe = PerpFrame(Curve=ln_11, Parameter=0)
pframe_2 = PerpFrame(Curve=ln_12, Parameter=0)
pt_14 = ConstructPoint(XCoordinate=Slider(0.38, range=0..1), YCoordinate=Slider(2.106, range=0..10), ZCoordinate=Slider(0.017, range=0..0.1))
ln_13 = Line(StartPoint=pt_6, EndPoint=pt_3)
ln_14 = Line(StartPoint=pt_8, EndPoint=pt_4)

# ---- group: Side Panel Bolts
crv_7 = Curve(flatten([ln_14, top_frame_5, ln]))
divide_6 = DivideCurve(Curve=crv_7, Count=Slider(3, range=0..100), Kinks=False)  # -> Points, Tangents, Parameters
item_9 = ListItem(List=divide_6.Points, Index=[1, 2], Wrap=True)
number_slider_13 = Slider(0.016, range=0..0.1)
cir_7 = Circle(Plane=item_9, Radius=Slider(0.012, range=0..0.1))
cir_8 = Circle(Plane=item_9, Radius=Slider(0.004, range=0..0.1))
Z_12 = UnitZ(Factor=1)
X_7 = UnitX(Factor=1)
Z_13 = UnitZ(Factor=1)
X_8 = UnitX(Factor=1)
neg_8 = Negative(Value=number_slider_13)
neg_9 = Negative(Value=number_slider_13)
rotate_3 = Rotate(Geometry=cir_7, Center=item_9, From=Z_12, To=X_7)  # -> Geometry, Transform
rotate_4 = Rotate(Geometry=cir_8, Center=item_9, From=Z_13, To=X_8)  # -> Geometry, Transform
X_9 = UnitX(Factor=neg_8)
X_10 = UnitX(Factor=neg_9)
X_11 = UnitX(Factor=Slider(0.047, range=0..0.1))
move_19 = Move(Geometry=rotate_3.Geometry, Motion=X_9)  # -> Geometry, Transform
move_20 = Move(Geometry=rotate_4.Geometry, Motion=X_10)  # -> Geometry, Transform
boundary_8 = BoundarySurfaces(Edges=move_19.Geometry)
boundary_9 = BoundarySurfaces(Edges=move_20.Geometry)
extr_8 = Extrude(Base=boundary_8, Direction=X_9)
extr_9 = Extrude(Base=boundary_9, Direction=X_11)
join_6 = BrepJoin(Breps=[extr_8, extr_9])  # -> flatten(Breps), Closed

# ----
pt_15 = Point(rotate_4.Geometry)
pt_16 = Point(move_20.Geometry)
ln_15 = Line(StartPoint=pt_16, EndPoint=pt_15)
pframe_3 = PerpFrame(Curve=ln_15, Parameter=0)
pt_17 = Point(move_13.Geometry)
ln_16 = Line(StartPoint=item_3, EndPoint=pt_14)
ln_17 = Line(StartPoint=pt_5, EndPoint=pt_14)
ln_18 = Line(StartPoint=item_4, EndPoint=pt_14)
ln_19 = Line(StartPoint=move_14.Geometry, EndPoint=pt_14)
ln_20 = Line(StartPoint=pt_14, EndPoint=move_15.Geometry)
sunion = SolidUnion(Breps=[extr_4, extr_5])
pl = PlaneNormal(Origin=pt_17, ZAxis=Vector(0, 0, 1))
preview = CustomPreview(Geometry=sdiff, Shader=ColourSwatch(SwatchColor=RGB(70, 164, 199)))
crv_8 = Curve([ln_19, ln_18, ln_20, ln_16, ln_14, ln_13, top_frame_7])
crv_9 = Curve([ln_2, ln_5, ln_9])
preview_2 = CustomPreview(Geometry=join_3.Breps, Shader=ColourSwatch(SwatchColor=RGB(252, 254, 255)))
brep = Brep(flatten(extr_9))
crv_10 = Curve(flatten([top_frame, ln_3, ln, ln_2, ln_6, ln_8, ln_9, top_frame_4, ln_13, ln_14, top_frame_2, top_frame_3, top_frame_5, ln_16, ln_17, ln_10, ln_7, ln_18, ln_19, ln_5, ln_4, top_frame_7, top_frame_6, ln_20]))
orient = Orient(Geometry=sunion, Source=pl, Target=pframe)  # -> Geometry, Transform
orient_2 = Orient(Geometry=sunion, Source=pl, Target=pframe_2)  # -> Geometry, Transform
orient_3 = Orient(Geometry=sunion, Source=pl, Target=pframe_3)  # -> Geometry, Transform
crv_11 = Curve(graft(crv_10))
crv_12 = Curve(flatten(crv_11))
linetobeam = LineToBeamKaramba(Line=crv_10, New=True, Remove=True, LimitDistance_m=0.005)  # -> Points, Element, Info
panel = Panel("FINAL MEMBERS")
item_10 = ListItem(List=crv_12, Index=5, Wrap=True)
item_11 = ListItem(List=crv_12, Index=24, Wrap=True)
item_12 = ListItem(List=crv_12, Index=17, Wrap=True)
item_13 = ListItem(List=crv_12, Index=19, Wrap=True)
item_14 = ListItem(List=crv_12, Index=[9, 10], Wrap=True)
item_15 = ListItem(List=crv_12, Index=[15, 23], Wrap=True)
cull_i = CullIndex(List=crv_12, Indices=[5, 9, 10, 15, 17, 19, 23, 24], Wrap=True)
crv_13 = Curve(graft(item_10))
crv_14 = Curve(graft(item_11))
crv_15 = Curve(graft(item_12))
crv_16 = Curve(graft(item_13))
crv_17 = Curve(graft(item_15))
crv_18 = Curve(graft(cull_i))
crv_19 = Curve(graft(item_14))

# ---- group: Brep Members
pframe_4 = PerpFrame(Curve=crv_13, Parameter=0)
pframe_5 = PerpFrame(Curve=crv_13, Parameter=1)
vec2pt = Vector2Pt(PointA=pframe_5, PointB=pframe_4, Unitize=False)  # -> Vector, Length
neg_10 = Negative(Value=Slider(0.09, range=0..52))
amp = Amplitude(Vector=vec2pt.Vector, Amplitude=neg_10)
amp_2 = Amplitude(Vector=vec2pt.Vector, Amplitude=Slider(0.19, range=0..52))
move_21 = Move(Geometry=pframe_4, Motion=amp)  # -> Geometry, Transform
move_22 = Move(Geometry=pframe_5, Motion=amp_2)  # -> Geometry, Transform
pt_18 = Point(move_21.Geometry)
pt_19 = Point(move_22.Geometry)
ln_21 = Line(StartPoint=pt_19, EndPoint=pt_18)
polygon = Polygon(Plane=move_22.Geometry, Radius=0.02968, Segments=4, FilletRadius=0)  # -> Polygon, Length
rotate_5 = Rotate(Geometry=polygon.Polygon, Angle=Slider(5.5, range=0..100), Plane=move_22.Geometry)  # -> Geometry, Transform
boundary_10 = BoundarySurfaces(Edges=rotate_5.Geometry)
extrcrv = ExtrudeAlong(Base=boundary_10, Curve=ln_21)  # -> flatten(Extrusion)

pframe_6 = PerpFrame(Curve=crv_14, Parameter=0)
pframe_7 = PerpFrame(Curve=crv_14, Parameter=1)
vec2pt_2 = Vector2Pt(PointA=pframe_7, PointB=pframe_6, Unitize=False)  # -> Vector, Length
neg_11 = Negative(Value=Slider(0.15, range=0..52))
amp_3 = Amplitude(Vector=vec2pt_2.Vector, Amplitude=neg_11)
amp_4 = Amplitude(Vector=vec2pt_2.Vector, Amplitude=Slider(0.09, range=0..52))
move_23 = Move(Geometry=pframe_6, Motion=amp_3)  # -> Geometry, Transform
move_24 = Move(Geometry=pframe_7, Motion=amp_4)  # -> Geometry, Transform
pt_20 = Point(move_23.Geometry)
pt_21 = Point(move_24.Geometry)
ln_22 = Line(StartPoint=pt_21, EndPoint=pt_20)
polygon_2 = Polygon(Plane=move_24.Geometry, Radius=0.02968, Segments=4, FilletRadius=0)  # -> Polygon, Length
rotate_6 = Rotate(Geometry=polygon_2.Polygon, Angle=Slider(5.5, range=0..100), Plane=move_24.Geometry)  # -> Geometry, Transform
boundary_11 = BoundarySurfaces(Edges=rotate_6.Geometry)
extrcrv_2 = ExtrudeAlong(Base=boundary_11, Curve=ln_22)  # -> flatten(Extrusion)

pframe_8 = PerpFrame(Curve=crv_15, Parameter=0)
pframe_9 = PerpFrame(Curve=crv_15, Parameter=1)
vec2pt_3 = Vector2Pt(PointA=pframe_9, PointB=pframe_8, Unitize=False)  # -> Vector, Length
neg_12 = Negative(Value=Slider(0.2, range=0..52))
amp_5 = Amplitude(Vector=vec2pt_3.Vector, Amplitude=neg_12)
amp_6 = Amplitude(Vector=vec2pt_3.Vector, Amplitude=Slider(0.15, range=0..52))
move_25 = Move(Geometry=pframe_8, Motion=amp_5)  # -> Geometry, Transform
move_26 = Move(Geometry=pframe_9, Motion=amp_6)  # -> Geometry, Transform
pt_22 = Point(move_25.Geometry)
pt_23 = Point(move_26.Geometry)
ln_23 = Line(StartPoint=pt_23, EndPoint=pt_22)
polygon_3 = Polygon(Plane=move_26.Geometry, Radius=0.02968, Segments=4, FilletRadius=0)  # -> Polygon, Length
rotate_7 = Rotate(Geometry=polygon_3.Polygon, Angle=Slider(5.5, range=0..100), Plane=move_26.Geometry)  # -> Geometry, Transform
boundary_12 = BoundarySurfaces(Edges=rotate_7.Geometry)
extrcrv_3 = ExtrudeAlong(Base=boundary_12, Curve=ln_23)  # -> flatten(Extrusion)

pframe_10 = PerpFrame(Curve=crv_16, Parameter=0)
pframe_11 = PerpFrame(Curve=crv_16, Parameter=1)
vec2pt_4 = Vector2Pt(PointA=pframe_11, PointB=pframe_10, Unitize=False)  # -> Vector, Length
neg_13 = Negative(Value=Slider(0.2, range=0..52))
amp_7 = Amplitude(Vector=vec2pt_4.Vector, Amplitude=neg_13)
amp_8 = Amplitude(Vector=vec2pt_4.Vector, Amplitude=Slider(0.09, range=0..52))
move_27 = Move(Geometry=pframe_10, Motion=amp_7)  # -> Geometry, Transform
move_28 = Move(Geometry=pframe_11, Motion=amp_8)  # -> Geometry, Transform
pt_24 = Point(move_27.Geometry)
pt_25 = Point(move_28.Geometry)
ln_24 = Line(StartPoint=pt_25, EndPoint=pt_24)
polygon_4 = Polygon(Plane=move_28.Geometry, Radius=0.02968, Segments=4, FilletRadius=0)  # -> Polygon, Length
rotate_8 = Rotate(Geometry=polygon_4.Polygon, Angle=Slider(5.5, range=0..100), Plane=move_28.Geometry)  # -> Geometry, Transform
boundary_13 = BoundarySurfaces(Edges=rotate_8.Geometry)
extrcrv_4 = ExtrudeAlong(Base=boundary_13, Curve=ln_24)  # -> flatten(Extrusion)

pframe_12 = PerpFrame(Curve=crv_17, Parameter=0)
pframe_13 = PerpFrame(Curve=crv_17, Parameter=1)
vec2pt_5 = Vector2Pt(PointA=pframe_13, PointB=pframe_12, Unitize=False)  # -> Vector, Length
neg_14 = Negative(Value=Slider(0.115, range=0..52))
amp_9 = Amplitude(Vector=vec2pt_5.Vector, Amplitude=neg_14)
amp_10 = Amplitude(Vector=vec2pt_5.Vector, Amplitude=Slider(0.11, range=0..52))
move_29 = Move(Geometry=pframe_12, Motion=amp_9)  # -> Geometry, Transform
move_30 = Move(Geometry=pframe_13, Motion=amp_10)  # -> Geometry, Transform
pt_26 = Point(move_29.Geometry)
pt_27 = Point(move_30.Geometry)
ln_25 = Line(StartPoint=pt_27, EndPoint=pt_26)
polygon_5 = Polygon(Plane=move_30.Geometry, Radius=0.02968, Segments=4, FilletRadius=0)  # -> Polygon, Length
rotate_9 = Rotate(Geometry=polygon_5.Polygon, Angle=Slider(5.5, range=0..100), Plane=move_30.Geometry)  # -> Geometry, Transform
boundary_14 = BoundarySurfaces(Edges=rotate_9.Geometry)
extrcrv_5 = ExtrudeAlong(Base=boundary_14, Curve=ln_25)  # -> flatten(Extrusion)

number_slider_14 = Slider(0.098, range=0..52)
pframe_14 = PerpFrame(Curve=crv_18, Parameter=0)
pframe_15 = PerpFrame(Curve=crv_18, Parameter=1)
vec2pt_6 = Vector2Pt(PointA=pframe_15, PointB=pframe_14, Unitize=False)  # -> Vector, Length
neg_15 = Negative(Value=number_slider_14)
amp_11 = Amplitude(Vector=vec2pt_6.Vector, Amplitude=neg_15)
amp_12 = Amplitude(Vector=vec2pt_6.Vector, Amplitude=number_slider_14)
move_31 = Move(Geometry=pframe_14, Motion=amp_11)  # -> Geometry, Transform
move_32 = Move(Geometry=pframe_15, Motion=amp_12)  # -> Geometry, Transform
pt_28 = Point(move_31.Geometry)
pt_29 = Point(move_32.Geometry)
ln_26 = Line(StartPoint=pt_29, EndPoint=pt_28)
polygon_6 = Polygon(Plane=move_32.Geometry, Radius=0.02968, Segments=4, FilletRadius=0)  # -> Polygon, Length
rotate_10 = Rotate(Geometry=polygon_6.Polygon, Angle=Slider(5.5, range=0..100), Plane=move_32.Geometry)  # -> Geometry, Transform
boundary_15 = BoundarySurfaces(Edges=rotate_10.Geometry)
extrcrv_6 = ExtrudeAlong(Base=boundary_15, Curve=ln_26)  # -> flatten(Extrusion)

# ---- group: Middle Movement Nodes
pdecon = Deconstruct(Point=linetobeam.Points)  # -> XComponent, YComponent, ZComponent
smaller = SmallerThan(FirstNumber=pdecon.ZComponent, SecondNumber=Slider(0.725, range=0..1))  # -> SmallerThan, OrEqualTo
cull = CullPattern(List=linetobeam.Points, CullPattern=smaller.SmallerThan)
pdecon_2 = Deconstruct(Point=cull)  # -> XComponent, YComponent, ZComponent
larger = LargerThan(FirstNumber=pdecon_2.ZComponent, SecondNumber=Slider(0.3, range=0..1))  # -> LargerThan, OrEqualTo
cull_2 = CullPattern(List=cull, CullPattern=larger.LargerThan)
supp = SupportKaramba(PosInd=cull_2, menu=[buttons(off, off, off, off, off, off)])

# ---- group: Front Load
load_in_kn = Slider(0.6, range=0..10)
pdecon_3 = Deconstruct(Point=linetobeam.Points)  # -> XComponent, YComponent, ZComponent
Z_14 = UnitZ(Factor=load_in_kn)
larger_2 = LargerThan(FirstNumber=pdecon_3.ZComponent, SecondNumber=Slider(0.951, range=0..1))  # -> LargerThan, OrEqualTo
cull_3 = CullPattern(List=linetobeam.Points, CullPattern=larger_2.LargerThan)
neg_16 = Negative(Value=Z_14)
pdecon_4 = Deconstruct(Point=cull_3)  # -> XComponent, YComponent, ZComponent
smaller_2 = SmallerThan(FirstNumber=pdecon_4.YComponent, SecondNumber=Slider(0.772, range=0..1))  # -> SmallerThan, OrEqualTo
cull_4 = CullPattern(List=cull_3, CullPattern=smaller_2.SmallerThan)
loads = LoadsKaramba(ForceVector=neg_16, Local=True, PosInd=cull_4, LCase=0, mode="Point")

# ---- group: Back Load (with extra panel mass)
load_in_kn_2 = Slider(0.4, range=0..10)
pdecon_5 = Deconstruct(Point=linetobeam.Points)  # -> XComponent, YComponent, ZComponent
Z_15 = UnitZ(Factor=load_in_kn_2)
larger_3 = LargerThan(FirstNumber=pdecon_5.ZComponent, SecondNumber=Slider(0.951, range=0..1))  # -> LargerThan, OrEqualTo
cull_5 = CullPattern(List=linetobeam.Points, CullPattern=larger_3.LargerThan)
neg_17 = Negative(Value=Z_15)
pdecon_6 = Deconstruct(Point=cull_5)  # -> XComponent, YComponent, ZComponent
larger_4 = LargerThan(FirstNumber=pdecon_6.YComponent, SecondNumber=Slider(0.511, range=0..1))  # -> LargerThan, OrEqualTo
cull_6 = CullPattern(List=cull_5, CullPattern=larger_4.LargerThan)
loads_2 = LoadsKaramba(ForceVector=neg_17, Local=True, PosInd=cull_6, LCase=0, mode="Point")

# ---- group: 42 x 42mm Wooden Members
cross_sections = CrossSectionsKaramba(
    Height_cm=Slider(4.2, range=0..10),
    UpperFlangeWidth_cm=Slider(4.2, range=0..10),
    LowerFlangeWidth_cm=Slider(4.2, range=0..10),
    mode="Trapezoid")
panel_2 = Panel(cross_sections)

# ---- group: Top Rigid Nodes
pdecon_7 = Deconstruct(Point=linetobeam.Points)  # -> XComponent, YComponent, ZComponent
larger_5 = LargerThan(FirstNumber=pdecon_7.ZComponent, SecondNumber=Slider(0.772, range=0..1))  # -> LargerThan, OrEqualTo
cull_7 = CullPattern(List=linetobeam.Points, CullPattern=larger_5.LargerThan)
supp_2 = SupportKaramba(PosInd=cull_7, menu=[buttons(on, on, on, off, off, off)])

# ---- group: Middle Load (with extra panel mass)
load_in_kn_3 = Slider(0.2, range=0..10)
pdecon_8 = Deconstruct(Point=linetobeam.Points)  # -> XComponent, YComponent, ZComponent
Z_16 = UnitZ(Factor=load_in_kn_3)
smaller_3 = SmallerThan(FirstNumber=pdecon_8.ZComponent, SecondNumber=Slider(0.465, range=0..1))  # -> SmallerThan, OrEqualTo
cull_8 = CullPattern(List=linetobeam.Points, CullPattern=smaller_3.SmallerThan)
neg_18 = Negative(Value=Z_16)
loads_3 = LoadsKaramba(ForceVector=neg_18, Local=True, PosInd=cull_8, LCase=0, mode="Point")

# ---- group: Botton Back Two Supports
pdecon_9 = Deconstruct(Point=linetobeam.Points)  # -> XComponent, YComponent, ZComponent
smaller_4 = SmallerThan(FirstNumber=pdecon_9.ZComponent, SecondNumber=Slider(0.3, range=0..1))  # -> SmallerThan, OrEqualTo
cull_9 = CullPattern(List=linetobeam.Points, CullPattern=smaller_4.SmallerThan)
pdecon_10 = Deconstruct(Point=cull_9)  # -> XComponent, YComponent, ZComponent
smaller_5 = SmallerThan(FirstNumber=pdecon_10.YComponent, SecondNumber=Slider(1, range=0..1))  # -> SmallerThan, OrEqualTo
cull_10 = CullPattern(List=cull_9, CullPattern=smaller_5.SmallerThan)
supp_3 = SupportKaramba(PosInd=cull_10, menu=[buttons(off, off, off, on, on, on)])

# ---- group: Custom Node
neg_19 = Negative(Value=Slider(0.085, range=0..52))
polygon_7 = Polygon(Plane=pframe_5, Radius=0.02968, Segments=4, FilletRadius=0)  # -> Polygon, Length
polygon_8 = Polygon(Plane=pframe_4, Radius=0.02968, Segments=4, FilletRadius=0)  # -> Polygon, Length
vec2pt_7 = Vector2Pt(PointA=pframe_5, PointB=pframe_4, Unitize=False)  # -> Vector, Length
amp_13 = Amplitude(Vector=vec2pt.Vector, Amplitude=Slider(0.185, range=0..52))
amp_14 = Amplitude(Vector=vec2pt.Vector, Amplitude=neg_19)
neg_20 = Negative(Value=Slider(0.021, range=0..0.1))
move_33 = Move(Geometry=pframe_5, Motion=amp_13)  # -> Geometry, Transform
move_34 = Move(Geometry=pframe_4, Motion=amp_14)  # -> Geometry, Transform
amp_15 = Amplitude(Vector=vec2pt_7.Vector, Amplitude=neg_20)
boundary_16 = BoundarySurfaces(Edges=polygon_7.Polygon)
boundary_17 = BoundarySurfaces(Edges=polygon_8.Polygon)
pt_30 = Point(pframe_4)
pt_31 = Point(pframe_5)
ln_27 = Line(StartPoint=pt_31, EndPoint=move_33.Geometry)
ln_28 = Line(StartPoint=pt_30, EndPoint=move_34.Geometry)
number_slider_15 = Slider(5.5, range=0..100)
extrcrv_7 = ExtrudeAlong(Base=boundary_16, Curve=ln_27)
extrcrv_8 = ExtrudeAlong(Base=boundary_17, Curve=ln_28)
rotate_11 = Rotate(Geometry=extrcrv_7, Angle=number_slider_15, Plane=move_21.Geometry)  # -> Geometry, Transform
rotate_12 = Rotate(Geometry=extrcrv_8, Angle=number_slider_15, Plane=move_22.Geometry)  # -> Geometry, Transform
join_7 = BrepJoin(Breps=[rotate_11.Geometry, rotate_12.Geometry])  # -> graft(Breps), Closed

# ---- group: Bottom Middle Support
pdecon_11 = Deconstruct(Point=linetobeam.Points)  # -> XComponent, YComponent, ZComponent
smaller_6 = SmallerThan(FirstNumber=pdecon_11.ZComponent, SecondNumber=Slider(0.3, range=0..1))  # -> SmallerThan, OrEqualTo
cull_11 = CullPattern(List=linetobeam.Points, CullPattern=smaller_6.SmallerThan)
pdecon_12 = Deconstruct(Point=cull_11)  # -> XComponent, YComponent, ZComponent
larger_6 = LargerThan(FirstNumber=pdecon_12.YComponent, SecondNumber=Slider(1, range=0..1))  # -> LargerThan, OrEqualTo
cull_12 = CullPattern(List=cull_11, CullPattern=larger_6.LargerThan)
supp_4 = SupportKaramba(PosInd=cull_12, menu=[buttons(off, off, off, on, on, on)])

# ---- group: Brep Members
pframe_16 = PerpFrame(Curve=crv_19, Parameter=0)
pframe_17 = PerpFrame(Curve=crv_19, Parameter=1)
vec2pt_8 = Vector2Pt(PointA=pframe_17, PointB=pframe_16, Unitize=False)  # -> Vector, Length
neg_21 = Negative(Value=Slider(0.11, range=0..52))
amp_16 = Amplitude(Vector=vec2pt_8.Vector, Amplitude=neg_21)
amp_17 = Amplitude(Vector=vec2pt_8.Vector, Amplitude=Slider(0.094, range=0..52))
move_35 = Move(Geometry=pframe_16, Motion=amp_16)  # -> Geometry, Transform
move_36 = Move(Geometry=pframe_17, Motion=amp_17)  # -> Geometry, Transform
pt_32 = Point(move_35.Geometry)
pt_33 = Point(move_36.Geometry)
ln_29 = Line(StartPoint=pt_33, EndPoint=pt_32)
polygon_9 = Polygon(Plane=move_36.Geometry, Radius=0.02968, Segments=4, FilletRadius=0)  # -> Polygon, Length
rotate_13 = Rotate(Geometry=polygon_9.Polygon, Angle=Slider(5.5, range=0..100), Plane=move_36.Geometry)  # -> Geometry, Transform
boundary_18 = BoundarySurfaces(Edges=rotate_13.Geometry)
extrcrv_9 = ExtrudeAlong(Base=boundary_18, Curve=ln_29)  # -> flatten(Extrusion)

# ----
brep_2 = Brep([extrcrv, extrcrv_2, extrcrv_3, extrcrv_4, extrcrv_5, extrcrv_9, extrcrv_6])
sdiff_2 = SolidDifference(BrepsA=brep_2, BrepsB=[join_4.Breps, join_6.Breps, join.Breps])
brep_3 = Brep(sdiff_2)
panel_3 = Panel(sdiff_2)

# ---- group: Custom Node
neg_22 = Negative(Value=Slider(0.145, range=0..52))
polygon_10 = Polygon(Plane=pframe_7, Radius=0.02968, Segments=4, FilletRadius=0)  # -> Polygon, Length
polygon_11 = Polygon(Plane=pframe_6, Radius=0.02968, Segments=4, FilletRadius=0)  # -> Polygon, Length
vec2pt_9 = Vector2Pt(PointA=pframe_7, PointB=pframe_6, Unitize=False)  # -> Vector, Length
amp_18 = Amplitude(Vector=vec2pt_2.Vector, Amplitude=Slider(0.085, range=0..52))
amp_19 = Amplitude(Vector=vec2pt_2.Vector, Amplitude=neg_22)
neg_23 = Negative(Value=Slider(0.021, range=0..0.1))
move_37 = Move(Geometry=pframe_7, Motion=amp_18)  # -> Geometry, Transform
move_38 = Move(Geometry=pframe_6, Motion=amp_19)  # -> Geometry, Transform
amp_20 = Amplitude(Vector=vec2pt_9.Vector, Amplitude=neg_23)
boundary_19 = BoundarySurfaces(Edges=polygon_10.Polygon)
boundary_20 = BoundarySurfaces(Edges=polygon_11.Polygon)
pt_34 = Point(pframe_6)
pt_35 = Point(pframe_7)
ln_30 = Line(StartPoint=pt_35, EndPoint=move_37.Geometry)
ln_31 = Line(StartPoint=pt_34, EndPoint=move_38.Geometry)
number_slider_16 = Slider(5.5, range=0..100)
extrcrv_10 = ExtrudeAlong(Base=boundary_19, Curve=ln_30)
extrcrv_11 = ExtrudeAlong(Base=boundary_20, Curve=ln_31)
rotate_14 = Rotate(Geometry=extrcrv_10, Angle=number_slider_16, Plane=move_23.Geometry)  # -> Geometry, Transform
rotate_15 = Rotate(Geometry=extrcrv_11, Angle=number_slider_16, Plane=move_24.Geometry)  # -> Geometry, Transform
join_8 = BrepJoin(Breps=[rotate_14.Geometry, rotate_15.Geometry])  # -> graft(Breps), Closed

neg_24 = Negative(Value=Slider(0.195, range=0..52))
polygon_12 = Polygon(Plane=pframe_9, Radius=0.02968, Segments=4, FilletRadius=0)  # -> Polygon, Length
polygon_13 = Polygon(Plane=pframe_8, Radius=0.02968, Segments=4, FilletRadius=0)  # -> Polygon, Length
vec2pt_10 = Vector2Pt(PointA=pframe_9, PointB=pframe_8, Unitize=False)  # -> Vector, Length
amp_21 = Amplitude(Vector=vec2pt_3.Vector, Amplitude=Slider(0.145, range=0..52))
amp_22 = Amplitude(Vector=vec2pt_3.Vector, Amplitude=neg_24)
neg_25 = Negative(Value=Slider(0.021, range=0..0.1))
move_39 = Move(Geometry=pframe_9, Motion=amp_21)  # -> Geometry, Transform
move_40 = Move(Geometry=pframe_8, Motion=amp_22)  # -> Geometry, Transform
amp_23 = Amplitude(Vector=vec2pt_10.Vector, Amplitude=neg_25)
boundary_21 = BoundarySurfaces(Edges=polygon_12.Polygon)
boundary_22 = BoundarySurfaces(Edges=polygon_13.Polygon)
pt_36 = Point(pframe_8)
pt_37 = Point(pframe_9)
ln_32 = Line(StartPoint=pt_37, EndPoint=move_39.Geometry)
ln_33 = Line(StartPoint=pt_36, EndPoint=move_40.Geometry)
number_slider_17 = Slider(5.5, range=0..100)
extrcrv_12 = ExtrudeAlong(Base=boundary_21, Curve=ln_32)
extrcrv_13 = ExtrudeAlong(Base=boundary_22, Curve=ln_33)
rotate_16 = Rotate(Geometry=extrcrv_12, Angle=number_slider_17, Plane=move_25.Geometry)  # -> Geometry, Transform
rotate_17 = Rotate(Geometry=extrcrv_13, Angle=number_slider_17, Plane=move_26.Geometry)  # -> Geometry, Transform
join_9 = BrepJoin(Breps=[rotate_16.Geometry, rotate_17.Geometry])  # -> graft(Breps), Closed

pframe_18 = PerpFrame(Curve=crv_16, Parameter=0.025)
neg_26 = Negative(Value=Slider(0.195, range=0..52))
polygon_14 = Polygon(Plane=pframe_11, Radius=0.02968, Segments=4, FilletRadius=0)  # -> Polygon, Length
polygon_15 = Polygon(Plane=pframe_18, Radius=0.02968, Segments=4, FilletRadius=0)  # -> Polygon, Length
vec2pt_11 = Vector2Pt(PointA=pframe_11, PointB=pframe_10, Unitize=False)  # -> Vector, Length
amp_24 = Amplitude(Vector=vec2pt_4.Vector, Amplitude=Slider(0.085, range=0..52))
amp_25 = Amplitude(Vector=vec2pt_4.Vector, Amplitude=neg_26)
neg_27 = Negative(Value=Slider(0.021, range=0..0.1))
move_41 = Move(Geometry=pframe_11, Motion=amp_24)  # -> Geometry, Transform
move_42 = Move(Geometry=pframe_10, Motion=amp_25)  # -> Geometry, Transform
amp_26 = Amplitude(Vector=vec2pt_11.Vector, Amplitude=neg_27)
boundary_23 = BoundarySurfaces(Edges=polygon_14.Polygon)
boundary_24 = BoundarySurfaces(Edges=polygon_15.Polygon)
pt_38 = Point(pframe_11)
pt_39 = Point(pframe_10)
ln_34 = Line(StartPoint=pt_38, EndPoint=move_41.Geometry)
ln_35 = Line(StartPoint=pt_39, EndPoint=move_42.Geometry)
number_slider_18 = Slider(5.5, range=0..100)
extrcrv_14 = ExtrudeAlong(Base=boundary_23, Curve=ln_34)
extrcrv_15 = ExtrudeAlong(Base=boundary_24, Curve=ln_35)
rotate_18 = Rotate(Geometry=extrcrv_14, Angle=number_slider_18, Plane=move_27.Geometry)  # -> Geometry, Transform
rotate_19 = Rotate(Geometry=extrcrv_15, Angle=number_slider_18, Plane=move_28.Geometry)  # -> Geometry, Transform
join_10 = BrepJoin(Breps=[rotate_18.Geometry, rotate_19.Geometry])  # -> graft(Breps), Closed

neg_28 = Negative(Value=Slider(0.105, range=0..52))
polygon_16 = Polygon(Plane=pframe_17, Radius=0.02968, Segments=4, FilletRadius=0)  # -> Polygon, Length
polygon_17 = Polygon(Plane=pframe_16, Radius=0.02968, Segments=4, FilletRadius=0)  # -> Polygon, Length
vec2pt_12 = Vector2Pt(PointA=pframe_17, PointB=pframe_16, Unitize=False)  # -> Vector, Length
amp_27 = Amplitude(Vector=vec2pt_8.Vector, Amplitude=Slider(0.089, range=0..52))
amp_28 = Amplitude(Vector=vec2pt_8.Vector, Amplitude=neg_28)
neg_29 = Negative(Value=Slider(0.021, range=0..0.1))
move_43 = Move(Geometry=pframe_17, Motion=amp_27)  # -> Geometry, Transform
move_44 = Move(Geometry=pframe_16, Motion=amp_28)  # -> Geometry, Transform
amp_29 = Amplitude(Vector=vec2pt_12.Vector, Amplitude=neg_29)
boundary_25 = BoundarySurfaces(Edges=polygon_16.Polygon)
boundary_26 = BoundarySurfaces(Edges=polygon_17.Polygon)
pt_40 = Point(pframe_16)
pt_41 = Point(pframe_17)
ln_36 = Line(StartPoint=pt_41, EndPoint=move_43.Geometry)
ln_37 = Line(StartPoint=pt_40, EndPoint=move_44.Geometry)
number_slider_19 = Slider(5.5, range=0..100)
extrcrv_16 = ExtrudeAlong(Base=boundary_25, Curve=ln_36)
extrcrv_17 = ExtrudeAlong(Base=boundary_26, Curve=ln_37)
rotate_20 = Rotate(Geometry=extrcrv_16, Angle=number_slider_19, Plane=move_35.Geometry)  # -> Geometry, Transform
rotate_21 = Rotate(Geometry=extrcrv_17, Angle=number_slider_19, Plane=move_36.Geometry)  # -> Geometry, Transform
join_11 = BrepJoin(Breps=[rotate_20.Geometry, rotate_21.Geometry])  # -> graft(Breps), Closed

neg_30 = Negative(Value=Slider(0.11, range=0..52))
polygon_18 = Polygon(Plane=pframe_13, Radius=0.02968, Segments=4, FilletRadius=0)  # -> Polygon, Length
polygon_19 = Polygon(Plane=pframe_12, Radius=0.02968, Segments=4, FilletRadius=0)  # -> Polygon, Length
vec2pt_13 = Vector2Pt(PointA=pframe_13, PointB=pframe_12, Unitize=False)  # -> Vector, Length
amp_30 = Amplitude(Vector=vec2pt_5.Vector, Amplitude=Slider(0.105, range=0..52))
amp_31 = Amplitude(Vector=vec2pt_5.Vector, Amplitude=neg_30)
neg_31 = Negative(Value=Slider(0.021, range=0..0.1))
move_45 = Move(Geometry=pframe_13, Motion=amp_30)  # -> Geometry, Transform
move_46 = Move(Geometry=pframe_12, Motion=amp_31)  # -> Geometry, Transform
amp_32 = Amplitude(Vector=vec2pt_13.Vector, Amplitude=neg_31)
boundary_27 = BoundarySurfaces(Edges=polygon_18.Polygon)
boundary_28 = BoundarySurfaces(Edges=polygon_19.Polygon)
pt_42 = Point(pframe_12)
pt_43 = Point(pframe_13)
ln_38 = Line(StartPoint=pt_43, EndPoint=move_45.Geometry)
ln_39 = Line(StartPoint=pt_42, EndPoint=move_46.Geometry)
number_slider_20 = Slider(5.5, range=0..100)
extrcrv_18 = ExtrudeAlong(Base=boundary_27, Curve=ln_38)
extrcrv_19 = ExtrudeAlong(Base=boundary_28, Curve=ln_39)
rotate_22 = Rotate(Geometry=extrcrv_18, Angle=number_slider_20, Plane=move_29.Geometry)  # -> Geometry, Transform
rotate_23 = Rotate(Geometry=extrcrv_19, Angle=number_slider_20, Plane=move_30.Geometry)  # -> Geometry, Transform
join_12 = BrepJoin(Breps=[rotate_22.Geometry, rotate_23.Geometry])  # -> graft(Breps), Closed

number_slider_21 = Slider(0.093, range=0..52)
neg_32 = Negative(Value=number_slider_21)
polygon_20 = Polygon(Plane=pframe_15, Radius=0.02968, Segments=4, FilletRadius=0)  # -> Polygon, Length
polygon_21 = Polygon(Plane=pframe_14, Radius=0.02968, Segments=4, FilletRadius=0)  # -> Polygon, Length
vec2pt_14 = Vector2Pt(PointA=pframe_15, PointB=pframe_14, Unitize=False)  # -> Vector, Length
amp_33 = Amplitude(Vector=vec2pt_6.Vector, Amplitude=number_slider_21)
amp_34 = Amplitude(Vector=vec2pt_6.Vector, Amplitude=neg_32)
neg_33 = Negative(Value=Slider(0.021, range=0..0.1))
move_47 = Move(Geometry=pframe_15, Motion=amp_33)  # -> Geometry, Transform
move_48 = Move(Geometry=pframe_14, Motion=amp_34)  # -> Geometry, Transform
amp_35 = Amplitude(Vector=vec2pt_14.Vector, Amplitude=neg_33)
boundary_29 = BoundarySurfaces(Edges=polygon_20.Polygon)
boundary_30 = BoundarySurfaces(Edges=polygon_21.Polygon)
pt_44 = Point(pframe_14)
pt_45 = Point(pframe_15)
ln_40 = Line(StartPoint=pt_45, EndPoint=move_47.Geometry)
ln_41 = Line(StartPoint=pt_44, EndPoint=move_48.Geometry)
number_slider_22 = Slider(5.5, range=0..100)
extrcrv_20 = ExtrudeAlong(Base=boundary_29, Curve=ln_40)
extrcrv_21 = ExtrudeAlong(Base=boundary_30, Curve=ln_41)
rotate_24 = Rotate(Geometry=extrcrv_20, Angle=number_slider_22, Plane=move_31.Geometry)  # -> Geometry, Transform
rotate_25 = Rotate(Geometry=extrcrv_21, Angle=number_slider_22, Plane=move_32.Geometry)  # -> Geometry, Transform
join_13 = BrepJoin(Breps=[rotate_24.Geometry, rotate_25.Geometry])  # -> graft(Breps), Closed

# ----
matselect = MaterialSelectionKaramba(menu=[dropdown(3), dropdown(2)])
loads_4 = LoadsKaramba(Vector=Vector(0, 0, -1), LCase=0, mode="Gravity")
assemble = AssembleModelKaramba(
    Elem=flatten(linetobeam.Element),
    Support=flatten([supp_3, supp_4, supp_2]),
    Load=flatten([loads, loads_2, loads_4]),
    CrossSection=cross_sections,
    Material=matselect,
    LimitDistance_m=0.005)  # -> Model, Info, Mass_kg, CenterOfGravity
modelview = ModelViewKaramba(Model=assemble.Model, LoadCaseFactorsForLinearSuperposition=1, IndexIncrementOfVisibleLoadcase=0)  # -> Model, DeformedMesh, DeformedAxes, DeformedModel
analyzethi = AnalyzeThIKaramba(Model=modelview.Model)  # -> CalculatedModel, MaximumDisplacement_m, ResultingForceOfGravity_kN, ElasticEnergy_kNm
besobeam = BESOForBeamsKaramba(
    Model=analyzethi.CalculatedModel,
    LCases=0,
    TargetMassRatio=0.5,
    NumberOfChangeIterations=10,
    NumberOfConvergenceIterations=20,
    WeightingFactorForTension=1,
    WeightingFactorForCompression=1,
    WeightingFactorForShear=0,
    WeightingFactorForMoments=0,
    BESOFactor=0,
    MinimumDistanceBetweenChangingElements=0,
    RelativeWeightLimit=0)  # -> MaximumDisplacement, OptimizedModel, HistoryOfTheBESO, ElementIsActive, DistributionOfWeights
modelview_2 = ModelViewKaramba(Model=analyzethi.CalculatedModel, LoadCaseFactorsForLinearSuperposition=1, IndexIncrementOfVisibleLoadcase=0)  # -> Model, DeformedMesh, DeformedAxes, DeformedModel
pln = Plane(flatten([move_33.Geometry, move_34.Geometry, move_37.Geometry, move_38.Geometry, move_39.Geometry, move_40.Geometry, move_41.Geometry, move_42.Geometry, move_45.Geometry, move_46.Geometry, move_43.Geometry, move_44.Geometry, move_47.Geometry, move_48.Geometry]))
modelview_3 = ModelViewKaramba(Model=besobeam.OptimizedModel, LoadCaseFactorsForLinearSuperposition=1, IndexIncrementOfVisibleLoadcase=0)  # -> Model, DeformedMesh, DeformedAxes, DeformedModel
beamview = BeamViewKaramba(Model=modelview_2.Model)  # -> Model, MeshesOfRenderedBeams, DeformedBeamAxes, LegendColors, LegendTags
item_16 = ListItem(List=pln, Index=[20, 32, 22, 30, 23, 1, 21, 31, 33, 0], Wrap=True)
rectangle = Rectangle(Plane=pln, XSize=Domain(-0.021, 0.021), YSize=Domain(-0.006, 0.006), Radius=0)  # -> Rectangle, Length
beamview_2 = BeamViewKaramba(Model=modelview_3.Model)  # -> Model, MeshesOfRenderedBeams, DeformedBeamAxes, LegendColors, LegendTags
panel_4 = Panel("FINAL NODES")
cull_i_2 = CullIndex(List=rectangle.Rectangle, Indices=[20, 32, 22, 30, 23, 1, 21, 31, 33, 0], Wrap=True)  # -> flatten(List)
item_17 = ListItem(List=rectangle.Rectangle, Index=[20, 32, 22, 30, 23, 1, 21, 31, 33, 0], Wrap=True)
geo = Geometry(beamview.MeshesOfRenderedBeams)
knob = ControlKnob(Decimals=3, Limit=True, Maximum=10, Minimum=0, Range=1, Value=1.575)
crv_20 = Curve(flatten(item_17))
legend = Legend(Colour=beamview_2.LegendColors, Tags=beamview_2.LegendTags, LegendType=101)

# ---- group: 1
legend_2 = Legend(Colour=beamview.LegendColors, Tags=beamview.LegendTags, LegendType=1)

# ----
number_slider_23 = Slider(5, range=0..100)
rotate_26 = Rotate(Geometry=crv_20, Angle=knob, Plane=item_16)  # -> flatten(Geometry), Transform
boundary_31 = BoundarySurfaces(Edges=[rotate_26.Geometry, cull_i_2])
number_slider_24 = Slider(0.04, range=0..0.1)
item_18 = ListItem(
    List=boundary_31,
    Index=[34, 20, 22, 35, 10, 3, 44, 46, 33, 16, 18, 38, 48, 14, 27, 31, 2, 0, 1, 28, 21, 9, 12, 40, 42],
    Wrap=True)
cull_i_3 = CullIndex(
    List=boundary_31,
    Indices=[34, 20, 22, 35, 10, 44, 46, 33, 16, 18, 38, 48, 14, 27, 31, 2, 0, 1, 3, 28, 21, 9, 12, 40, 42],
    Wrap=True)
len = Length(Curve=crv_10)
srf = Surface(graft(cull_i_3))
srf_2 = Surface(item_18)
avr = Average(Input=len)
flip = Flip(Surface=srf_2)  # -> Surface, Result
neg_34 = Negative(Value=number_slider_24)
num = Number(analyzethi.MaximumDisplacement_m)
srf_3 = Surface(graft(item_18))
expression = Expression(x=avr, y=num, Expression="y/x*100")
offset = Offset(Surface=flip.Surface, Distance=neg_34, Retrim=True)  # -> graft(Surface)
loft_opt = LoftOptions(Closed=False, Adjust=True, Rebuild=0, Refit=1, Type=4)
offset_2 = OffsetLoose(Surface=[cull_i_3, flip.Surface], Distance=0, Retrim=True)  # -> graft(Surface)
offset_3 = Offset(Surface=cull_i_3, Distance=number_slider_24, Retrim=True)  # -> graft(Surface)
this_needs_to_be_less_than_0_1 = Panel(expression)
# ***Some of these lofts are twisted. Not sure how to untwist them***
loft = Loft(Curves=[srf, srf_3, offset_3, offset], Options=loft_opt)
number_slider_25 = Slider(0.021, range=0..0.1)
cap = CapHoles(Brep=loft)
box = EvaluateBox(Box=cap, UParameter=0.5, VParameter=0.5, WParameter=0.5)  # -> Plane, Point, Include
evalsrf = EvaluateSurface(Surface=offset_2, Point=box.Point)  # -> Point, Normal, Frame
brep_4 = Brep(flatten(cap))
sdiff_3 = SolidDifference(BrepsA=brep_3, BrepsB=brep_4)
preview_3 = CustomPreview(Geometry=sdiff_3, Shader=ColourSwatch(SwatchColor=RGB(130, 99, 99)))

pt_46 = Point(linetobeam.Points)
brep_5 = Brep([join_7.Breps, join_8.Breps, join_9.Breps, join_10.Breps, join_12.Breps, join_11.Breps, join_13.Breps, brep_4])
item_19 = ListItem(List=pt_46, Index=7, Wrap=True)
preview_4 = CustomPreview(Geometry=brep_5, Shader=ColourSwatch(SwatchColor=RGB(254, 255, 252)))
item_20 = ListItem(List=pt_46, Index=5, Wrap=True)
Y_12 = UnitY(Factor=Slider(0, range=0..0.01))
pt_47 = Point(item_19)
Z_17 = UnitZ(Factor=Slider(0.004, range=0..0.01))
pt_48 = Point(item_20)
number_slider_26 = Slider(0.021, range=0..0.1)
move_49 = Move(Geometry=pt_48, Motion=Z_17)  # -> Geometry, Transform
cull_i_4 = CullIndex(List=pt_46, Indices=[7, 6, 10, 4, 5], Wrap=True)
move_50 = Move(Geometry=pt_47, Motion=Y_12)  # -> Geometry, Transform
knob_2 = ControlKnob(Decimals=3, Limit=True, Maximum=10, Minimum=0, Range=1, Value=3.441)
# ***My Attempt at trying to fill in the nodes where they come together in the centre***
box_2 = CenterBox(Base=move_49.Geometry, X=number_slider_26, Y=number_slider_26, Z=number_slider_26)
box_3 = CenterBox(Base=cull_i_4, X=number_slider_26, Y=number_slider_26, Z=number_slider_26)
box_4 = CenterBox(Base=move_50.Geometry, X=Slider(0.0201, range=0..0.1), Y=Slider(0.0062, range=0..0.01), Z=number_slider_26)
rotate_27 = Rotate(Geometry=box_4, Angle=knob_2, Plane=move_50.Geometry)  # -> Geometry, Transform
brep_6 = Brep([box_2, box_3, rotate_27.Geometry])
preview_5 = CustomPreview(Geometry=brep_6, Shader=ColourSwatch(SwatchColor=RGB(79, 107, 45)))

neg_35 = Negative(Value=number_slider_25)
pt_49 = Point(box.Point)
R = Radius(0.006)

# ---- group: 1
pl_2 = PlaneNormal(Origin=pt_49, ZAxis=evalsrf.Normal)
# 1: Just use a better plane to start the circle, and you wont have to rotate anything.
deplane = DeconstructPlane(Plane=pl_2)  # -> Origin, XAxis, YAxis, ZAxis
pl_3 = ConstructPlane(Origin=deplane.Origin, XAxis=deplane.XAxis, YAxis=deplane.ZAxis)
cir_9 = Circle(Plane=pl_3, Radius=R)

# ----
circle = CircleCNR(Center=pt_49, Normal=evalsrf.Normal, Radius=R)
boundary_32 = BoundarySurfaces(Edges=cir_9)
offset_4 = Offset(Surface=boundary_32, Distance=neg_35, Retrim=True)
offset_5 = Offset(Surface=boundary_32, Distance=number_slider_25, Retrim=True)

# ----
# ***Can't get the cylider to rotate the right way in order to boolean the whole where the dowel would go***
loft_2 = Loft(
    Curves=[offset_5, offset_4],
    Options={Adjust=False, Closed=False, LoftEnds=0, LoftSimp=0, LoftType=0, Rebuild=10, Refit=0.01})
rotate_28 = Rotate(Geometry=loft_2, Center=box.Point, From=evalsrf.Normal, To=Vector(0, 1, 0))  # -> Geometry, Transform
preview_6 = CustomPreview(Geometry=loft_2, Shader=ColourSwatch(SwatchColor=RGB(255, 18, 18)))

# ---- group: Side Panel
number_slider_27 = Slider(0.021, range=0..0.1)
neg_36 = Negative(Value=Slider(0.041, range=0..0.1))
Z_18 = UnitZ(Factor=number_slider_27)
Y_13 = UnitY(Factor=neg_36)
move_51 = Move(Geometry=top_frame_5, Motion=Z_18)  # -> Geometry, Transform
move_52 = Move(Geometry=ln, Motion=Y_13)  # -> Geometry, Transform
number_slider_28 = Slider(0.021, range=0..0.1)
X_12 = UnitX(Factor=number_slider_27)
X_13 = UnitX(Factor=number_slider_27)
move_53 = Move(Geometry=move_51.Geometry, Motion=X_12)  # -> Geometry, Transform
move_54 = Move(Geometry=move_52.Geometry, Motion=X_13)  # -> Geometry, Transform
ext_4 = ExtendCurve(Curve=move_54.Geometry, Type=0, Start=number_slider_28, End=number_slider_28)
ext_5 = ExtendCurve(Curve=move_53.Geometry, Type=0, Start=Slider(0.041, range=0..0.1), End=number_slider_28)
number_slider_29 = Slider(1, range=0..1)
divide_7 = DivideCurve(Curve=ext_4, Count=1, Kinks=False)  # -> Points, Tangents, Parameters
divide_8 = DivideCurve(Curve=ext_5, Count=1, Kinks=False)  # -> Points, Tangents, Parameters
item_21 = ListItem(List=divide_8.Points, Index=Slider(0, range=0..10), Wrap=True)
item_22 = ListItem(List=divide_8.Points, Index=number_slider_29, Wrap=True)
item_23 = ListItem(List=divide_7.Points, Index=number_slider_29, Wrap=True)
Y_14 = UnitY(Factor=Slider(0.031, range=0..0.1))
Y_15 = UnitY(Factor=Slider(0.062, range=0..0.1))
move_55 = Move(Geometry=item_23, Motion=Y_15)  # -> Geometry, Transform
X_14 = UnitX(Factor=Slider(0.02, range=0..0.1))

# ----
move_56 = Move(Geometry=item_22, Motion=Y_14)  # -> Geometry, Transform

# ---- group: Side Panel (continued)
merge_2 = Merge(Data1=item_21, Data2=move_56.Geometry, Data3=item_23, Data4=move_55.Geometry)  # -> flatten(Result)
pline_2 = PolyLine(Vertices=merge_2, Closed=True)
join_14 = JoinCurves(Curves=pline_2, Preserve=False)
boundary_33 = BoundarySurfaces(Edges=join_14)
extr_10 = Extrude(Base=boundary_33, Direction=X_14)

# ----
sdiff_4 = SolidDifference(BrepsA=extr_10, BrepsB=brep)
panel_5 = Panel(sdiff_4)

# ---- group: Table Top
number_slider_30 = Slider(0.041, range=0..0.1)
X_15 = UnitX(Factor=number_slider_30)
Y_16 = UnitY(Factor=Slider(0.021, range=0..0.1))
Y_17 = UnitY(Factor=number_slider_30)
ext_6 = ExtendCurve(Curve=line, Type=0, Start=Y_17, End=number_slider_30)
neg_37 = Negative(Value=Y_17)
neg_38 = Negative(Value=X_15)
move_57 = Move(Geometry=top_frame, Motion=neg_37)  # -> Geometry, Transform
move_58 = Move(Geometry=ext_6, Motion=neg_38)  # -> Geometry, Transform
move_59 = Move(Geometry=top_frame_4, Motion=Y_17)  # -> Geometry, Transform
ext_7 = ExtendCurve(Curve=[move_57.Geometry, move_59.Geometry], Type=0, Start=0.041, End=0.041)
Z_19 = UnitZ(Factor=Slider(0.021, range=0..0.1))
Z_20 = UnitZ(Factor=Slider(0.02, range=0..0.1))

# ----
move_60 = Move(Geometry=ext_3, Motion=X_15)  # -> Geometry, Transform

# ---- group: Table Top (continued)
join_15 = JoinCurves(Curves=[ext_7, move_58.Geometry, move_60.Geometry], Preserve=False)  # -> flatten(Curves)
move_61 = Move(Geometry=join_15, Motion=Z_19)  # -> Geometry, Transform

# ----
boundary_34 = BoundarySurfaces(Edges=move_61.Geometry)

# ---- group: Table Top (continued)
extr_11 = Extrude(Base=boundary_34, Direction=Z_20)
sdiff_5 = SolidDifference(BrepsA=extr_11, BrepsB=join_4.Breps)

# ----
preview_7 = CustomPreview(Geometry=sdiff_5, Shader=ColourSwatch(SwatchColor=RGB(70, 164, 199)))

# ---- group: Displacement Calculations: Result must be below 0.1%
len_2 = Length(Curve=crv_10)
length_of_members = Panel(len_2)
number_of_members = Slider(27, range=0..100)
ma = MassAddition(Input=length_of_members)  # -> Result, PartialResults
panel_6 = Panel(ma.Result)
division = Division(A=panel_6, B=number_of_members)
average_member_length = Panel(division)
division_2 = Division(A=analyzethi.MaximumDisplacement_m, B=average_member_length)

# ----
multiplication = Multiplication(A=Slider(100, range=0..100), B=division_2)

# ---- group: Displacement Calculations: Result must be below 0.1% (continued)
result_in = Panel(multiplication)
