# Grasshopper definition PP_003 - AB Comments.gh (Grasshopper 0.9.76)
# plug-ins: Karamba

# Questions: Also if you look at the structure, there is a part on the top where two beams intersect each other however it isn't a node, it reappears no matter what the seed is set to, is this a issue since its just a design proposal?
box = CenterBox(Base=PlaneXY(0, 0, 0), X=1.5, Y=0.5, Z=0.575)
debox = DeconstructBox(Box=box)  # -> Plane, X, Y, Z
debox_2 = DeconstructBox(Box=box)  # -> Plane, X, Y, Z
dedomain = DeconstructDomain(Domain=debox_2.Z)  # -> Start, End
dedomain_2 = DeconstructDomain(Domain=debox.Z)  # -> Start, End
pt = ConstructPoint(XCoordinate=0, YCoordinate=0, ZCoordinate=dedomain.End)
pt_2 = ConstructPoint(XCoordinate=0, YCoordinate=0, ZCoordinate=dedomain_2.Start)
xy = XYPlane(Origin=pt)
xy_2 = XYPlane(Origin=pt_2)
pop2d = Populate2D(Region=box, Count=7, Seed=634)
pop2d_2 = Populate2D(Region=box, Count=Slider(3, range=0..10), Seed=Slider(7, range=0..100))
project = Project(Geometry=pop2d_2, Plane=xy_2)  # -> Geometry, Transform
project_2 = Project(Geometry=pop2d, Plane=xy)  # -> Geometry, Transform
pop3d = Populate3D(Region=box, Count=Slider(1, range=0..10), Seed=Slider(57, range=0..100))
pt_3 = Point(flatten([pop3d, project.Geometry, project_2.Geometry]))
graft = GraftTree(Tree=pt_3, IncludeEmptyLists=True, IncludeNullItems=True)
cps = ClosestPoints(Point=graft, Cloud=pt_3, Count=5)  # -> ClosestPoint, CPIndex, Distance
cull_i = CullIndex(List=cps.ClosestPoint, Indices=0, Wrap=True)
ln = Line(StartPoint=graft, EndPoint=cull_i)  # -> flatten(Line)
eval = EvaluateLength(Curve=ln, Length=0.5, Normalized=True)  # -> Point, Tangent, Parameter
con = DelaunayEdges(Points=project_2.Geometry, Plane=PlaneXY(0, 0, 0))  # -> Connectivity, Edges
number_slider = Slider(4.2, range=0..10)
cullpt = CullDuplicates(Points=eval.Point, Tolerance=0.1, CullMode=1)  # -> Points, Indices, Valence
split = SplitList(List=project.Geometry, Index="2")  # -> ListA, ListB
vec = VectorXYZ(XComponent=Slider(2, range=0..10), YComponent=Slider(2, range=0..10), ZComponent=0)  # -> Vector, Length
# 1: Karamba has a function that finds intersections between lines and splits them for you. Be careful with this component though for other processes, as it may ignore order etc.
item = ListItem(List=ln, Index=cullpt.Indices, Wrap=True)
item_2 = ListItem(List=project_2.Geometry, Index=Slider(5, range=0..10), Wrap=True)
item_3 = ListItem(List=con.Edges, Index=Slider(7, range=0..20), Wrap=True)
Z = UnitZ(Factor=Slider(0.082, range=0.02..0.2))

# ---- group: 1
llinter = LineLineIntersectionKaramba(Line=item, LengthTolerance=0.01)  # -> IntersectionPoints, flatten(LineSubSegements)

# ----
divide = DivideCurve(Curve=item_3, Count=2, Kinks=False)  # -> Points, Tangents, Parameters
readmattable = ReadMaterialTableFromFileKaramba()
shatter = Shatter(Curve=item_3, Parameters=divide.Parameters)
neg = Negative(Value=Z)
matselect = MaterialSelectionKaramba(NameOrListIndexOfMaterial="Wood", Materials=readmattable, menu=[dropdown(1), dropdown(1)])
linetobeam = LineToBeamKaramba(Line=flatten([con.Edges, shatter]), New=True, Remove=True, LimitDistance_m=0.005, BeamIdentifier="Top")  # -> Points, Element, Info
supp = SupportKaramba(PosInd=split.ListA, menu=[buttons(on, on, on, off, off, off)])
supp_2 = SupportKaramba(PosInd=split.ListB, menu=[buttons(on, on, on, off, off, off)])
loads = LoadsKaramba(Vector=Vector(0, 0, -1), LCase=0, mode="Gravity")
loads_2 = LoadsKaramba(ForceVector=vec.Vector, Local=True, PosInd=item_2, LCase=0, mode="Point")
cross_sections = CrossSectionsKaramba(Height_cm=Slider(5, range=0..50), UpperFlangeWidth_cm=number_slider, LowerFlangeWidth_cm=number_slider, mode="Trapezoid")
loads_3 = LoadsKaramba(ForceVector=neg, Local=True, PosInd=[project_2.Geometry, divide.Points], LCase=0, mode="Point")  # -> flatten(Load)
linetobeam_2 = LineToBeamKaramba(Line=llinter.LineSubSegements, New=True, Remove=True, LimitDistance_m=0.005, BeamIdentifier="Frame")  # -> Points, Element, Info
geo = Geometry(<brep referenced from the Rhino model>)
pt_4 = Point(linetobeam_2.Points)
dodecahedron = Geometry(<brep referenced from the Rhino model>)
move = Move(Geometry=dodecahedron, Motion=pt_4)  # -> Geometry, Transform
assemble = AssembleModelKaramba(
    Point=divide.Points,
    Elem=flatten([linetobeam_2.Element, linetobeam.Element]),
    Support=flatten([supp, supp_2]),
    Load=flatten([loads, loads_3, loads_2]),
    CrossSection=cross_sections,
    Material=matselect,
    LimitDistance_m=0.005)  # -> Model, Info, Mass_kg, CenterOfGravity
area = Area(Geometry=move.Geometry)  # -> Area, Centroid
vec2pt = Vector2Pt(PointA=area.Centroid, PointB=pt_4, Unitize=False)  # -> Vector, Length
pt_5 = Point(assemble.CenterOfGravity)
move_2 = Move(Geometry=move.Geometry, Motion=vec2pt.Vector)  # -> Geometry, Transform
modelview = ModelViewKaramba(Model=assemble.Model, LoadCaseFactorsForLinearSuperposition=1, IndexIncrementOfVisibleLoadcase=0)  # -> Model, DeformedMesh, DeformedAxes, DeformedModel

# ---- group: 2
pt_6 = Point(simplify(graft(linetobeam_2.Points)))
trim = TrimWithBrep(Curve=llinter.LineSubSegements, Brep=simplify(graft(move_2.Geometry)))  # -> Inside, Outside
trim_2 = TrimTree(Tree=trim.Inside, Depth=1)
lng = ListLength(List=trim_2)
crv = Curve(graft(trim_2))
# 2: This is one way of starting to make pin joints.
# I'd suggest using pin joints instead of movement joints.
repeat = RepeatData(Data=pt_6, Length=lng)  # -> simplify(graft(Data))
eval_2 = EvaluateLength(Curve=crv, Length=[0, 1], Normalized=True)  # -> Point, Tangent, Parameter
dist = Distance(PointA=repeat, PointB=eval_2.Point)
sort = SortList(Keys=dist, ValuesA=eval_2.Point)  # -> Keys, ValuesA
pline = PolyLine(Vertices=sort.ValuesA, Closed=False)
end = EndPoints(Curve=pline)  # -> Start, End
vec2pt_2 = Vector2Pt(PointA=end.Start, PointB=end.End, Unitize=False)  # -> Vector, Length
Z_2 = UnitZ(Factor=1)
pl = ConstructPlane(Origin=end.End, XAxis=vec2pt_2.Vector, YAxis=Z_2)
planesrf = PlaneSurface(Plane=pl, XSize=Domain(0, 0.06), YSize=Domain(-0.03, 0.03))

# ----
panel = Panel(assemble.Mass_kg)
besobeam = BESOForBeamsKaramba(
    Model=modelview.Model,
    LCases=0,
    TargetMassRatio=Slider(1, range=0..1),
    NumberOfChangeIterations=10,
    NumberOfConvergenceIterations=20,
    WeightingFactorForTension=1,
    WeightingFactorForCompression=1,
    WeightingFactorForShear=0,
    WeightingFactorForMoments=0,
    BESOFactor=0,
    MinimumDistanceBetweenChangingElements=0,
    RelativeWeightLimit=0)  # -> MaximumDisplacement, OptimizedModel, HistoryOfTheBESO, ElementIsActive, DistributionOfWeights
analyzethi = AnalyzeThIKaramba(Model=modelview.Model)  # -> CalculatedModel, MaximumDisplacement_m, ResultingForceOfGravity_kN, ElasticEnergy_kNm
modelview_2 = ModelViewKaramba(Model=besobeam.OptimizedModel, LoadCaseFactorsForLinearSuperposition=1, IndexIncrementOfVisibleLoadcase=0)  # -> Model, DeformedMesh, DeformedAxes, DeformedModel
modelview_3 = ModelViewKaramba(Model=analyzethi.CalculatedModel, LoadCaseFactorsForLinearSuperposition=1, IndexIncrementOfVisibleLoadcase=0)  # -> Model, DeformedMesh, DeformedAxes, DeformedModel
beamview = BeamViewKaramba(Model=modelview_3.Model)  # -> Model, MeshesOfRenderedBeams, DeformedBeamAxes, LegendColors, LegendTags
beamview_2 = BeamViewKaramba(Model=modelview_2.Model)  # -> Model, MeshesOfRenderedBeams, DeformedBeamAxes, LegendColors, LegendTags
legend = Legend(Colour=beamview.LegendColors, Tags=beamview.LegendTags, LegendType=1)
mesh = Mesh(beamview.MeshesOfRenderedBeams)
legend_2 = Legend(Colour=beamview_2.LegendColors, Tags=beamview_2.LegendTags, LegendType=1)
