# Grasshopper definition PP_004 - AB Comments.gh (Grasshopper 0.9.76)
# plug-ins: Karamba

box = CenterBox(Base=PlaneXY(0, 0, 0), X=1.5, Y=0.5, Z=0.575)
debox = DeconstructBox(Box=box)  # -> Plane, X, Y, Z
debox_2 = DeconstructBox(Box=box)  # -> Plane, X, Y, Z
dedomain = DeconstructDomain(Domain=debox_2.Z)  # -> Start, End
dedomain_2 = DeconstructDomain(Domain=debox.Z)  # -> Start, End
pt = ConstructPoint(XCoordinate=0, YCoordinate=0, ZCoordinate=dedomain.End)
pt_2 = ConstructPoint(XCoordinate=0, YCoordinate=0, ZCoordinate=dedomain_2.Start)
xy = XYPlane(Origin=pt)
xy_2 = XYPlane(Origin=pt_2)
pop2d = Populate2D(Region=box, Count=7, Seed=634)
pop2d_2 = Populate2D(Region=box, Count=Slider(3, range=0..10), Seed=Slider(7, range=0..100))
project = Project(Geometry=pop2d_2, Plane=xy_2)  # -> Geometry, Transform
project_2 = Project(Geometry=pop2d, Plane=xy)  # -> Geometry, Transform
pop3d = Populate3D(Region=box, Count=Slider(1, range=0..10), Seed=Slider(57, range=0..100))
pt_3 = Point(flatten([pop3d, project.Geometry, project_2.Geometry]))
graft = GraftTree(Tree=pt_3, IncludeEmptyLists=True, IncludeNullItems=True)
cps = ClosestPoints(Point=graft, Cloud=pt_3, Count=5)  # -> ClosestPoint, CPIndex, Distance
cull_i = CullIndex(List=cps.ClosestPoint, Indices=0, Wrap=True)
ln = Line(StartPoint=graft, EndPoint=cull_i)  # -> flatten(Line)
eval = EvaluateLength(Curve=ln, Length=0.5, Normalized=True)  # -> Point, Tangent, Parameter
number_slider = Slider(7, range=0..20)
con = DelaunayEdges(Points=project_2.Geometry, Plane=PlaneXY(0, 0, 0))  # -> Connectivity, Edges
cullpt = CullDuplicates(Points=eval.Point, Tolerance=0.1, CullMode=1)  # -> Points, Indices, Valence
split = SplitList(List=project.Geometry, Index="2")  # -> ListA, ListB
# 1: Karamba has a function that finds intersections between lines and splits them for you. Be careful with this component though for other processes, as it may ignore order etc.
item = ListItem(List=ln, Index=cullpt.Indices, Wrap=True)
item_2 = ListItem(List=con.Edges, Index=number_slider, Wrap=True)
cull_i_2 = CullIndex(List=con.Edges, Indices=number_slider, Wrap=True)

# ---- group: 1
llinter = LineLineIntersectionKaramba(Line=item, LengthTolerance=0.01)  # -> IntersectionPoints, flatten(LineSubSegements)

# ----
divide = DivideCurve(Curve=item_2, Count=2, Kinks=False)  # -> Points, Tangents, Parameters
shatter = Shatter(Curve=item_2, Parameters=divide.Parameters)
crv = Curve([cull_i_2, shatter])

# ---- group: 3
eval_2 = EvaluateLength(Curve=crv, Length=0.5, Normalized=True)  # -> Point, Tangent, Parameter
# 3: This will remove double upped lines.
# 
# Your double upped lines are creating duplicate beams in the output. It will also mean your structural integrity will change.
eval_3 = EvaluateLength(Curve=llinter.LineSubSegements, Length=0.5, Normalized=True)  # -> Point, Tangent, Parameter
cullpt_2 = CullDuplicates(Points=eval_2.Point, Tolerance=0.1, CullMode=1)  # -> Points, Indices, Valence
item_3 = ListItem(List=crv, Index=cullpt_2.Indices, Wrap=True)
eval_4 = EvaluateLength(Curve=item_3, Length=0.5, Normalized=True)  # -> Point, Tangent, Parameter
cp = ClosestPoint(Point=eval_4.Point, Cloud=eval_3.Point)  # -> ClosestPoint, CPIndex, Distance
expression = Expression(x=cp.Distance, Expression="x≈0")
dispatch = Dispatch(List=cp.CPIndex, DispatchPattern=expression)  # -> ListA, ListB
cull_i_3 = CullIndex(List=llinter.LineSubSegements, Indices=dispatch.ListA, Wrap=True)

# ----
number_slider_2 = Slider(4.2, range=0..10)
vec = VectorXYZ(XComponent=Slider(2, range=0..10), YComponent=Slider(2, range=0..10), ZComponent=0)  # -> Vector, Length
item_4 = ListItem(List=project_2.Geometry, Index=Slider(5, range=0..10), Wrap=True)
Z = UnitZ(Factor=Slider(0.082, range=0.02..0.2))
readmattable = ReadMaterialTableFromFileKaramba()
neg = Negative(Value=Z)
matselect = MaterialSelectionKaramba(NameOrListIndexOfMaterial="Wood", Materials=readmattable, menu=[dropdown(1), dropdown(1)])
linetobeam = LineToBeamKaramba(Line=flatten(item_3), New=True, Remove=True, LimitDistance_m=0.005, BeamIdentifier="Top")  # -> Points, Element, Info
cross_sections = CrossSectionsKaramba(
    Height_cm=Slider(5, range=0..50),
    UpperFlangeWidth_cm=number_slider_2,
    LowerFlangeWidth_cm=number_slider_2,
    mode="Trapezoid")
panel = Panel(dispatch.ListA)
supp = SupportKaramba(PosInd=split.ListA, menu=[buttons(on, on, on, off, off, off)])
loads = LoadsKaramba(ForceVector=vec.Vector, Local=True, PosInd=item_4, LCase=0, mode="Point")
supp_2 = SupportKaramba(PosInd=split.ListB, menu=[buttons(on, on, on, off, off, off)])
loads_2 = LoadsKaramba(Vector=Vector(0, 0, -1), LCase=0, mode="Gravity")
loads_3 = LoadsKaramba(ForceVector=neg, Local=True, PosInd=[project_2.Geometry, divide.Points], LCase=0, mode="Point")  # -> flatten(Load)
linetobeam_2 = LineToBeamKaramba(Line=cull_i_3, New=True, Remove=True, LimitDistance_m=0.005, BeamIdentifier="Frame")  # -> Points, Element, Info
crv_2 = Curve(flatten([cull_i_3, item_3]))
pt_4 = Point(linetobeam_2.Points)
dodecahedron = Geometry(<brep referenced from the Rhino model>)
move = Move(Geometry=dodecahedron, Motion=pt_4)  # -> Geometry, Transform
assemble = AssembleModelKaramba(
    Point=divide.Points,
    Elem=flatten([linetobeam_2.Element, linetobeam.Element]),
    Support=flatten([supp, supp_2]),
    Load=flatten([loads_2, loads_3, loads]),
    CrossSection=cross_sections,
    Material=matselect,
    LimitDistance_m=0.005)  # -> Model, Info, Mass_kg, CenterOfGravity
area = Area(Geometry=move.Geometry)  # -> Area, Centroid
vec2pt = Vector2Pt(PointA=area.Centroid, PointB=pt_4, Unitize=False)  # -> Vector, Length
pt_5 = Point(assemble.CenterOfGravity)
move_2 = Move(Geometry=move.Geometry, Motion=vec2pt.Vector)  # -> Geometry, Transform
modelview = ModelViewKaramba(Model=assemble.Model, LoadCaseFactorsForLinearSuperposition=1, IndexIncrementOfVisibleLoadcase=0)  # -> Model, DeformedMesh, DeformedAxes, DeformedModel

# ---- group: 2
trim = TrimWithBrep(Curve=crv_2, Brep=simplify(graft(move_2.Geometry)))  # -> Inside, Outside
pt_6 = Point(simplify(graft(linetobeam_2.Points)))
trim_2 = TrimTree(Tree=trim.Inside, Depth=1)
lng = ListLength(List=trim_2)
crv_3 = Curve(graft(trim_2))
# 2: This is one way of starting to make pin joints.
# I'd suggest using pin joints instead of movement joints.
repeat = RepeatData(Data=pt_6, Length=lng)  # -> simplify(graft(Data))
eval_5 = EvaluateLength(Curve=crv_3, Length=[0, 1], Normalized=True)  # -> Point, Tangent, Parameter
dist = Distance(PointA=repeat, PointB=eval_5.Point)
sort = SortList(Keys=dist, ValuesA=eval_5.Point)  # -> Keys, ValuesA
pline = PolyLine(Vertices=sort.ValuesA, Closed=False)
end = EndPoints(Curve=pline)  # -> Start, End
vec2pt_2 = Vector2Pt(PointA=end.Start, PointB=end.End, Unitize=False)  # -> Vector, Length
Z_2 = UnitZ(Factor=1)
pl = ConstructPlane(Origin=end.End, XAxis=vec2pt_2.Vector, YAxis=Z_2)
planesrf = PlaneSurface(Plane=pl, XSize=Domain(-0.015, 0.06), YSize=Domain(-0.02, 0.02))

# ----
panel_2 = Panel(assemble.Mass_kg)
besobeam = BESOForBeamsKaramba(
    Model=modelview.Model,
    LCases=0,
    TargetMassRatio=Slider(1, range=0..1),
    NumberOfChangeIterations=10,
    NumberOfConvergenceIterations=20,
    WeightingFactorForTension=1,
    WeightingFactorForCompression=1,
    WeightingFactorForShear=0,
    WeightingFactorForMoments=0,
    BESOFactor=0,
    MinimumDistanceBetweenChangingElements=0,
    RelativeWeightLimit=0)  # -> MaximumDisplacement, OptimizedModel, HistoryOfTheBESO, ElementIsActive, DistributionOfWeights
analyzethi = AnalyzeThIKaramba(Model=modelview.Model)  # -> CalculatedModel, MaximumDisplacement_m, ResultingForceOfGravity_kN, ElasticEnergy_kNm
panel_3 = Panel(analyzethi.MaximumDisplacement_m)
modelview_2 = ModelViewKaramba(Model=besobeam.OptimizedModel, LoadCaseFactorsForLinearSuperposition=1, IndexIncrementOfVisibleLoadcase=0)  # -> Model, DeformedMesh, DeformedAxes, DeformedModel
modelview_3 = ModelViewKaramba(Model=analyzethi.CalculatedModel, LoadCaseFactorsForLinearSuperposition=1, IndexIncrementOfVisibleLoadcase=0)  # -> Model, DeformedMesh, DeformedAxes, DeformedModel
beamview = BeamViewKaramba(Model=modelview_3.Model)  # -> Model, MeshesOfRenderedBeams, DeformedBeamAxes, LegendColors, LegendTags
beamview_2 = BeamViewKaramba(Model=modelview_2.Model)  # -> Model, MeshesOfRenderedBeams, DeformedBeamAxes, LegendColors, LegendTags
number_slider_3 = Slider(0.01, range=0..0.01)
legend = Legend(Colour=beamview.LegendColors, Tags=beamview.LegendTags, LegendType=1)
legend_2 = Legend(Colour=beamview_2.LegendColors, Tags=beamview_2.LegendTags, LegendType=1)
offset = Offset(Surface=planesrf, Distance=expr("-x", number_slider_3), Retrim=True)
offset_2 = Offset(Surface=planesrf, Distance=number_slider_3, Retrim=True)
loft = Loft(
    Curves=[offset, offset_2],
    Options={Adjust=False, Closed=False, LoftEnds=0, LoftSimp=0, LoftType=0, Rebuild=10, Refit=0.01})
eval_6 = EvaluateLength(Curve=offset_2, Length=Slider(0.6, range=0..1), Normalized=True)  # -> Point, Tangent, Parameter
eval_7 = EvaluateLength(Curve=offset_2, Length=Slider(0.23, range=0..1), Normalized=True)  # -> Point, Tangent, Parameter
eval_8 = EvaluateLength(Curve=offset, Length=Slider(0.6, range=0..1), Normalized=True)  # -> Point, Tangent, Parameter
ln_2 = Line(StartPoint=eval_6.Point, EndPoint=eval_7.Point)
ln_3 = Line(StartPoint=eval_8.Point, EndPoint=eval_6.Point)
eval_9 = EvaluateLength(Curve=ln_2, Length=Slider(0.5, range=0..1), Normalized=True)  # -> Point, Tangent, Parameter
pframe = PerpFrame(Curve=ln_3, Parameter=0.01)
item_5 = ListItem(List=move_2.Geometry, Index=[1, 2, 3, 7, 8, 9, 10, 11], Wrap=True)
edges = BrepEdges(Brep=item_5)  # -> Naked, Interior, NonManifold
circle = CircleCNR(Center=eval_9.Point, Normal=pframe, Radius=Slider(0.01, range=0..0.1))
srf = Surface(<surface referenced from the Rhino model>)
item_6 = ListItem(List=edges.Interior, Index=[15, 19, 24, 27, 29], Wrap=True)
cyl = Cylinder(Base=circle, Radius=Slider(0.01, range=0..0.1), Length=Slider(-0.02, range=-1..0.1))
Z_3 = UnitZ(Factor=Slider(0.03, range=0..0.1))
disc = Discontinuity(Curve=item_6, Level=1)  # -> Points, Parameters
eval_10 = EvaluateLength(Curve=item_6, Length=Slider(0.5, range=0..1), Normalized=True)  # -> Point, Tangent, Parameter
cap = CapHoles(Brep=cyl)
mesh = Mesh(beamview.MeshesOfRenderedBeams)
extr = Extrude(Base=srf, Direction=Z_3)
pt_7 = Point(flatten(disc.Points))
pt_8 = Point(flatten(eval_10.Point))

item_7 = ListItem(List=pt_7, Index=Slider(64, range=0..100), Wrap=True)
item_8 = ListItem(List=pt_8, Index=Slider(34, range=0..100), Wrap=True)
ln_4 = Line(StartPoint=item_7, EndPoint=item_8)
eval_11 = EvaluateLength(Curve=ln_4, Length=Slider(0.5, range=0..1), Normalized=True)  # -> Point, Tangent, Parameter
circle_2 = CircleCNR(Center=eval_11.Point, Normal=Vector(0, 0, 1), Radius=Slider(0.01, range=0..0.1))
cyl_2 = Cylinder(Base=circle_2, Radius=Slider(0.01, range=0..0.1), Length=Slider(0.037, range=-1..0.1))
cap_2 = CapHoles(Brep=cyl_2)

item_9 = ListItem(List=pt_7, Index=Slider(24, range=0..100), Wrap=True)
item_10 = ListItem(List=pt_8, Index=Slider(14, range=0..100), Wrap=True)
ln_5 = Line(StartPoint=item_9, EndPoint=item_10)
eval_12 = EvaluateLength(Curve=ln_5, Length=Slider(0.5, range=0..1), Normalized=True)  # -> Point, Tangent, Parameter
circle_3 = CircleCNR(Center=eval_12.Point, Normal=Vector(0, 0, 1), Radius=Slider(0.01, range=0..0.1))
cyl_3 = Cylinder(Base=circle_3, Radius=Slider(0.01, range=0..0.1), Length=Slider(0.039, range=-1..0.1))
cap_3 = CapHoles(Brep=cyl_3)

item_11 = ListItem(List=pt_7, Index=Slider(4, range=0..5), Wrap=True)
item_12 = ListItem(List=pt_8, Index=Slider(4, range=0..5), Wrap=True)
ln_6 = Line(StartPoint=item_11, EndPoint=item_12)
eval_13 = EvaluateLength(Curve=ln_6, Length=Slider(0.5, range=0..1), Normalized=True)  # -> Point, Tangent, Parameter
circle_4 = CircleCNR(Center=eval_13.Point, Normal=Vector(0, 0, 1), Radius=Slider(0.01, range=0..0.1))
cyl_4 = Cylinder(Base=circle_4, Radius=Slider(0.01, range=0..0.1), Length=Slider(0.037, range=-1..0.1))
cap_4 = CapHoles(Brep=cyl_4)

item_13 = ListItem(List=pt_7, Index=Slider(54, range=0..100), Wrap=True)
item_14 = ListItem(List=pt_8, Index=Slider(29, range=0..100), Wrap=True)
ln_7 = Line(StartPoint=item_13, EndPoint=item_14)
eval_14 = EvaluateLength(Curve=ln_7, Length=Slider(0.5, range=0..1), Normalized=True)  # -> Point, Tangent, Parameter
circle_5 = CircleCNR(Center=eval_14.Point, Normal=Vector(0, 0, 1), Radius=Slider(0.01, range=0..0.1))
cyl_5 = Cylinder(Base=circle_5, Radius=Slider(0.01, range=0..0.1), Length=Slider(0.043, range=-1..0.1))
cap_5 = CapHoles(Brep=cyl_5)

item_15 = ListItem(List=pt_7, Index=Slider(74, range=0..100), Wrap=True)
item_16 = ListItem(List=pt_8, Index=Slider(39, range=0..100), Wrap=True)
ln_8 = Line(StartPoint=item_15, EndPoint=item_16)
eval_15 = EvaluateLength(Curve=ln_8, Length=Slider(0.5, range=0..1), Normalized=True)  # -> Point, Tangent, Parameter
circle_6 = CircleCNR(Center=eval_15.Point, Normal=Vector(0, 0, 1), Radius=Slider(0.01, range=0..0.1))
cyl_6 = Cylinder(Base=circle_6, Radius=Slider(0.01, range=0..0.1), Length=Slider(0.037, range=-1..0.1))
cap_6 = CapHoles(Brep=cyl_6)

item_17 = ListItem(List=pt_7, Index=Slider(14, range=0..100), Wrap=True)
item_18 = ListItem(List=pt_8, Index=Slider(9, range=0..100), Wrap=True)
ln_9 = Line(StartPoint=item_17, EndPoint=item_18)
eval_16 = EvaluateLength(Curve=ln_9, Length=Slider(0.5, range=0..1), Normalized=True)  # -> Point, Tangent, Parameter
circle_7 = CircleCNR(Center=eval_16.Point, Normal=Vector(0, 0, 1), Radius=Slider(0.01, range=0..0.1))
cyl_7 = Cylinder(Base=circle_7, Radius=Slider(0.01, range=0..0.1), Length=Slider(0.035, range=-1..0.1))
cap_7 = CapHoles(Brep=cyl_7)

item_19 = ListItem(List=pt_7, Index=Slider(37, range=0..100), Wrap=True)
item_20 = ListItem(List=pt_8, Index=Slider(19, range=0..100), Wrap=True)
ln_10 = Line(StartPoint=item_19, EndPoint=item_20)
eval_17 = EvaluateLength(Curve=ln_10, Length=Slider(0.5, range=0..1), Normalized=True)  # -> Point, Tangent, Parameter
circle_8 = CircleCNR(Center=eval_17.Point, Normal=Vector(0, 0, 1), Radius=Slider(0.01, range=0..0.1))
cyl_8 = Cylinder(Base=circle_8, Radius=Slider(0.01, range=0..0.1), Length=Slider(0.037, range=-1..0.1))
cap_8 = CapHoles(Brep=cyl_8)

item_21 = ListItem(List=pt_7, Index=Slider(44, range=0..100), Wrap=True)
item_22 = ListItem(List=pt_8, Index=Slider(24, range=0..100), Wrap=True)
ln_11 = Line(StartPoint=item_21, EndPoint=item_22)
eval_18 = EvaluateLength(Curve=ln_11, Length=Slider(0.5, range=0..1), Normalized=True)  # -> Point, Tangent, Parameter
circle_9 = CircleCNR(Center=eval_18.Point, Normal=Vector(0, 0, 1), Radius=Slider(0.01, range=0..0.1))
cyl_9 = Cylinder(Base=circle_9, Radius=Slider(0.01, range=0..0.1), Length=Slider(0.037, range=-1..0.1))
cap_9 = CapHoles(Brep=cyl_9)
