# Grasshopper definition Tut 001 - Tensegrity Test.gh (Grasshopper 0.9.76)
# plug-ins: Human, Kangaroo Components

dpipeline = DynamicGeometryPipeline(
    LayerFilter="Tension",
    TypeFilter="Curve",
    NameFilter="*",
    enableFullPath=False,
    GroupByLayer=False,
    GroupByType=False,
    IncludeHidden=True,
    IncludeLocked=True)
dpipeline_2 = DynamicGeometryPipeline(
    LayerFilter="Compression",
    TypeFilter="Curve",
    NameFilter="*",
    enableFullPath=False,
    GroupByLayer=False,
    GroupByType=False,
    IncludeHidden=True,
    IncludeLocked=True)
dpipeline_3 = DynamicGeometryPipeline(
    LayerFilter="Fixed",
    TypeFilter="Point",
    NameFilter="*",
    enableFullPath=False,
    GroupByLayer=False,
    GroupByType=False,
    IncludeHidden=True,
    IncludeLocked=True)
crv = Curve(dpipeline)
pt = Point(dpipeline_3)
crv_2 = Curve(dpipeline_2)
len = Length(Curve=crv)
len_2 = Length(Curve=crv_2)
expression = Expression(x=len, Expression="x*.8")
merge = Merge(Data1=crv_2, Data2=crv)
springs = SpringsFromLine(Connection=crv_2, Stiffness=1000, Damping=10, RestLength=len_2, UpperCutoff=0, LowerCutoff=0, Plasticity=0)
springs_2 = SpringsFromLine(Connection=crv, Stiffness=10, Damping=10, RestLength=expression, UpperCutoff=0, LowerCutoff=0, Plasticity=0)
eval = EvaluateLength(Curve=graft(merge), Length=[0, 1], Normalized=True)  # -> Point, Tangent, Parameter
kangaroo_settings = KangarooSettings(
    Tolerance=0.001,
    TimeStep=0.01,
    SubIterations=10,
    Floor=True,
    Drag=1,
    Restitution=0.7,
    StaticFriction=10,
    KineticFriction=10,
    Settle=2,
    Tumble=1,
    Sound=False,
    Solver=0)
Z = UnitZ(Factor=Slider(-1, range=-50..50))
cullpt = CullDuplicates(Points=flatten(eval.Point), Tolerance=0.1, CullMode=3)  # -> Points, Indices, Valence
uforce = UnaryForce(Point=cullpt.Points, Force=Z)
timer = Timer(TimerInterval=20, Target=kangaroo)
kangaroo = KangarooPhysics(
    ForceObjects=flatten([springs, springs_2, uforce]),
    AnchorPoints=pt,
    Settings=kangaroo_settings,
    Geometry=cullpt.Points,
    SimulationReset=Toggle(False))  # -> Out, Iterations, ParticlesOut, GeometryOut, KE
cp = ClosestPoint(Point=eval.Point, Cloud=cullpt.Points)  # -> ClosestPoint, CPIndex, Distance
item = ListItem(List=kangaroo.GeometryOut, Index=cp.CPIndex, Wrap=True)
pline = PolyLine(Vertices=item, Closed=False)  # -> flatten(Polyline)
lng = ListLength(List=crv_2)
split = SplitList(List=pline, Index=lng)  # -> ListA, ListB
crv_3 = Curve(split.ListA)
X = X(Domain(-0.25, 0.25))
pframe = PerpFrame(Curve=crv_3, Parameter=0)
len_3 = Length(Curve=crv_3)
box = DomainBox(Base=pframe, X=X, Y=X, Z=len_3)
crv_4 = Curve(split.ListB)
