# Grasshopper definition Maths Surfaces.gh (Grasshopper 0.9.76)

panel = Panel("""cx = math.cos(u)
cy = math.sin(u)
cz = v
sx = math.sin(cz)*cx
sy = math.sin(cz)*cy
sz = math.cos(cz)
x = (3/2)*cz
y = (13/10)*math.sin(60*cz/240)-math.sin(-5*cz/2)/6+sx*cy
z = (13/10)*math.sin(sx*sx)""")
maths_form = MathsForm(variables="0<=u>=2*pi,0<=v>=pi", formulas=panel)
intcrv = Interpolate(Vertices=maths_form, Degree=3, Periodic=False, KnotStyle=1)  # -> Curve, Length, Domain

# ==== cluster MathsForm
formulas = ClusterInput()
variables = ClusterInput()
variables_2 = Data(variables)
formulas_2 = Data(formulas)
rep = ReplaceText(Text=variables_2, Find="<=", Replace="≤", RecursiveReplace=False)
rep_2 = ReplaceText(Text=rep, Find=">=", Replace="≥", RecursiveReplace=False)
rep_3 = ReplaceText(Text=rep_2, Find="pi", Replace="π", RecursiveReplace=False)
split = TextSplit(Text=rep_3, Separators=",")
rep_4 = ReplaceText(Text=split, Find="≤", Replace="~", RecursiveReplace=False)
rep_5 = ReplaceText(Text=rep_4, Find="≥", Replace="~", RecursiveReplace=False)
split_2 = TextSplit(Text=rep_5, Separators="~")
item = ListItem(List=split_2, Index=0, Wrap=True)  # -> Item, Item1, Item2
eval = Evaluate(F=item.Item2)
eval_2 = Evaluate(F=item.Item)
dom = ConstructDomain(DomainStart=eval_2, DomainEnd=eval)  # -> simplify(flatten(Domain))
int = Integer(50)
item_2 = ListItem(List=dom, Index=0, Wrap=True)  # -> Item, Item1
join = TextJoin(Text=formulas_2, Join="~")
range = Range(Domain=item_2.Item1, Steps=int)  # -> graft(Range)
range_2 = Range(Domain=item_2.Item, Steps=int)
python = PythonScript(var=join, u=range_2, v=range)  # -> out, xo, yo, zo
# ---------- python: Python ----------
import json
import math
var = var.split('~')
print (var)
for i in var:
    exec i
xo = x
yo = y
zo = z
# ---------- end python ----------
pt = ConstructPoint(XCoordinate=python.xo, YCoordinate=python.yo, ZCoordinate=python.zo)  # -> simplify(Point)
pt_2 = Point(pt)
pt_3 = ClusterOutput(pt_2)
